# Grasshopper definition Figure1-13_preview_with_panel.gh (Grasshopper 1.0.9)

# Figure 1-13: Preview with Panel
number_slider = Slider(2, range=0..10)
series = Series(Start=0, Step=1, Count=10)
expression = Expression(x=number_slider, y=series, Expression="x^2+y^2")
panel = Panel(expression)
