# Grasshopper definition Figure1-14_adding_inputs.gh (Grasshopper 1.0.9)

polygon = Polygon(Plane=PlaneXY(0, 0, 0), Radius=3, Segments="4", FilletRadius=0)  # -> Polygon, Length
explode = Explode(Curve=polygon.Polygon, Recursive=True)  # -> Segments, Vertices
list_item = ListItem(List=explode.Segments, Index=0, Wrap=True)  # -> Item, Item1, Item2, Item3
# 5
# 6
c0 = Curve(list_item.Item)
# 7
c1 = Curve(list_item.Item1)
# 8
c2 = Curve(list_item.Item2)
# 9
c3 = Curve(list_item.Item3)

# ----
# 1
panel = Panel("4")
# Figure 1-14: Adding Inputs
polygon_2 = Polygon(Plane=PlaneXY(0, 0, 0), Radius=3, Segments=panel, FilletRadius=0)  # -> Polygon, Length
# 2
explode_2 = Explode(Curve=polygon_2.Polygon, Recursive=True)  # -> Segments, Vertices
# 3
# 4
list_item_2 = ListItem(List=explode_2.Segments, Index=0, Wrap=True)
