# Grasshopper definition Figure1-18_1-19_1-20_rectangles_panels.gh (Grasshopper 1.0.9)

# ---- group: Figure 1-18
rectangle = Rectangle(Plane=PlaneXY(0, 0, 0), XSize="7.5", YSize="7.5", Radius=0)  # -> Rectangle, Length
rectangle_2 = Rectangle(Plane=PlaneXY(0, 0, 0), XSize=["7.5", "12.5"], YSize=["7.5", "12.5"], Radius=0)  # -> Rectangle, Length

# ---- group: Figure 1-19
side_length = Panel("""1
2
3
4
5""")
rectangle_3 = Rectangle(Plane=PlaneXY(0, 0, 0), XSize=side_length, YSize=side_length, Radius=0)  # -> Rectangle, Length

# ---- group: Figure 1-20
rectangle_4 = Rectangle(Plane=PlaneXY(0, 0, 0), XSize="2.5 to 11.5", YSize="4.5 to 9.5", Radius=0)  # -> Rectangle, Length
construct_domain = ConstructDomain(DomainStart="2.5", DomainEnd="11.5")
construct_domain_2 = ConstructDomain(DomainStart="4.5", DomainEnd="9.5")
rectangle_5 = Rectangle(Plane=PlaneXY(0, 0, 0), XSize=construct_domain, YSize=construct_domain_2, Radius=0)  # -> Rectangle, Length

# ---- group: Extra - Number node right click -> Set Number
number = Number(3)
rectangle_6 = Rectangle(Plane=PlaneXY(0, 0, 0), XSize=number, YSize=number, Radius=0)  # -> Rectangle, Length

# ---- group: Extra - Number node right click -> Set Multiple Numbers
number_2 = Number([3, 5, 6])
rectangle_7 = Rectangle(Plane=PlaneXY(0, 0, 0), XSize=number_2, YSize=number_2, Radius=0)  # -> Rectangle, Length
