# Grasshopper definition Figure1-24_booleans.gh (Grasshopper 1.0.9)

# ---- group: Figure 1-24: Creating Booleans
boolean = Boolean(Slider(-1, range=-1..1))
boolean_2 = Boolean(Slider(0, range=-1..1))
boolean_3 = Boolean(Slider(2, range=0..5))
panel = Panel([Toggle(False), "True", boolean, boolean_2, boolean_3, Button()])
