# Grasshopper definition Figure1-25_create_a_point.gh (Grasshopper 1.0.9)

# ---- group: Figure 1-25: Create a Point
construct_point = ConstructPoint(XCoordinate="1", YCoordinate="2", ZCoordinate="3")
line_sdl = LineSDL(Start="{1,2,3}", Direction=Vector(0, 0, 1), Length=1)
line_sdl_2 = LineSDL(Start=construct_point, Direction=Vector(0, 0, 1), Length=1)
