# Grasshopper definition Figure1-26_types_of_wires.gh (Grasshopper 1.0.9)

# ---- group: Figure 1-26: Types of Wires
number_slider = Slider(3, range=0..100)
series = Series(Start=0, Step=1, Count=number_slider)
series_2 = Series(Start=0, Step=1, Count=number_slider)
construct_point = ConstructPoint(XCoordinate=graft(series), YCoordinate=series_2, ZCoordinate=0)
panel = Panel(series)
panel_2 = Panel(construct_point)
