# Grasshopper definition Figure1-28_move_rotate.gh (Grasshopper 1.0.9)

# Move Along Z+, Rotate Top 90 Deg.
number_slider = Slider(10, range=0..10)
# 1
polygon = Polygon(Plane=PlaneXY(0, 0, 0), Radius=number_slider, Segments=Slider(6, range=0..10), FilletRadius=0)  # -> Polygon, Length
# 2
Z = UnitZ(Factor=Slider(20, range=1..100))
# 3
move = Move(Geometry=polygon.Polygon, Motion=Z)  # -> Geometry, Transform
# 4
rotate = Rotate(Geometry=move.Geometry, Angle=1.570796327, Plane=PlaneXY(0, 0, 0))  # -> Geometry, Transform
# 5
loft = Loft(
    Curves=[polygon.Polygon, rotate.Geometry],
    Options={Adjust=False, Closed=False, LoftEnds=0, LoftSimp=0, LoftType=0, Rebuild=10, Refit=0.01})
