# Grasshopper definition Figure1-29_move_rotate_scale.gh (Grasshopper 1.0.9)

# Move Along Z+, Rotate Top 90 Deg.,
# Then Scale Top
number_slider = Slider(10, range=0..10)
# 1
polygon = Polygon(Plane=PlaneXY(0, 0, 0), Radius=number_slider, Segments=Slider(6, range=0..10), FilletRadius=0)  # -> Polygon, Length
# 2
Z = UnitZ(Factor=Slider(20, range=1..100))
number_slider_2 = Slider(0.7, range=0.1..2)
# 3
move = Move(Geometry=polygon.Polygon, Motion=Z)  # -> Geometry, Transform
# 4
rotate = Rotate(Geometry=move.Geometry, Angle=1.570796327, Plane=PlaneXY(0, 0, 0))  # -> Geometry, Transform
# 5
scale_nu = ScaleNU(Geometry=rotate.Geometry, Plane=PlaneXY(0, 0, 0), ScaleX=number_slider_2, ScaleY=number_slider_2, ScaleZ=1)  # -> Geometry, Transform
# 6
loft = Loft(
    Curves=[polygon.Polygon, scale_nu.Geometry],
    Options={Adjust=False, Closed=False, LoftEnds=0, LoftSimp=0, LoftType=0, Rebuild=10, Refit=0.01})
