# Grasshopper definition Figure1-9_component_colors.gh (Grasshopper 1.0.9)

# ----
# a
# 2
# b
number_slider = Slider(-10, range=-100..100)
divide_curve = DivideCurve(Count=10, Kinks=False)  # -> Points, Tangents, Parameters
series = Series(Start=0, Step=1, Count=number_slider)
panel = Panel(series)

# ----
# 3
# a
# b
cylinder = Cylinder(Base=PlaneXY(0, 0, 0), Radius=0.5, Length=1)
division = Division(A="5", B="0")
divide_curve_2 = DivideCurve(Curve=cylinder, Count=10, Kinks=False)  # -> Points, Tangents, Parameters

# ----
# Figure 1-9: Component Colors
# 1
circle = Circle(Plane=PlaneXY(0, 0, 0), Radius=1)

# ----
# 4
# a
# b
circle_2 = Circle(Plane=PlaneXY(0, 0, 0), Radius=1)
unit_x = UnitX(Factor=1)

# ----
# 5
circle_3 = Circle(Plane=PlaneXY(0, 0, 0), Radius=1)  # disabled
# 6
circle_4 = Circle(Plane=PlaneXY(0, 0, 0), Radius=1)
