# Grasshopper definition Figure10-10_to_10-17_TileFromImage_ImportImage.gh (Grasshopper 1.0.9)

# ----
# Image to Mesh - Using Import Image
# 1
# 1a
img = ImportImage(File="C:\Users\isabe\Documents\Grasshopper\Book\Ch10_GeneratingModelsFromImages\exploration\succulent.jpg")
# 1b
demesh = DeconstructMesh(Mesh=img)  # -> Vertices, Faces, Colours, Normals
# 1e
dom = ConstructDomain(DomainStart=Slider(6, range=0..50), DomainEnd=Slider(0, range=0..10))
# 1c
pdecon = Deconstruct(Point=demesh.Vertices)  # -> XComponent, YComponent, ZComponent
# 1d
remap = RemapNumbers(Value=demesh.Colours, Source=Domain(0, 1), Target=dom)  # -> Mapped, Clipped
# 1f
pt = ConstructPoint(XCoordinate=pdecon.XComponent, YCoordinate=pdecon.YComponent, ZCoordinate=remap.Mapped)
# 1g
conmesh = ConstructMesh(Vertices=pt, Faces=demesh.Faces)

# ----
# 3a
conmesh_2 = ConstructMesh(Vertices=demesh.Vertices, Faces=demesh.Faces)

# ----
# 2a
# 2b
# 2f
# 2c
# 2e
# 2h
# 2g
# 2d
py3 = Python3Script(m=conmesh)  # -> z_min, tb, bb, lb, rb, n_pts; inputs m: Mesh
# ---------- py3: Python ----------
import ghpythonlib.components as ghc

mbbox, _ = ghc.BoundingBox(m, ghc.XYPlane(ghc.ConstructPoint(0,0,0)))
_, dom_x, dom_y, dom_z = ghc.DeconstructBox(mbbox)
_, x_max = ghc.DeconstructDomain(dom_x)
_, y_max = ghc.DeconstructDomain(dom_y)
z_min, _ = ghc.DeconstructDomain(dom_z)
border_edges, _, _ = ghc.MeshEdges(m)
tb, _ = ghc.SubList(border_edges, ghc.ConstructDomain(0, x_max-1), True)
v_edges, _ = ghc.SubList(border_edges, ghc.ConstructDomain(x_max, x_max+y_max*2-1), True)
rb, lb = ghc.Dispatch(v_edges, [True, False])
bb, _ = ghc.SubList(border_edges, ghc.ConstructDomain(x_max+y_max*2, ghc.ListLength(border_edges)-1), True)
n_pts = (x_max + y_max)*2
# ---------- end py3 ----------
join = JoinCurves(Curves=[py3.tb, py3.rb, py3.bb, py3.lb], Preserve=False)
# 2
divide = DivideCurve(Curve=join, Count=py3.n_pts, Kinks=False)  # -> Points, Tangents, Parameters
pdecon_2 = Deconstruct(Point=divide.Points)  # -> XComponent, YComponent, ZComponent
loft_opt = LoftOptions(Closed="True", Adjust=False, Rebuild=0, Refit=0, Type=0)

# ----
# 3
# 3b
subtraction = Subtraction(A=py3.z_min, B=Slider(5, range=1..10))
# 3c
Z = UnitZ(Factor=subtraction)

pt_2 = ConstructPoint(XCoordinate=pdecon_2.XComponent, YCoordinate=pdecon_2.YComponent, ZCoordinate=subtraction)
ln = Line(StartPoint=divide.Points, EndPoint=pt_2)
loft = Loft(Curves=ln, Options=loft_opt)

# ---- group: Moved Bottom
# 3d
move = Move(Geometry=conmesh_2, Motion=Z)  # -> Geometry, Transform

# ----
# 4a
mjoin = MeshJoin(Meshes=[conmesh, loft, move.Geometry])
# 4
# 4b
unim = UnifyMesh(Mesh=mjoin)  # -> Result, Count
