# Grasshopper definition Figure10-18_to_10-19_ProjecTileOnSphere.gh (Grasshopper 1.0.9)

subtraction = Subtraction(A="489", B="1")
subtraction_2 = Subtraction(A="664", B="1")
dom = ConstructDomain(DomainStart=1, DomainEnd="664")
dom_2 = ConstructDomain(DomainStart=1, DomainEnd="489")
# Image to Mesh - Using Image Sampler
addition = Addition(A="664", B="489")
# 1b
range = Range(Domain=dom, Steps=subtraction_2)
# 1c
range_2 = Range(Domain=dom_2, Steps=subtraction)
# 1d
# 1
pt = ConstructPoint(XCoordinate=graft(range), YCoordinate=range_2, ZCoordinate=0)
image = ImageSampler(
    pt,
    FilePath="C:\Users\isabe\Documents\Grasshopper\Book\Ch10_GeneratingModelsFromImages\exploration\succulent.jpg",
    Filter="Colour",
    Interpolate=False,
    Umax=664,
    Umin=1,
    Vmax=489,
    Vmin=1,
    Wrap=1)
# 1a
multiplication = Multiplication(A=addition, B="2")
# 1f
dom_3 = ConstructDomain(DomainStart=Slider(6, range=0..50), DomainEnd=Slider(0, range=0..10))
# 1e
remap = RemapNumbers(Value=image, Source=Domain(0, 1), Target=dom_3)  # -> Mapped, Clipped
# 1g
Z = UnitZ(Factor=remap.Mapped)
# 1h
move = Move(Geometry=pt, Motion=Z)  # -> Geometry, Transform
# 1j
srfgrid = SurfaceFromPoints(Points=flatten(move.Geometry), UCount="664", Interpolate=False)
# 1i
pt_2 = Point(flatten(move.Geometry))

# ----
# 2a
flip = FlipMatrix(Data=srfgrid)
# 2b
bbox = BoundingBox(Content=flip, Plane=PlaneXY(0, 0, 0))  # -> Box, Box_2
# 2c
debrep = DeconstructBrep(Brep=bbox.Box)  # -> Faces, Edges, Vertices
# 2
number_slider = Slider(5, range=1..10)
neg = Negative(Value=number_slider)
Z_2 = UnitZ(Factor=neg)

# ----
# 3a
debrep_2 = DeconstructBrep(Brep=flip)  # -> Faces, Edges, Vertices
# 3b
join = JoinCurves(Curves=debrep_2.Edges, Preserve=False)
# 3c
divide = DivideCurve(Curve=join, Count=multiplication, Kinks=False)  # -> Points, Tangents, Parameters
# 3
# 3d
pdecon = Deconstruct(Point=divide.Points)  # -> XComponent, YComponent, ZComponent
# 3e
bnd = Bounds(Numbers=pdecon.ZComponent)
# 3f
dedomain = DeconstructDomain(Domain=bnd)  # -> Start, End
# 3g
subtraction_3 = Subtraction(A=dedomain.Start, B=number_slider)
# 3h
pt_3 = ConstructPoint(XCoordinate=pdecon.XComponent, YCoordinate=pdecon.YComponent, ZCoordinate=subtraction_3)
# 3i
ln = Line(StartPoint=divide.Points, EndPoint=pt_3)
# 3k
loft_opt = LoftOptions(Closed="True", Adjust=False, Rebuild=0, Refit=0, Type=0)

# ---- group: BOTTOM
# 2d
item = ListItem(List=debrep.Faces, Index=Slider(4, range=0..6), Wrap=True)

# ---- group: Moved Bottom
# 2e
move_2 = Move(Geometry=item, Motion=Z_2)  # -> Geometry, Transform

# ---- group: Sides
# 3j
loft = Loft(Curves=ln, Options=loft_opt)

# ----
# 4a
brep = Brep(flatten([flip, loft, move_2.Geometry]))
# 4
# 4b
mesh = MeshBrep(
    Brep=brep,
    Settings={GridMaxCount=0, GridMinCount=16, JaggedSeams=False, MaxEdgeLength=0, MinEdgeLength=0.0001, MinTolerance=0, Refine=True, RefineAngle=0, RelativeTolerance=0.65, SimplePlanes=True, Tolerance=0})
# 4c
mjoin = MeshJoin(Meshes=mesh)
# 4d
unim = UnifyMesh(Mesh=mjoin)  # -> Result, Count

# ----
# 5a
# 5
mesh_2 = MeshBrep(
    Brep=flatten([loft, srfgrid]),
    Settings={GridMaxCount=0, GridMinCount=16, JaggedSeams=False, MaxEdgeLength=0, MinEdgeLength=0.0001, MinTolerance=0, Refine=True, RefineAngle=0, RelativeTolerance=0.65, SimplePlanes=True, Tolerance=0})
# 5f
expression = Expression(x="664", y="489", Expression="sqrt((x/2)²+(y/2)²)")
# 5b
mjoin_2 = MeshJoin(Meshes=mesh_2)
# 5c
unim_2 = UnifyMesh(Mesh=mjoin_2)  # -> Result, Count
# 5i
panel = Panel("{0.5, 0, 0}")
# 5d
bbox_2 = BoundingBox(Content=unim_2.Result, Plane=PlaneXY(0, 0, 0), UnionBox=False)  # -> Box, Box_2
# 5e
area = Area(Geometry=bbox_2.Box)  # -> Area, Centroid
# 5g
sph = Sphere(Base=area.Centroid, Radius=expression)
# 5h
splop = Splop(Geometry=unim_2.Result, Plane=area.Centroid, Surface=sph, Parameter=panel, Angle=0, Rigid=False)
# 5j
mjoin_3 = MeshJoin(Meshes=[splop, sph])
