# Grasshopper definition Figure10-22_to_10-25_TileToMold.gh (Grasshopper 1.0.9)

subtraction = Subtraction(A="489", B="1")
subtraction_2 = Subtraction(A="664", B="1")
dom = ConstructDomain(DomainStart=1, DomainEnd="664")
dom_2 = ConstructDomain(DomainStart=1, DomainEnd="489")
# Image to Mesh - Using Image Sampler
addition = Addition(A="664", B="489")
# 1b
range = Range(Domain=dom, Steps=subtraction_2)
# 1c
range_2 = Range(Domain=dom_2, Steps=subtraction)
# 1d
# 1
pt = ConstructPoint(XCoordinate=graft(range), YCoordinate=range_2, ZCoordinate=0)
image = ImageSampler(
    pt,
    FilePath="C:\Users\isabe\Documents\Grasshopper\Book\Ch10_GeneratingModelsFromImages\exploration\succulent.jpg",
    Filter="Colour",
    Interpolate=False,
    Umax=664,
    Umin=1,
    Vmax=489,
    Vmin=1,
    Wrap=1)
# 1a
multiplication = Multiplication(A=addition, B="2")
# 1f
dom_3 = ConstructDomain(DomainStart=Slider(0, range=0..50), DomainEnd=Slider(6, range=0..10))
# 1e
remap = RemapNumbers(Value=image, Source=Domain(0, 1), Target=dom_3)  # -> Mapped, Clipped
# 1g
Z = UnitZ(Factor=remap.Mapped)
# 1h
move = Move(Geometry=pt, Motion=Z)  # -> Geometry, Transform
# 1j
srfgrid = SurfaceFromPoints(Points=flatten(move.Geometry), UCount="664", Interpolate=False)
# 1i
pt_2 = Point(flatten(move.Geometry))

# ----
# 2a
flip = FlipMatrix(Data=srfgrid)
# 2b
bbox = BoundingBox(Content=flip, Plane=PlaneXY(0, 0, 0))  # -> Box, Box_2
# 2c
debrep = DeconstructBrep(Brep=bbox.Box)  # -> Faces, Edges, Vertices
# 2
number_slider = Slider(5, range=1..10)
neg = Negative(Value=number_slider)
Z_2 = UnitZ(Factor=neg)

# ----
# 3a
debrep_2 = DeconstructBrep(Brep=flip)  # -> Faces, Edges, Vertices
# 3b
join = JoinCurves(Curves=debrep_2.Edges, Preserve=False)
# 3c
divide = DivideCurve(Curve=join, Count=multiplication, Kinks=False)  # -> Points, Tangents, Parameters
# 3
# 3d
pdecon = Deconstruct(Point=divide.Points)  # -> XComponent, YComponent, ZComponent
# 3e
bnd = Bounds(Numbers=pdecon.ZComponent)
# 3f
dedomain = DeconstructDomain(Domain=bnd)  # -> Start, End
# 3g
subtraction_3 = Subtraction(A=dedomain.Start, B=number_slider)
# 3h
pt_3 = ConstructPoint(XCoordinate=pdecon.XComponent, YCoordinate=pdecon.YComponent, ZCoordinate=subtraction_3)
# 3i
ln = Line(StartPoint=divide.Points, EndPoint=pt_3)
# 3k
loft_opt = LoftOptions(Closed="True", Adjust=False, Rebuild=0, Refit=0, Type=0)

# ---- group: BOTTOM
# 2d
item = ListItem(List=debrep.Faces, Index=Slider(4, range=0..6), Wrap=True)

# ---- group: Moved Bottom
# 2e
move_2 = Move(Geometry=item, Motion=Z_2)  # -> Geometry, Transform

# ----
# 2b1
multiplication_2 = Multiplication(A=Slider(10, range=1..100), B="4")
# 2b2
len = Length(Curve=move_2.Geometry)
# 2b3
addition_2 = Addition(A=multiplication_2, B=len)
# 2b
number_slider_2 = Slider(100, range=1..200)
# 2b5
area = Area(Geometry=move_2.Geometry)  # -> Area, Centroid
# 2b4
division = Division(A=addition_2, B=len)
# 2b6
scale = Scale(Geometry=move_2.Geometry, Center=area.Centroid, Factor=division)  # -> Geometry, Transform
# 2b9
Z_3 = UnitZ(Factor=number_slider_2)
# 2b7
boundary = BoundarySurfaces(Edges=[scale.Geometry, move_2.Geometry])
# 2b8
extr = Extrude(Base=boundary, Direction=Z_3)

# ---- group: Sides
# 3j
loft = Loft(Curves=ln, Options=loft_opt)

# ----
# 4a
brep = Brep(flatten([srfgrid, loft, move_2.Geometry, extr]))
# 4
# 4b
mesh = MeshBrep(
    Brep=brep,
    Settings={GridMaxCount=0, GridMinCount=16, JaggedSeams=False, MaxEdgeLength=0, MinEdgeLength=0.0001, MinTolerance=0, Refine=True, RefineAngle=0, RelativeTolerance=0.65, SimplePlanes=True, Tolerance=0})
# 4c
mjoin = MeshJoin(Meshes=mesh)
