# Grasshopper definition Figure11-14_to_11-18_2D_tree_variations.gh (Grasshopper 1.0.9)

# ---- group: 2D tree - Dandelion
py3 = Python3Script(axiom="X", rewriting_rules="{\"X\": \"[F[+X][-X][--X]]FX\", \"F\": \"FF\"}", iterations=Slider(7, range=1..10))  # -> out, str_output; inputs axiom: String, rewriting_rules: String, iterations: Int32
# ---------- py3: Python ----------
import json

def rewrite(str_to_rewrite: str, rewriting_rules: dict):
    str_out = ""
    for c in str_to_rewrite:
        rewritten = False
        for predecessor, successor in rewriting_rules.items():
            if c == predecessor:
                str_out = "".join((str_out, successor))
                rewritten = True
                break
        if not rewritten:
            str_out = "".join((str_out, c))

    return str_out

def rewrite_recur(
    str_to_rewrite: str, rewriting_rules: dict, level: int, max_level: int
):
    if level == max_level:
        return str_to_rewrite

    str_to_rewrite = rewrite(str_to_rewrite, rewriting_rules)
    print("level " + str(level) + " = " + str_to_rewrite)
    level += 1
    return rewrite_recur(str_to_rewrite, rewriting_rules, level, max_level)

rr = json.loads(rewriting_rules)
print(str(type(rr)) + " = " + str(rr))
str_output = rewrite_recur(axiom, rr, 0, iterations)
# ---------- end py3 ----------

# ---- group: 2D tree - More right branching
py3_2 = Python3Script(axiom="X", rewriting_rules="{\"X\": \"F[+X][-X][--X]FX\", \"F\": \"FF\"}", iterations=Slider(7, range=1..10))  # -> out, str_output; inputs axiom: String, rewriting_rules: String, iterations: Int32; same code as py3

# ---- group: 2D tree - Left leaning branches
py3_3 = Python3Script(axiom="X", rewriting_rules="{\"X\": \"F[+X+X][-X]FX\", \"F\": \"FF\"}", iterations=Slider(7, range=1..10))  # -> out, str_output; inputs axiom: String, rewriting_rules: String, iterations: Int32; same code as py3

# ---- group: 2D tree - 3X instead of 2X branch lengthening
py3_4 = Python3Script(axiom="X", rewriting_rules="{\"X\": \"F[+X][-X]FX\", \"F\": \"FFF\"}", iterations=Slider(7, range=1..10))  # -> out, str_output; inputs axiom: String, rewriting_rules: String, iterations: Int32; same code as py3

# ---- group: 2D tree
py3_5 = Python3Script(axiom="X", rewriting_rules="{\"X\": \"F[+X][-X]FX\", \"F\": \"FF\"}", iterations=Slider(7, range=1..10))  # -> out, str_output; inputs axiom: String, rewriting_rules: String, iterations: Int32; same code as py3

# ----
py3_6 = Python3Script(rewritten_str=py3.str_output, theta="22.5", step_dist="1")  # -> out, polyline; inputs rewritten_str: String, theta: Double, step_dist: Double
# ---------- py3_6: Python ----------
import Rhino.Geometry as rg
import ghpythonlib.components as ghc
from math import radians

class turtle_2D:
    def __init__(
        self, rewritten_str: str, theta: float, step_dist: float
    ):
        self.rewritten_str = rewritten_str
        self.theta = theta
        self.step_dist = step_dist

        self.polyline = [rg.Polyline()]
        self.polyline[-1].Add(0.0, 0.0, 0.0)
        self.lcs = rg.Transform.Identity
        self.heading = rg.Vector3d(rg.Point3d(0.0, 1.0, 0.0))

        ### Branching addition ###
        self.stack = []
        self.prev_popped_pt = []
        self.prev_step_popped = False
        self.last_pt_stats = [0, 0]

    def update_heading(self, mat_rot):
        self.lcs = self.lcs * mat_rot
        self.heading = rg.Vector3d(rg.Point3d(self.lcs.M10, self.lcs.M11, self.lcs.M12))
        self.heading.Unitize()   

    def draw(self):
        for c in self.rewritten_str:
            ### Branching addition ###
            if self.prev_step_popped:
                self.last_pt_stats[0], self.last_pt_stats[1], self.heading, self.lcs = self.prev_popped_pt
                self.prev_step_popped = False
                self.prev_popped_pt.clear()
            start_pt = self.polyline[self.last_pt_stats[0]].PointAt(self.last_pt_stats[1])

            # Only interpret and draw the turtle symbols, don't draw the rest of the alphabet.
            if c == "[":  ### Branching addition ###
                self.stack.append([self.last_pt_stats[0], self.last_pt_stats[1], self.heading.Clone(), self.lcs.Clone()])        
                self.polyline.append(rg.Polyline())
                self.polyline[-1].Add(start_pt[0], start_pt[1], start_pt[2])
                self.last_pt_stats = [len(self.polyline)-1, 0]
            elif c == "]":  ### Branching addition ###
                if len(self.stack) > 0:
                    self.prev_popped_pt = self.stack.pop()
                    self.prev_step_popped = True           
            elif c == "F" or c == "L" or c == "R":
                self.one_step_forward(start_pt, True)
            elif c == "f":
                self.one_step_forward(start_pt, False)
            elif c == "+":  # Turn LEFT
                mat_rot = rg.Transform.Rotation(radians(-self.theta), rg.Vector3d(rg.Point3d(self.lcs.M20, self.lcs.M21, self.lcs.M22)), start_pt)
                self.update_heading(mat_rot)
            elif c == "-":  # Turn RIGHT
                mat_rot = rg.Transform.Rotation(radians(self.theta), rg.Vector3d(rg.Point3d(self.lcs.M20, self.lcs.M21, self.lcs.M22)), start_pt)
                self.update_heading(mat_rot)

    def one_step_forward(self, start_pt, should_draw: bool = True):
        trans_vec = self.heading * self.step_dist
        end_pt = start_pt + trans_vec

        if should_draw:
            self.polyline[self.last_pt_stats[0]].Add(end_pt[0], end_pt[1], end_pt[2])
            self.last_pt_stats[1] = self.polyline[self.last_pt_stats[0]].Count - 1
        else:
            self.polyline.append(rg.Polyline())
            self.polyline[-1].Add(end_pt[0], end_pt[1], end_pt[2])           
            self.last_pt_stats = [len(self.polyline) - 1, 0]

t = turtle_2D(rewritten_str, theta, step_dist)
t.draw()
polyline = t.polyline
# ---------- end py3_6 ----------
py3_7 = Python3Script(rewritten_str=py3_2.str_output, theta="22.5", step_dist="1")  # -> out, polyline; inputs rewritten_str: String, theta: Double, step_dist: Double; same code as py3_6
py3_8 = Python3Script(rewritten_str=py3_3.str_output, theta="22.5", step_dist="1")  # -> out, polyline; inputs rewritten_str: String, theta: Double, step_dist: Double; same code as py3_6
py3_9 = Python3Script(rewritten_str=py3_4.str_output, theta="22.5", step_dist="1")  # -> out, polyline; inputs rewritten_str: String, theta: Double, step_dist: Double; same code as py3_6
# L-System axiom and rewriting rule used in this GH definition are
# from "The Algorithmic Beauty of Plants" (book) by Przemyslaw Prusinkiewicz, Aristid Lindenmayer et al., with the author's revisions.
py3_10 = Python3Script(rewritten_str=py3_5.str_output, theta="22.5", step_dist="1")  # -> out, polyline; inputs rewritten_str: String, theta: Double, step_dist: Double
# ---------- py3_10: Python ----------
import Rhino.Geometry as rg
import ghpythonlib.components as ghc
from math import radians

class turtle_2D:
    def __init__(
        self, rewritten_str: str, theta: float, step_dist: float
    ):
        self.rewritten_str = rewritten_str
        self.theta = theta
        self.step_dist = step_dist

        self.polyline = [rg.Polyline()]
        self.polyline[-1].Add(0.0, 0.0, 0.0)
        self.lcs = rg.Transform.Identity
        self.heading = rg.Vector3d(rg.Point3d(0.0, 1.0, 0.0))

        ### Branching addition ###
        self.stack = []
        self.prev_popped_pt = []
        self.prev_step_popped = False
        self.last_pt_stats = [0, 0]

    def update_heading(self, mat_rot):
        self.lcs = self.lcs * mat_rot
        self.heading = rg.Vector3d(rg.Point3d(self.lcs.M10, self.lcs.M11, self.lcs.M12))
        self.heading.Unitize()   

    def draw(self):
        for c in self.rewritten_str:
            ### Branching addition ###
            if self.prev_step_popped:
                self.last_pt_stats[0], self.last_pt_stats[1], self.heading, self.lcs = self.prev_popped_pt
                self.prev_step_popped = False
                self.prev_popped_pt.clear()
            start_pt = self.polyline[self.last_pt_stats[0]].PointAt(self.last_pt_stats[1])

            # Only interpret and draw the turtle symbols, don't draw the rest of the alphabet.
            if c == "[":  ### Branching addition ###
                self.stack.append([self.last_pt_stats[0], self.last_pt_stats[1], self.heading.Clone(), self.lcs.Clone()])        
                self.polyline.append(rg.Polyline())
                self.polyline[-1].Add(start_pt[0], start_pt[1], start_pt[2])
                self.last_pt_stats = [len(self.polyline)-1, 0]
            elif c == "]":  ### Branching addition ###
                if len(self.stack) > 0:
                    self.prev_popped_pt = self.stack.pop()
                    self.prev_step_popped = True           
            elif c == "F":
                self.one_step_forward(start_pt, True)
            elif c == "f":
                self.one_step_forward(start_pt, False)
            elif c == "+":  # Turn LEFT
                mat_rot = rg.Transform.Rotation(radians(-self.theta), rg.Vector3d(rg.Point3d(self.lcs.M20, self.lcs.M21, self.lcs.M22)), start_pt)
                self.update_heading(mat_rot)
            elif c == "-":  # Turn RIGHT
                mat_rot = rg.Transform.Rotation(radians(self.theta), rg.Vector3d(rg.Point3d(self.lcs.M20, self.lcs.M21, self.lcs.M22)), start_pt)
                self.update_heading(mat_rot)

    def one_step_forward(self, start_pt, should_draw: bool = True):
        trans_vec = self.heading * self.step_dist
        end_pt = start_pt + trans_vec

        if should_draw:
            self.polyline[self.last_pt_stats[0]].Add(end_pt[0], end_pt[1], end_pt[2])
            self.last_pt_stats[1] = self.polyline[self.last_pt_stats[0]].Count - 1
        else:
            self.polyline.append(rg.Polyline())
            self.polyline[-1].Add(end_pt[0], end_pt[1], end_pt[2])           
            self.last_pt_stats = [len(self.polyline) - 1, 0]

t = turtle_2D(rewritten_str, theta, step_dist)
t.draw()
polyline = t.polyline
# ---------- end py3_10 ----------
