# Grasshopper definition Figure11-21_3D_tree_variations.gh (Grasshopper 1.0.9)

panel = Panel("{\"X\": \"[&&FX]////[&&FX]////[&&FX]////[&&FX]\", \"F\": \"FF\"}")

# ---- group: 3D tree
py3 = Python3Script(axiom="FX", rewriting_rules=panel, iterations=Slider(3, range=1..10))  # -> out, str_output; inputs axiom: String, rewriting_rules: String, iterations: Int32
# ---------- py3: Python ----------
import json

def rewrite(str_to_rewrite: str, rewriting_rules: dict):
    str_out = ""
    for c in str_to_rewrite:
        rewritten = False
        for predecessor, successor in rewriting_rules.items():
            if c == predecessor:
                str_out = "".join((str_out, successor))
                rewritten = True
                break
        if not rewritten:
            str_out = "".join((str_out, c))

    return str_out

def rewrite_recur(
    str_to_rewrite: str, rewriting_rules: dict, level: int, max_level: int
):
    if level == max_level:
        return str_to_rewrite

    str_to_rewrite = rewrite(str_to_rewrite, rewriting_rules)
    print("level " + str(level) + " = " + str_to_rewrite)
    level += 1
    return rewrite_recur(str_to_rewrite, rewriting_rules, level, max_level)

rr = json.loads(rewriting_rules)
print(str(type(rr)) + " = " + str(rr))
str_output = rewrite_recur(axiom, rr, 0, iterations)
# ---------- end py3 ----------

# ----
py3_2 = Python3Script(rewritten_str=py3.str_output, theta="22.5", step_dist="3")  # -> out, polyline; inputs rewritten_str: String, theta: Double, step_dist: Double
# ---------- py3_2: Python ----------
import Rhino.Geometry as rg
import ghpythonlib.components as ghc
from math import radians

class turtle_2D:
    def __init__(
        self, rewritten_str: str, theta: float, step_dist: float
    ):
        self.rewritten_str = rewritten_str
        self.theta = theta
        self.step_dist = step_dist

        self.polyline = [rg.Polyline()]
        self.polyline[-1].Add(0.0, 0.0, 0.0)
        self.lcs = rg.Transform.Identity
        self.heading = rg.Vector3d(rg.Point3d(0.0, 1.0, 0.0))

        ### Branching addition ###
        self.stack = []
        self.prev_popped_pt = []
        self.prev_step_popped = False
        self.last_pt_stats = [0, 0]

    def update_heading(self, mat_rot):
            self.lcs = self.lcs * mat_rot
            self.heading = rg.Vector3d(rg.Point3d(self.lcs.M10, self.lcs.M11, self.lcs.M12))
            self.heading.Unitize()      

    def draw(self):
        for c in self.rewritten_str:
            ### Branching addition ###
            if self.prev_step_popped:
                self.last_pt_stats[0], self.last_pt_stats[1], self.heading, self.lcs = self.prev_popped_pt
                self.prev_step_popped = False
                self.prev_popped_pt.clear()
            start_pt = self.polyline[self.last_pt_stats[0]].PointAt(self.last_pt_stats[1])

            # Only interpret and draw the turtle symbols, don't draw the rest of the alphabet.
            if c == "[":  ### Branching addition ###
                self.stack.append([self.last_pt_stats[0], self.last_pt_stats[1], self.heading.Clone(), self.lcs.Clone()])        
                self.polyline.append(rg.Polyline())
                self.polyline[-1].Add(start_pt[0], start_pt[1], start_pt[2])
                self.last_pt_stats = [len(self.polyline)-1, 0]
            elif c == "]":  ### Branching addition ###
                if len(self.stack) > 0:
                    self.prev_popped_pt = self.stack.pop()
                    self.prev_step_popped = True           
            elif c == "F":
                self.one_step_forward(start_pt, True)
            elif c == "f":
                self.one_step_forward(start_pt, False)
            elif c == "+":  # Turn LEFT
                mat_rot = rg.Transform.Rotation(radians(-self.theta), rg.Vector3d(rg.Point3d(self.lcs.M20, self.lcs.M21, self.lcs.M22)), start_pt)
                self.update_heading(mat_rot)
            elif c == "-":  # Turn RIGHT
                mat_rot = rg.Transform.Rotation(radians(self.theta), rg.Vector3d(rg.Point3d(self.lcs.M20, self.lcs.M21, self.lcs.M22)), start_pt)
                self.update_heading(mat_rot)
            elif c == "&":  # Pitch down
                mat_rot = rg.Transform.Rotation(radians(self.theta), rg.Vector3d(rg.Point3d(self.lcs.M00, self.lcs.M01, self.lcs.M02)), start_pt)
                self.update_heading(mat_rot)
            elif c == "^":  # Pitch up
                mat_rot = rg.Transform.Rotation(radians(-self.theta), rg.Vector3d(rg.Point3d(self.lcs.M00, self.lcs.M01, self.lcs.M02)), start_pt)
                self.update_heading(mat_rot)
            elif c == "\\":  # Roll left
                mat_rot = rg.Transform.Rotation(radians(-self.theta), rg.Vector3d(rg.Point3d(self.lcs.M10, self.lcs.M11, self.lcs.M12)), start_pt)
                self.update_heading(mat_rot)
            elif c == "/":  # Roll right
                mat_rot = rg.Transform.Rotation(radians(self.theta), rg.Vector3d(rg.Point3d(self.lcs.M10, self.lcs.M11, self.lcs.M12)), start_pt)
                self.update_heading(mat_rot)
            elif c == "|":  # Turn around
                mat_rot = rg.Transform.Rotation(radians(-180), rg.Vector3d(rg.Point3d(self.lcs.M20, self.lcs.M21, self.lcs.M22)), start_pt)
                self.update_heading(mat_rot)

    def one_step_forward(self, start_pt, should_draw: bool = True):
        trans_vec = self.heading * self.step_dist
        end_pt = start_pt + trans_vec

        if should_draw:
            self.polyline[self.last_pt_stats[0]].Add(end_pt[0], end_pt[1], end_pt[2])
            self.last_pt_stats[1] = self.polyline[self.last_pt_stats[0]].Count - 1
        else:
            self.polyline.append(rg.Polyline())
            self.polyline[-1].Add(end_pt[0], end_pt[1], end_pt[2])           
            self.last_pt_stats = [len(self.polyline) - 1, 0]

t = turtle_2D(rewritten_str, theta, step_dist)
t.draw()
polyline = t.polyline
# ---------- end py3_2 ----------
X = UnitX(Factor=1)
rot3d = Rotate3D(Geometry=py3_2.polyline, Angle=1.570796327, Center=Point(0, 0, 0), Axis=X)  # -> Geometry, Transform
project = Project(Geometry=rot3d.Geometry, Plane=PlaneXY(0, 0, 0))  # -> Geometry, Transform
bbox = BoundingBox(Content=project.Geometry, Plane=PlaneXY(0, 0, 0), UnionBox=True)  # -> Box, Box_2
scale = Scale(Geometry=bbox.Box_2, Center=Point(0, 0, 0), Factor=Slider(1.1, range=0..10))  # -> Geometry, Transform
arrrec = RectangularArray(Geometry=rot3d.Geometry, Cell=scale.Geometry, XCount="3", YCount="2")  # -> Geometry, Transform
item = ListItem(List=arrrec.Geometry, Index=0, Wrap=True)  # -> flatten(Item), flatten(Item1), flatten(Item2), flatten(Item3), flatten(Item4)
mp = MultiPipe(
    Curves=item.Item,
    NodeSize=Slider(-1, range=-100..1),
    EndOffset=1,
    StrutSize=Slider(0.7, range=-10..10),
    Segment=0,
    KinkAngle=0.6,
    CubeFit=0,
    Caps="1")
mp_2 = MultiPipe(
    Curves=item.Item1,
    NodeSize=Slider(0.5, range=0.1..1),
    EndOffset=1,
    StrutSize=Slider(0.5, range=-10..10),
    Segment=0,
    KinkAngle=0.6,
    CubeFit=0,
    Caps="1")
mp_3 = MultiPipe(
    Curves=item.Item2,
    NodeSize=Slider(0.5, range=0.1..1),
    EndOffset=1,
    StrutSize=Slider(3, range=-10..10),
    Segment=0,
    KinkAngle=0.6,
    CubeFit=0,
    Caps="1")
mp_4 = MultiPipe(
    Curves=item.Item3,
    NodeSize=Slider(0.5, range=0.1..1),
    EndOffset=1,
    StrutSize=Slider(0.05, range=-10..10),
    Segment=0,
    KinkAngle=0.6,
    CubeFit=0,
    Caps="1")
mp_5 = MultiPipe(
    Curves=item.Item4,
    NodeSize=Slider(0.5, range=-100..1),
    EndOffset=1,
    StrutSize=Slider(-5, range=-10..10),
    Segment=0,
    KinkAngle=0.6,
    CubeFit=0,
    Caps="1")
geo = Geometry([mp_2, mp_3, mp_4, mp_5, mp])
