# Grasshopper definition Figure11-5_rewriting.gh (Grasshopper 1.0.9)

py3 = Python3Script(axiom="b", rewriting_rules="{\"a\": \"ab\", \"b\": \"a\"}", iterations=Slider(5, range=1..10))  # -> out, str_output; inputs axiom: String, rewriting_rules: String, iterations: Int32
# ---------- py3: Python ----------
import json

def rewrite(str_to_rewrite: str, rewriting_rules: dict):
    str_out = ""
    for c in str_to_rewrite:
        rewritten = False
        for predecessor, successor in rewriting_rules.items():
            if c == predecessor:
                str_out = "".join((str_out, successor))
                rewritten = True
                break
        if not rewritten:
            str_out = "".join((str_out, c))

    return str_out

def rewrite_recur(
    str_to_rewrite: str, rewriting_rules: dict, level: int, max_level: int
):
    if level == max_level:
        return str_to_rewrite

    str_to_rewrite = rewrite(str_to_rewrite, rewriting_rules)
    print("level " + str(level) + " = " + str_to_rewrite)
    level += 1
    return rewrite_recur(str_to_rewrite, rewriting_rules, level, max_level)

rr = json.loads(rewriting_rules)
print(str(type(rr)) + " = " + str(rr))
str_output = rewrite_recur(axiom, rr, 0, iterations)
# ---------- end py3 ----------
panel = Panel(py3.str_output)
panel_2 = Panel(py3.out)
