# Grasshopper definition Figure11-6_turtle2D.gh (Grasshopper 1.0.9)

py3 = Python3Script(axiom="F", rewriting_rules="{\"F\": \"F+F+F+F\"}", iterations="1")  # -> out, str_output; inputs axiom: String, rewriting_rules: String, iterations: Int32
# ---------- py3: Python ----------
import json

def rewrite(str_to_rewrite: str, rewriting_rules: dict):
    str_out = ""
    for c in str_to_rewrite:
        rewritten = False
        for predecessor, successor in rewriting_rules.items():
            if c == predecessor:
                str_out = "".join((str_out, successor))
                rewritten = True
                break
        if not rewritten:
            str_out = "".join((str_out, c))

    return str_out

def rewrite_recur(
    str_to_rewrite: str, rewriting_rules: dict, level: int, max_level: int
):
    if level == max_level:
        return str_to_rewrite

    str_to_rewrite = rewrite(str_to_rewrite, rewriting_rules)
    print("level " + str(level) + " = " + str_to_rewrite)
    level += 1
    return rewrite_recur(str_to_rewrite, rewriting_rules, level, max_level)

rr = json.loads(rewriting_rules)
print(str(type(rr)) + " = " + str(rr))
str_output = rewrite_recur(axiom, rr, 0, iterations)
# ---------- end py3 ----------
py3_2 = Python3Script(axiom="F", rewriting_rules="{\"F\": \"F+F--F+F\"}", iterations="4")  # -> out, str_output; inputs axiom: String, rewriting_rules: String, iterations: Int32; same code as py3
py3_3 = Python3Script(rewritten_str=py3.str_output, theta="90", step_dist="1")  # -> out, polyline; inputs rewritten_str: String, theta: Double, step_dist: Double
# ---------- py3_3: Python ----------
import Rhino.Geometry as rg
from math import radians

class turtle_2D:
    def __init__(
        self, rewritten_str: str, theta: float, step_dist: float
    ):
        self.rewritten_str = rewritten_str
        self.theta = theta
        self.step_dist = step_dist

        self.polyline = [rg.Polyline()]
        self.polyline[-1].Add(0.0, 0.0, 0.0)
        self.lcs = rg.Transform.Identity
        self.heading = rg.Vector3d(rg.Point3d(0.0, 1.0, 0.0))

    def update_heading(self, mat_rot):
        self.lcs = self.lcs * mat_rot
        self.heading = rg.Vector3d(rg.Point3d(self.lcs.M10, self.lcs.M11, self.lcs.M12))
        self.heading.Unitize() 

    def draw(self):
        for c in self.rewritten_str:
            last_pt_index = self.polyline[-1].Count-1
            start_pt = self.polyline[-1].PointAt(last_pt_index)
            print(start_pt)          
            if c == "F":
                self.one_step_forward(start_pt)
            elif c == "+":  # Turn LEFT
                mat_rot = rg.Transform.Rotation(radians(-self.theta), rg.Vector3d(rg.Point3d(self.lcs.M20, self.lcs.M21, self.lcs.M22)), start_pt)
                self.update_heading(mat_rot)
            elif c == "-":  # Turn RIGHT
                mat_rot = rg.Transform.Rotation(radians(self.theta), rg.Vector3d(rg.Point3d(self.lcs.M20, self.lcs.M21, self.lcs.M22)), start_pt)
                self.update_heading(mat_rot)

    def one_step_forward(self, start_pt):
        trans_vec = self.heading * self.step_dist
        end_pt = start_pt + trans_vec
        self.polyline[-1].Add(end_pt[0], end_pt[1], end_pt[2])

t = turtle_2D(rewritten_str, theta, step_dist)
t.draw()
polyline = t.polyline
# ---------- end py3_3 ----------
py3_4 = Python3Script(rewritten_str=py3_2.str_output, theta="75", step_dist="1")  # -> out, polyline; inputs rewritten_str: String, theta: Double, step_dist: Double; same code as py3_3
