# Grasshopper definition Figure12-11_parsing_shp_and_xlsx_files_python3.gh (Grasshopper 1.0.9)

scale_factor = Slider(0.1, range=0..2)
path = FilePath("C:\Users\isabe\Documents\Grasshopper\Book\Ch12_GeneratingCitySkylineModelsFromBuildingFootprint(GIS)Data\exploration\qgis_battery_park.shp")
path_2 = FilePath("C:\Users\isabe\Documents\Grasshopper\Book\Ch12_GeneratingCitySkylineModelsFromBuildingFootprint(GIS)Data\exploration\qgis_battery_park.xlsx")
py3 = Python3Script(
    plot_shapes=Toggle(False),
    shp_file_path=path,
    xlsx_file_path=path_2,
    gnd_elev_key="groundelev",
    roof_h_key="heightroof",
    shp_area_key="shape_area",
    scale_factor=scale_factor)  # -> wb_preview, ground_elevs, roof_heights, shape_areas; inputs plot_shapes: Boolean, shp_file_path: String, xlsx_file_path: String, gnd_elev_key: String, roof_h_key: String, shp_area_key: String, scale_factor: Double
# ---------- py3: Python ----------
# r "pip: pyshp>=3.0.3"
# r "pip: pandas>=3.0.1"
# r "pip: matplotlib>=3.10.8"
# r "pip: openpyxl>=3.1.5"

import pandas as pd
import shapefile
import matplotlib.pyplot as plt
from matplotlib.patches import Polygon
import numpy as np

def read_shp_file(shp_file_path: str):
    shp_file = shapefile.Reader(shp_file_path)
    shapes = shp_file.shapes()
    delimiter = "/" if "/" in shp_file_path else "\\"
    shp_file_name = shp_file_path.split(delimiter)[-1].split(".")[0]
    return shp_file, shapes, shp_file_name
    
def plot_shp_file(shp_file_path: str):
    shp_file, shapes, shp_file_name = read_shp_file(shp_file_path)

    fig, axes = plt.subplots()
    x_min, y_min, x_max, y_max = shp_file.bbox
    axes.set_xlim(x_min, x_max)
    axes.set_ylim(y_min, y_max)
    axes.set_title(shp_filename)
    
    for shape in shapes:
        points = shape.points
        polygon = Polygon(points, edgecolor='green', facecolor='lightgreen')
        axes.add_patch(polygon)
        
    plt.show()

def get_sample(num_items, max, min):
    span = max-min
    return np.random.random_sample(num_items)*span+min

shp_file, shapes, shp_filename = read_shp_file(shp_file_path)
if plot_shapes:
    plot_shp_file(shp_file_path)

wb = pd.read_excel(xlsx_file_path)
wb_preview = wb.head()
print (list(wb.columns))

num_shapes = len(shapes)
ground_elevs, roof_heights, shape_areas = [], [], []

if gnd_elev_key in wb.keys():
    ground_elevs = list(wb[gnd_elev_key]*scale_factor)  
else:
    ground_elevs = get_sample(num_shapes, 10, 30)*scale_factor

if roof_h_key in wb.keys():
    roof_heights = list(wb[roof_h_key]*scale_factor)
else:
    roof_heights = get_sample(num_shapes, 40, 100)*scale_factor

if shp_area_key in wb.keys():
    shape_areas = list(wb[shp_area_key]*scale_factor)
else:
    shape_areas = get_sample(num_shapes, 600, 6000)*scale_factor
# ---------- end py3 ----------
wb_preview = Panel(py3.wb_preview)
