# Grasshopper definition Figure12-21_to_12-23_generating_buildings_havana.gh (Grasshopper 1.0.9)

scale_factor = Slider(0.02, range=0..1000)
# Generate Buildings - Havana
toggle = BooleanToggle(False)
path = FilePath("C:\Users\isabe\Documents\Grasshopper\Book\Ch12_GeneratingCitySkylineModelsFromBuildingFootprint(GIS)Data\Code\Ch12\havana.shp")
path_2 = FilePath("C:\Users\isabe\Documents\Grasshopper\Book\Ch12_GeneratingCitySkylineModelsFromBuildingFootprint(GIS)Data\Code\Ch12\havana.xlsx")
# 1
py3 = Python3Script(
    plot_shapes=toggle,
    shp_file_path=path,
    xlsx_file_path=path_2,
    gnd_elev_key="missing",
    roof_h_key="missing",
    shp_area_key="area_in_meters",
    scale_factor=scale_factor)  # -> wb_preview, ground_elevs, roof_heights, shape_areas; inputs plot_shapes: Boolean, shp_file_path: String, xlsx_file_path: String, gnd_elev_key: String, roof_h_key: String, shp_area_key: String, scale_factor: Double
# ---------- py3: Python ----------
# r "pip: pyshp>=3.0.3"
# r "pip: pandas>=3.0.1"
# r "pip: matplotlib>=3.10.8"
# r "pip: openpyxl>=3.1.5"

import pandas as pd
import shapefile
import matplotlib.pyplot as plt
from matplotlib.patches import Polygon
import numpy as np

def read_shp_file(shp_file_path: str):
    shp_file = shapefile.Reader(shp_file_path)
    shapes = shp_file.shapes()
    delimiter = "/" if "/" in shp_file_path else "\\"
    shp_file_name = shp_file_path.split(delimiter)[-1].split(".")[0]
    return shp_file, shapes, shp_file_name
    
def plot_shp_file(shp_file_path: str):
    shp_file, shapes, shp_file_name = read_shp_file(shp_file_path)

    fig, axes = plt.subplots()
    x_min, y_min, x_max, y_max = shp_file.bbox
    axes.set_xlim(x_min, x_max)
    axes.set_ylim(y_min, y_max)
    axes.set_title(shp_filename)
    
    for shape in shapes:
        points = shape.points
        polygon = Polygon(points, edgecolor='green', facecolor='lightgreen')
        axes.add_patch(polygon)
        
    plt.show()

def get_sample(num_items, max, min):
    span = max-min
    return np.random.random_sample(num_items)*span+min

shp_file, shapes, shp_filename = read_shp_file(shp_file_path)
if plot_shapes:
    plot_shp_file(shp_file_path)

wb = pd.read_excel(xlsx_file_path)
wb_preview = wb.head()
print (list(wb.columns))

num_shapes = len(shapes)
ground_elevs, roof_heights, shape_areas = [], [], []

if gnd_elev_key in wb.keys():
    ground_elevs = list(wb[gnd_elev_key]*scale_factor)  
else:
    ground_elevs = list(get_sample(num_shapes, 10, 30)*scale_factor)

if roof_h_key in wb.keys():
    roof_heights = list(wb[roof_h_key]*scale_factor)
else:
    roof_heights = list(get_sample(num_shapes, 40, 100)*scale_factor)

if shp_area_key in wb.keys():
    shape_areas = list(wb[shp_area_key]*scale_factor)
else:
    shape_areas = list(get_sample(num_shapes, 600, 6000)*scale_factor)
# ---------- end py3 ----------

# ----
# 2a
shp = ImportSHP(File="C:\Users\isabe\Documents\Grasshopper\Book\Ch12_GeneratingCitySkylineModelsFromBuildingFootprint(GIS)Data\Code\Ch12\havana.shp")  # -> Points, Curves, Regions
# 2b
len = Length(Curve=shp.Curves)
# 2c
sqrt = SquareRoot(Value=py3.shape_areas)
# 2d
division = Division(A=sqrt, B=len)
# 2
# 2e
ma = MassAddition(Input=division)  # -> Result, PartialResults
# 2f
lng = ListLength(List=division)
# 2g
division_2 = Division(A=ma.Result, B=lng)
# 2h
scale = Scale(Geometry=shp.Curves, Center=Point(0, 0, 0), Factor=division_2)  # -> Geometry, Transform
# 2i
boundary = BoundarySurfaces(Edges=scale.Geometry)

# ----
# 3a
bbox = BoundingBox(Content=boundary, Plane=PlaneXY(0, 0, 0), UnionBox=True)  # -> Box, Box_2
# 3
# 3b
pt = ConstructPoint(XCoordinate=0, YCoordinate=0, ZCoordinate=0)
# 3c
area = Area(Geometry=bbox.Box)  # -> Area, Centroid
# 3d
subtraction = Subtraction(A=pt, B=area.Centroid)
# 3e
move = Move(Geometry=boundary, Motion=subtraction)  # -> Geometry, Transform

# ----
# 4a
smaller = SmallerThan(FirstNumber=py3.roof_heights, SecondNumber="0.01")  # -> SmallerThan, OrEqualTo
# 4b
dispatch = Dispatch(List=py3.roof_heights, DispatchPattern=smaller.SmallerThan)  # -> ListA, ListB
# 4g
Z = UnitZ(Factor=py3.ground_elevs)
# 4c
addition = Addition(A=dispatch.ListA, B="0.01")
# 4d
# 4
weave = Weave(Pattern=smaller.SmallerThan, Stream0=dispatch.ListB, Stream1=addition, NullGaps=False)
# 4e
Z_2 = UnitZ(Factor=weave)
# 4f
extr = Extrude(Base=move.Geometry, Direction=Z_2)
# 4h
move_2 = Move(Geometry=extr, Motion=Z)  # -> Geometry, Transform
