# Grasshopper definition turtle2D_RW_and_T_nodes_demo.gh (Grasshopper 1.0.9)
# plug-ins: LSystem2D.Components

rw = RewriteString(Axiom="F", Rewriting_rules="{\"F\":\"F+F--F+F\"}", Iterations=Slider(4, range=0..10))
t2d = Turtle2D(ExpansionString=rw, StepAngle="75", StepDistance="1")
