# Grasshopper definition turtle2D_contexual.gh (Grasshopper 1.0.9)

axiom = GetString(
    "F",
    {"F"}, selected=[],
    AtLeast=1,
    AtMost=1,
    Prompt="Starting string for the input L-System (with or without single/double quotes).",
    TreeAccess=False)
rewriting_rules = GetString(
    "{\"F\": \"F+F--F+F\"}",
    {"{\"F\": \"F+F--F+F\"}": "{"F": "F+F--F+F"}"}, selected=[],
    AtLeast=1,
    AtMost=1,
    Prompt="One or more rewriting rules for the input L-System formatted as a string representation of a Python dictionary, with each rule as one entry and the predecessor of the rule as the key and successor as the item, e.g. {\"F\":\"F+F+F+F\"}. Each key or item must be surrounded by double quotes.",
    TreeAccess=False)
iterations = GetInteger(
    "4",
    {"4"}, selected=[],
    AtLeast=1,
    AtMost=1,
    Maximum=100,
    Minimum=1,
    Prompt="Number of iterations to rewrite the L-System.",
    TreeAccess=False)
py3 = Python3Script(axiom=axiom, rewriting_rules=rewriting_rules, iterations=iterations)  # -> out, str_output; inputs axiom: String, rewriting_rules: String, iterations: Int32
#   port axiom: Starting string for the input L-System (with or without single/double quotes).
#   port rewriting_rules: One or more rewriting rules for the input L-System formatted as a string representation of a Python dictionary, with each rule as one entry and the predecessor of the rule as the key and successor as the item, e.g. {"F":"F+F+F+F"}. Each key or item must be surrounded by double quotes.
#   port iterations: Number of iterations to rewrite the L-System.
#   port str_output: The rewritten string for the given number of iterations.
# ---------- py3: Python ----------
import json

def rewrite(str_to_rewrite: str, rewriting_rules: dict):
    str_out = ""
    for c in str_to_rewrite:
        rewritten = False
        for predecessor, successor in rewriting_rules.items():
            if c == predecessor:
                str_out = "".join((str_out, successor))
                rewritten = True
                break
        if not rewritten:
            str_out = "".join((str_out, c))

    return str_out

def rewrite_recur(
    str_to_rewrite: str, rewriting_rules: dict, level: int, max_level: int
):
    if level == max_level:
        return str_to_rewrite

    str_to_rewrite = rewrite(str_to_rewrite, rewriting_rules)
    print("level " + str(level) + " = " + str_to_rewrite)
    level += 1
    return rewrite_recur(str_to_rewrite, rewriting_rules, level, max_level)

rr = json.loads(rewriting_rules)
print(str(type(rr)) + " = " + str(rr))
str_output = rewrite_recur(axiom, rr, 0, iterations)
# ---------- end py3 ----------
theta = GetNumber(
    "75",
    {"75"}, selected=[],
    AtLeast=23,
    AtMost=120,
    Maximum=120,
    Minimum=5,
    Prompt="Unit angle in degrees for turn, pitche, or roll.",
    TreeAccess=False)
step_dist = GetNumber(
    "1",
    {"1"}, selected=[],
    AtLeast=1,
    AtMost=1000,
    Maximum=100,
    Minimum=1,
    Prompt="Unit distance for one step forward (F or f).",
    TreeAccess=False)
py3_2 = Python3Script(rewritten_str=py3.str_output, theta=theta, step_dist=step_dist)  # -> out, polyline; inputs rewritten_str: String, theta: Double, step_dist: Double
#   port rewritten_str: An expansion string for a L-System, ready to be interpreted as a (collection of) polyline(s).
#   port theta: Unit angle in degrees for turn, pitche, or roll.
#   port step_dist: Unit distance for one step forward (F or f).
#   port polyline: Polyline(s) constructed based on the expansion string.
# ---------- py3_2: Python ----------
import Rhino.Geometry as rg
from math import radians

class turtle_2D:
    def __init__(
        self, rewritten_str: str, theta: float, step_dist: float
    ):
        self.rewritten_str = rewritten_str
        self.theta = theta
        self.step_dist = step_dist

        self.polyline = [rg.Polyline()]
        self.polyline[-1].Add(0.0, 0.0, 0.0)
        self.lcs = rg.Transform.Identity
        self.heading = rg.Vector3d(rg.Point3d(0.0, 1.0, 0.0))

    def update_heading(self, mat_rot):
        self.lcs = self.lcs * mat_rot
        self.heading = rg.Vector3d(rg.Point3d(self.lcs.M10, self.lcs.M11, self.lcs.M12))
        self.heading.Unitize() 

    def draw(self):
        for c in self.rewritten_str:
            last_pt_index = self.polyline[-1].Count-1
            start_pt = self.polyline[-1].PointAt(last_pt_index)
            print(start_pt)          
            if c == "F":
                self.one_step_forward(start_pt)
            elif c == "+":  # Turn LEFT
                mat_rot = rg.Transform.Rotation(radians(-self.theta), rg.Vector3d(rg.Point3d(self.lcs.M20, self.lcs.M21, self.lcs.M22)), start_pt)
                self.update_heading(mat_rot)
            elif c == "-":  # Turn RIGHT
                mat_rot = rg.Transform.Rotation(radians(self.theta), rg.Vector3d(rg.Point3d(self.lcs.M20, self.lcs.M21, self.lcs.M22)), start_pt)
                self.update_heading(mat_rot)

    def one_step_forward(self, start_pt):
        trans_vec = self.heading * self.step_dist
        end_pt = start_pt + trans_vec
        self.polyline[-1].Add(end_pt[0], end_pt[1], end_pt[2])

t = turtle_2D(rewritten_str, theta, step_dist)
t.draw()
polyline = t.polyline
# ---------- end py3_2 ----------
c_bake = ContextBake(Polyline=py3_2.polyline)
