# Grasshopper definition turtle2D_contexual_demo_fractal.gh (Grasshopper 1.0.9)
# plug-ins: LSystem2D_contextual.Components

l2d = LSystem2D(
    StartingStringForTheInputLSystemWithOrWithoutSingleDoubleQuotes="\"F-F-F-F\"",
    OneOrMoreRewritingRulesForTheInputLSystemFormattedAsAStringRepresentationOfAPythonDictionaryWithEachRuleAsOneEntryAndThePredecessorOfTheRuleAsTheKeyAndSuccessorAsTheItemEGFFFFFEachKeyOrItemMustBeSurroundedByDoubleQuotes="{\"F\": \"FF-F+F-F-FF\"}",
    NumberOfIterationsToRewriteTheLSystem=Slider(3, range=1..10),
    UnitAngleInDegreesForTurnPitcheOrRoll="90",
    UnitDistanceForOneStepForwardFOrF="1")
