# Grasshopper definition turtle2D_contexual_raw_demo.gh (Grasshopper 1.0.9)
# plug-ins: LSystem2D_contexual.Components

figure13_todo_turtle2d_11_6__contexual_g = Figure13_TODO_turtle2D116_contexualGh(GetString="F", GetString_2="{\"F\":\"F+F--F+F\"}", GetInteger=Slider(4, range=0..10), GetNumber="75", GetNumber_2="1")
