# Grasshopper definition Figure2-3_series.gh (Grasshopper 1.0.9)

number_slider = Slider(25, range=1..36)
series = Series(Start="1", Step=1, Count=10)
multiplication = Multiplication(A=series, B=number_slider)
unit_z = UnitZ(Factor=series)
radians = Radians(Degrees=multiplication)
arc = Arc(Plane=PlaneXY(0, 0, 0), Radius=series, Angle=radians)  # -> Arc, Length
extrude = Extrude(Base=arc.Arc, Direction=unit_z)

py3 = Python3Script(count="10", step_angle=number_slider)  # -> out, walls; inputs count: Int32, step_angle: Double
#   port count: Number of walls to create.
#   port step_angle: Angle increment (for the arc defining the wall's curvature) between neighboring walls.
#   port walls: Nested curved walls as a collection of surfaces.
# ---------- py3: Python ----------
__author__ = "isabel"
__version__ = "2026.06.16"

import ghpythonlib.components as ghcps

radii = ghcps.Series(1, 1, count)
angle = ghcps.Radians(ghcps.Multiplication(step_angle, radii))
xy_plane = ghcps.XYPlane(ghcps.ConstructPoint(0,0,0))
arc, _ = ghcps.Arc(xy_plane, radii, angle)
walls = ghcps.Extrude(arc, ghcps.UnitZ(radii))
# ---------- end py3 ----------
