# Grasshopper definition Figure2-3_series_contexual.gh (Grasshopper 1.0.9)

# ---- group: Figure 2-3: Series
series = Series(Start="1", Step=1, Count=10)
multiplication = Multiplication(A=series, B=Slider(25, range=1..36))
unit_z = UnitZ(Factor=series)
radians = Radians(Degrees=multiplication)
arc = Arc(Plane=PlaneXY(0, 0, 0), Radius=series, Angle=radians)  # -> Arc, Length
extrude = Extrude(Base=arc.Arc, Direction=unit_z)

# ----
count = GetInteger(
    "10",
    {"10"}, selected=[],
    AtLeast=1,
    AtMost=1,
    Maximum=500,
    Minimum=1,
    Prompt="Number of walls to create.",
    TreeAccess=False)
step_angle = GetNumber(
    Slider(25, range=1..36),
    {"25.0"}, selected=[],
    AtLeast=1,
    AtMost=1,
    Maximum=360,
    Minimum=1,
    Prompt="Angle increment (for the arc defining the wall's curvature) between neighboring walls.",
    TreeAccess=False)
py3 = Python3Script(count=count, step_angle=step_angle)  # -> out, walls; inputs count: Int32, step_angle: Double
#   port count: Number of walls to create.
#   port step_angle: Angle increment (for the arc defining the wall's curvature) between neighboring walls.
#   port walls: Nested curved walls as a collection of surfaces.
# ---------- py3: Python ----------
__author__ = "isabel"
__version__ = "2026.06.16"

import ghpythonlib.components as ghcps

radii = ghcps.Series(1, 1, count)
angle = ghcps.Radians(ghcps.Multiplication(step_angle, radii))
xy_plane = ghcps.XYPlane(ghcps.ConstructPoint(0,0,0))
arc, _ = ghcps.Arc(xy_plane, radii, angle)
walls = ghcps.Extrude(arc, ghcps.UnitZ(radii))
# ---------- end py3 ----------
c_bake = ContextBake(Content=py3.walls)
