# Grasshopper definition Figure2-3_series_RC_panel.gh (Grasshopper 1.0.9)

# ----
# a
number_slider = Slider(10, range=1..500)
# b
step_angle_deg = Slider(25, range=1..36)
series = Series(Start="1", Step=1, Count=number_slider)
multiplication = Multiplication(A=series, B=step_angle_deg)
unit_z = UnitZ(Factor=series)
radians = Radians(Degrees=multiplication)
arc = Arc(Plane=PlaneXY(0, 0, 0), Radius=series, Angle=radians)  # -> Arc, Length
extrude = Extrude(Base=arc.Arc, Direction=unit_z)
