# Grasshopper definition Figure2-11_list_data_matching_one_to_many.gh (Grasshopper 1.0.9)

# One to Many: One Line to a List of
# 3 Scale Factors
pt = ConstructPoint(XCoordinate=0, YCoordinate=0, ZCoordinate=0)
pt_2 = ConstructPoint(XCoordinate=0, YCoordinate="5", ZCoordinate=0)
# One to One: One Line to One Scale Factor
pt_3 = ConstructPoint(XCoordinate=0, YCoordinate=0, ZCoordinate=0)
pt_4 = ConstructPoint(XCoordinate=0, YCoordinate="5", ZCoordinate=0)
# One Line
pt_5 = ConstructPoint(XCoordinate=0, YCoordinate=0, ZCoordinate=0)
pt_6 = ConstructPoint(XCoordinate=0, YCoordinate="5", ZCoordinate=0)
ln = Line(StartPoint=pt, EndPoint=pt_2)
ln_2 = Line(StartPoint=pt_3, EndPoint=pt_4)
ln_3 = Line(StartPoint=pt_5, EndPoint=pt_6)
panel = Panel("""2
4
6""")
scale_nu = ScaleNU(Geometry=ln, Plane=PlaneXY(0, 0, 0), ScaleX=1, ScaleY=panel, ScaleZ=1)  # -> Geometry, Transform
scale_nu_2 = ScaleNU(Geometry=ln_2, Plane=PlaneXY(0, 0, 0), ScaleX=1, ScaleY="2", ScaleZ=1)  # -> Geometry, Transform
# 2X
# 4X
# 6X
panel_2 = Panel(scale_nu.Geometry)
panel_3 = Panel(ln_3)
panel_4 = Panel(scale_nu_2.Geometry)
