# Grasshopper definition Figure2-12_list_data_matching_many_to_fewer.gh (Grasshopper 1.0.9)

# Many to One: A List of 3 Lines to 1 Scale Factor
panel = Panel("""5
10
15""")
# One Line
panel_2 = Panel("""5
10
15""")
# Many to Many: A List of 3 Lines to a List of 3 Scale Factors
panel_3 = Panel("""5
10
15""")
# Many to Fewer: A List of 3 Lines to a List of 2 Scale Factors
panel_4 = Panel("""5
10
15""")
pt = ConstructPoint(XCoordinate=panel, YCoordinate=0, ZCoordinate=0)
pt_2 = ConstructPoint(XCoordinate=panel, YCoordinate=panel, ZCoordinate=0)
pt_3 = ConstructPoint(XCoordinate=panel_3, YCoordinate=0, ZCoordinate=0)
pt_4 = ConstructPoint(XCoordinate=panel_3, YCoordinate=panel_3, ZCoordinate=0)
pt_5 = ConstructPoint(XCoordinate=panel_2, YCoordinate=0, ZCoordinate=0)
pt_6 = ConstructPoint(XCoordinate=panel_2, YCoordinate=panel_2, ZCoordinate=0)
pt_7 = ConstructPoint(XCoordinate=panel_4, YCoordinate=0, ZCoordinate=0)
pt_8 = ConstructPoint(XCoordinate=panel_4, YCoordinate=panel_4, ZCoordinate=0)
ln = Line(StartPoint=pt_5, EndPoint=pt_6)
ln_2 = Line(StartPoint=pt, EndPoint=pt_2)
ln_3 = Line(StartPoint=pt_3, EndPoint=pt_4)
ln_4 = Line(StartPoint=pt_7, EndPoint=pt_8)
panel_5 = Panel("""2
4
6""")
panel_6 = Panel("""2
4""")
scale_nu = ScaleNU(Geometry=ln_2, Plane=PlaneXY(0, 0, 0), ScaleX=1, ScaleY="2", ScaleZ=1)  # -> Geometry, Transform
scale_nu_2 = ScaleNU(Geometry=ln_3, Plane=PlaneXY(0, 0, 0), ScaleX=1, ScaleY=panel_5, ScaleZ=1)  # -> Geometry, Transform
scale_nu_3 = ScaleNU(Geometry=ln_4, Plane=PlaneXY(0, 0, 0), ScaleX=1, ScaleY=panel_6, ScaleZ=1)  # -> Geometry, Transform
# 2X
# 2X
# 2X
panel_7 = Panel(scale_nu.Geometry)
# 2X
# 4X
# 6X
panel_8 = Panel(scale_nu_2.Geometry)
panel_9 = Panel(ln)
# 2X
# 4X
# 2X
panel_10 = Panel(scale_nu_3.Geometry)
