# Grasshopper definition Figure2-13_data_tree_intro.gh (Grasshopper 1.0.9)

# Data Tree
number_slider = Slider(5, range=1..100)
cyl = Cylinder(Base=PlaneXY(0, 0, 0), Radius=number_slider, Length=Slider(15, range=1..100))
sdivide = DivideSurface(Surface=cyl, UCount=10, VCount=10)  # -> Points, Normals, Parameters

# ---- group: Param Viewer - Draw Tree
viewer = ParamViewer(sdivide.Points)

# ----
viewer_2 = ParamViewer(sdivide.Points)
