# Grasshopper definition Figure2-14_data_tree_simplify_tree_branch_flip_matrix.gh (Grasshopper 1.0.9)

# Data Tree: Simplify, Tree Branch,
# Flip Matrix
number_slider = Slider(5, range=1..100)
cyl = Cylinder(Base=PlaneXY(0, 0, 0), Radius=number_slider, Length=Slider(15, range=1..100))
sdivide = DivideSurface(Surface=cyl, UCount=10, VCount=10)  # -> simplify(Points), Normals, Parameters
flip = FlipMatrix(Data=sdivide.Points)
viewer = ParamViewer(sdivide.Points)
viewer_2 = ParamViewer(sdivide.Points)
branch = TreeBranch(Tree=sdivide.Points, Path="{0}", MaintainPaths=True)
branch_2 = TreeBranch(Tree=flip, Path="{0}", MaintainPaths=True)
