# Grasshopper definition Figure2-15_data_tree_flatten.gh (Grasshopper 1.0.9)

# Data Tree: Flatten
number_slider = Slider(5, range=1..100)
cyl = Cylinder(Base=PlaneXY(0, 0, 0), Radius=number_slider, Length=Slider(15, range=1..100))
sdivide = DivideSurface(Surface=cyl, UCount=10, VCount=10)  # -> flatten(Points), Normals, Parameters
panel = Panel(sdivide.Points)
viewer = ParamViewer(sdivide.Points)
viewer_2 = ParamViewer(sdivide.Points)
intcrv = Interpolate(Vertices=sdivide.Points, Degree=3, Periodic=False, KnotStyle=1)  # -> Curve, Length, Domain
pipe = Pipe(Curve=intcrv.Curve, Radius="0.2", Caps=0, FitRail=False)
