# Grasshopper definition Figure2-16_2-17_data_tree_graft_flatten.gh (Grasshopper 1.0.9)

# ----
# Data Tree: Graft, Flatten
# 3
# List
# 1
# 4
# 2
panel = Panel("2")
series = Series(Start=0, Step=panel, Count=10)
pt = ConstructPoint(XCoordinate=series, YCoordinate=series, ZCoordinate=0)
viewer = ParamViewer(pt)
viewer_2 = ParamViewer(pt)

# ----
# Graft
# 6
# 5
# 7
panel_2 = Panel("2")
series_2 = Series(Start=0, Step=panel_2, Count=10)
pt_2 = ConstructPoint(XCoordinate=series_2, YCoordinate=graft(series_2), ZCoordinate=0)
viewer_3 = ParamViewer(pt_2)
viewer_4 = ParamViewer(pt_2)

# ----
# 9
# 8
# Graft then flatten
# 10
panel_3 = Panel("2")
series_3 = Series(Start=0, Step=panel_3, Count=10)
pt_3 = ConstructPoint(XCoordinate=series_3, YCoordinate=graft(series_3), ZCoordinate=0)  # -> flatten(Point)
viewer_5 = ParamViewer(pt_3)
viewer_6 = ParamViewer(pt_3)

# ----
# 13
# 12
# 11
panel_4 = Panel("2")
series_4 = Series(Start=0, Step=panel_4, Count=10)
pt_4 = ConstructPoint(XCoordinate=series_4, YCoordinate=graft(series_4), ZCoordinate=0)  # -> flatten(Point)
lng = ListLength(List=pt_4)
random = Random(Range="0.3 to 1.0", Number=lng, Seed=2)
sph = Sphere(Base=pt_4, Radius=random)
