# Grasshopper definition Figure2-18_data_tree_reverse.gh (Grasshopper 1.0.9)

# ----
# Data Tree: Reverse
number_slider = Slider(3, range=1..100)
series = Series(Start=0, Step=number_slider, Count=10)
division = Division(A=number_slider, B="2")
pt = ConstructPoint(XCoordinate=series, YCoordinate=graft(series), ZCoordinate=0)  # -> simplify(Point)
# 1
tstat = TreeStatistics(Tree=pt)  # -> Paths, Length, Count
# 2
series_2 = Series(Start="1", Step=1, Count=tstat.Count)
# 3
division_2 = Division(A=division, B=series_2)
# 4
sph = Sphere(Base=pt, Radius=division_2)

# ---- group: Reversed
number_slider_2 = Slider(3, range=1..100)
series_3 = Series(Start=0, Step=number_slider_2, Count=10)
division_3 = Division(A=number_slider_2, B="2")
# 5
pt_2 = ConstructPoint(XCoordinate=series_3, YCoordinate=graft(series_3), ZCoordinate=0)  # -> reverse(simplify(Point))
tstat_2 = TreeStatistics(Tree=pt_2)  # -> Paths, Length, Count
series_4 = Series(Start="1", Step=1, Count=tstat_2.Count)
division_4 = Division(A=division_3, B=series_4)
# 6
sph_2 = Sphere(Base=pt_2, Radius=division_4)
