# Grasshopper definition Figure2-19_2-20_python3_spiral.gh (Grasshopper 1.0.9)

steps = Slider(100, range=1..500)
# Simple Seashell Spiral in Python 3
number_slider = Slider(1.35, range=0.01..10)
range = Range(Domain="0 to pi", Steps=steps)
range_2 = Range(Domain="-2*pi to 2*pi", Steps=steps)
seashell_spiral = Python3Script(scale=number_slider, n=Slider(6, range=2..20), c=Slider(0.2, range=0.1..5), u=range, v=range_2)  # -> pts; inputs scale: Double, n: Int32, c: Double, u: list of Double, v: list of Double
# ---------- seashell_spiral: Python ----------
__author__ = "isabel"
__version__ = "2025.11.11"

import ghpythonlib.components as ghcps
import math


two_pi = 2*math.pi
b = 10
a = scale
pts = []

for i in range(len(u)):
    v_term = 1-(v[i]/two_pi)
    n_v = n*v[i]

    x = scale * (v_term * (1+math.cos(u[i])) + c) * math.cos(n_v)
    y = scale * (v_term * (1+math.cos(u[i])) + c) * math.sin(n_v)
    z = ((b*v[i])/two_pi) + a*math.sin(u[i])*v_term
    p = ghcps.ConstructPoint(x, y, z)
    pts.append(p)
# ---------- end seashell_spiral ----------

# ---- group: Interpolate Curve
curve = Interpolate(Vertices=seashell_spiral, Degree=3, Periodic=False, KnotStyle=1)  # -> Curve, Length, Domain
