# Grasshopper definition Figure2-1_data_conversion.gh (Grasshopper 1.0.9)

# Figure 2-1: Data Conversion Examples
number_slider = Slider(3.25, range=0..10)
rectangle = Rectangle(Plane="{1,2,3}", XSize=Domain(-1, 1), YSize=Domain(-2, 2), Radius=0)  # -> Rectangle, Length
boolean = Boolean(number_slider)
integer = Integer(Slider(3.25, range=0..10))
panel = Panel(boolean)
panel_2 = Panel(integer)
surface_points = SurfacePoints(Surface=rectangle.Rectangle)  # -> Points, Weights, Greville, UCount, VCount
brep_edges = BrepEdges(Brep=rectangle.Rectangle)  # -> Naked, Interior, NonManifold
cone = Cone(Base=rectangle.Rectangle, Radius=0.5, Length=1)  # -> Cone, Tip
