# Grasshopper definition Figure2-26_group_example.gh (Grasshopper 1.0.9)

series = Series(Start="1", Step=1, Count=10)

# ---- group: List of Angles for the Arcs
multiplication = Multiplication(A=series, B=Slider(25, range=1..36))
radians = Radians(Degrees=multiplication)

# ----
unit_z = UnitZ(Factor=series)
arc = Arc(Plane=PlaneXY(0, 0, 0), Radius=series, Angle=radians)  # -> Arc, Length
extrude = Extrude(Base=arc.Arc, Direction=unit_z)
