# Grasshopper definition Figure2-27_scribble_and_panel.gh (Grasshopper 1.0.9)

# Generate Cylindrical Columns
panel = Panel("0.0 to 10.0")
# This definition generates 9 evenly spaced cylindrical columns along a Bezier curve.
panel_2 = Panel("8")
range = Range(Domain=panel, Steps=panel_2)
series = Series(Start="1", Step=1, Count=10)
graph = GraphMapper(
    range,
    x0=0,
    x1=10,
    y0=1,
    y1=5,
    container_name="Bezier",
    cpx=[0, 0.2391304374, 0.8043478131, 1],
    cpy=[0, 0.8913043737, 0.3333333135, 1])
multiplication = Multiplication(A=series, B=Slider(25, range=1..36))
pt = ConstructPoint(XCoordinate=range, YCoordinate=graph, ZCoordinate=0)
Z = UnitZ(Factor=series)
rad = Radians(Degrees=multiplication)
cyl = Cylinder(Base=pt, Radius=0.5, Length=graph)
cap = CapHoles(Brep=cyl)
arc = Arc(Plane=PlaneXY(0, 0, 0), Radius=series, Angle=rad)  # -> Arc, Length
extr = Extrude(Base=arc.Arc, Direction=Z)
