# Grasshopper definition Figure2-2_2-28_range.gh (Grasshopper 1.0.9)

# ---- group: Figure 2-2: Range
range = Range(Domain="0.0 to 10.0", Steps="8")
graph_mapper = GraphMapper(
    range,
    x0=0,
    x1=10,
    y0=1,
    y1=5,
    container_name="Bezier",
    cpx=[0, 0.2391304374, 0.8043478131, 1],
    cpy=[0, 0.8913043737, 0.3333333135, 1])
construct_point = ConstructPoint(XCoordinate=range, YCoordinate=graph_mapper, ZCoordinate=0)
cylinder = Cylinder(Base=construct_point, Radius=0.5, Length=graph_mapper)
cap_holes = CapHoles(Brep=cylinder)
