# Grasshopper definition Figure2-3_series.gh (Grasshopper 1.0.9)

# ---- group: Figure 2-3: Series
series = Series(Start="1", Step=1, Count=10)
multiplication = Multiplication(A=series, B=Slider(25, range=1..36))
unit_z = UnitZ(Factor=series)
radians = Radians(Degrees=multiplication)
arc = Arc(Plane=PlaneXY(0, 0, 0), Radius=series, Angle=radians)  # -> Arc, Length
extrude = Extrude(Base=arc.Arc, Direction=unit_z)
