# Grasshopper definition Figure2-4_list_cull_nth_cull_pattern.gh (Grasshopper 1.0.9)

# List: Cull Nth, Cull Pattern
number_slider = Slider(5, range=1..100)
cir = Circle(Plane=PlaneXY(0, 0, 0), Radius=number_slider)
divide = DivideCurve(Curve=cir, Count=Slider(10, range=1..100), Kinks=False)  # -> Points, Tangents, Parameters
panel = Panel("""True
False""")
panel_2 = Panel("""False
True""")
culln = CullNth(List=divide.Points, CullFrequency=2)
cull = CullPattern(List=divide.Points, CullPattern=panel)
cull_2 = CullPattern(List=divide.Points, CullPattern=panel_2)
pline = PolyLine(Vertices=cull, Closed="True")
pline_2 = PolyLine(Vertices=cull_2, Closed="True")
pipe = Pipe(Curve=[pline, pline_2], Radius="0.2", Caps=0, FitRail=False)
