# Grasshopper definition Figure2-5_partition_list_sub_list.gh (Grasshopper 1.0.9)

# List: Partition List, Sub List
number_slider = Slider(5, range=1..100)
cir = Circle(Plane=PlaneXY(0, 0, 0), Radius=number_slider)
divide = DivideCurve(Curve=cir, Count=Slider(15, range=1..100), Kinks=False)  # -> Points, Tangents, Parameters
Z = UnitZ(Factor="10")

# ---- group: Sub List
subset = SubList(List=divide.Points, Domain="3 to 8", Wrap=True)  # -> List, Index
pline = PolyLine(Vertices=subset.List, Closed=False)
extr = Extrude(Base=pline, Direction=Z)

# ---- group: Partition List
partition = PartitionList(List=divide.Points, Size=[3, 2])
pline_2 = PolyLine(Vertices=partition, Closed=False)
extr_2 = Extrude(Base=pline_2, Direction=Z)
