# Grasshopper definition Figure2-6_list_dispatch_weave.gh (Grasshopper 1.0.9)

# List: Dispatch, Weave
panel = Panel("0.0 to 20.0")
range = Range(Domain=panel, Steps="15")

# ---- group: Parabolic Curve
graph = GraphMapper(
    range,
    x0=0,
    x1=20,
    y0=1,
    y1=15,
    Ox=0.4786228836,
    Oy=0.6833334565,
    Px=0.6326084137,
    Py=0.6217392683,
    container_name="Parabola")

# ----
# 1
number_slider = Slider(8, range=1..50)
pt = ConstructPoint(XCoordinate=range, YCoordinate=graph, ZCoordinate=0)
cyl = Cylinder(Base=pt, Radius=0.5, Length=number_slider)

# ---- group: Dispatch
panel_2 = Panel("""True
True
False
False""")
# 2
dispatch = Dispatch(List=cyl, DispatchPattern=panel_2)  # -> ListA, ListB

# ----
# 3
scale_nu = ScaleNU(Geometry=dispatch.ListA, Plane=PlaneXY(0, 0, 0), ScaleX=1, ScaleY=1, ScaleZ=Slider(0.6, range=0.1..1))  # -> Geometry, Transform
# 4
weave = Weave(Pattern=panel_2, Stream0=scale_nu.Geometry, Stream1=dispatch.ListB, NullGaps=False)
# 5
cap = CapHoles(Brep=weave)
