# Grasshopper definition Figure2-7_2-8_data_matching.gh (Grasshopper 1.0.9)

# ----
# Longest List (default)
_2nd_line_length = Slider(15, range=1..100)
_2nd_line_length_2 = Slider(15, range=1..100)
unit_x = UnitX(Factor=1)
_2nd_line_length_3 = Slider(15, range=1..100)
_2nd_line_length_4 = Slider(15, range=1..100)
unit_x_2 = UnitX(Factor=1)
unit_x_3 = UnitX(Factor=1)
unit_x_4 = UnitX(Factor=1)
construct_point = ConstructPoint(XCoordinate=0, YCoordinate=0, ZCoordinate=0)
# Cross Reference
construct_point_2 = ConstructPoint(XCoordinate=0, YCoordinate=0, ZCoordinate=0)
# Longest List (with Longest List node)
construct_point_3 = ConstructPoint(XCoordinate=0, YCoordinate=0, ZCoordinate=0)
# Shortest List
construct_point_4 = ConstructPoint(XCoordinate=0, YCoordinate=0, ZCoordinate=0)
_1st_line_length = Slider(10, range=1..100)
_1st_line_length_2 = Slider(10, range=1..100)
line_sdl = LineSDL(Start=construct_point, Direction=unit_x_2, Length=_2nd_line_length_2)
line_sdl_2 = LineSDL(Start=construct_point_2, Direction=unit_x, Length=_2nd_line_length)
_1st_line_length_3 = Slider(10, range=1..100)
_1st_line_length_4 = Slider(10, range=1..100)
line_sdl_3 = LineSDL(Start=construct_point_3, Direction=unit_x_3, Length=_2nd_line_length_3)
line_sdl_4 = LineSDL(Start=construct_point_4, Direction=unit_x_4, Length=_2nd_line_length_4)
move = Move(Geometry=line_sdl, Motion=Vector(0, 0, 10))  # -> Geometry, Transform
move_2 = Move(Geometry=line_sdl_2, Motion=Vector(0, 0, 10))  # -> Geometry, Transform
move_3 = Move(Geometry=line_sdl_3, Motion=Vector(0, 0, 10))  # -> Geometry, Transform
move_4 = Move(Geometry=line_sdl_4, Motion=Vector(0, 0, 10))  # -> Geometry, Transform
line_sdl_5 = LineSDL(Start=construct_point, Direction=unit_x_2, Length=_1st_line_length_2)
line_sdl_6 = LineSDL(Start=construct_point_2, Direction=unit_x, Length=_1st_line_length)
line_sdl_7 = LineSDL(Start=construct_point_3, Direction=unit_x_3, Length=_1st_line_length_3)
line_sdl_8 = LineSDL(Start=construct_point_4, Direction=unit_x_4, Length=_1st_line_length_4)
divide_curve = DivideCurve(Curve=line_sdl_5, Count=_1st_line_length_2, Kinks=False)  # -> Points, Tangents, Parameters
divide_curve_2 = DivideCurve(Curve=move.Geometry, Count=_2nd_line_length_2, Kinks=False)  # -> Points, Tangents, Parameters
divide_curve_3 = DivideCurve(Curve=line_sdl_6, Count=_1st_line_length, Kinks=False)  # -> Points, Tangents, Parameters
divide_curve_4 = DivideCurve(Curve=move_2.Geometry, Count=_2nd_line_length, Kinks=False)  # -> Points, Tangents, Parameters
divide_curve_5 = DivideCurve(Curve=line_sdl_7, Count=_1st_line_length_3, Kinks=False)  # -> Points, Tangents, Parameters
divide_curve_6 = DivideCurve(Curve=move_3.Geometry, Count=_2nd_line_length_3, Kinks=False)  # -> Points, Tangents, Parameters
divide_curve_7 = DivideCurve(Curve=line_sdl_8, Count=_1st_line_length_4, Kinks=False)  # -> Points, Tangents, Parameters
divide_curve_8 = DivideCurve(Curve=move_4.Geometry, Count=_2nd_line_length_4, Kinks=False)  # -> Points, Tangents, Parameters
line = Line(StartPoint=divide_curve.Points, EndPoint=divide_curve_2.Points)
cross_reference = CrossReference(ListListA=divide_curve_3.Points, ListListB=divide_curve_4.Points, CrossMode=1)  # -> ListListA, ListListB
longest_list = LongestList(ListListA=divide_curve_5.Points, ListListB=divide_curve_6.Points, PaddingMode=2)  # -> ListListA, ListListB
shortest_list = ShortestList(ListListA=divide_curve_7.Points, ListListB=divide_curve_8.Points, TrimMode=2)  # -> ListListA, ListListB
line_2 = Line(StartPoint=cross_reference.ListListA, EndPoint=cross_reference.ListListB)
line_3 = Line(StartPoint=longest_list.ListListA, EndPoint=longest_list.ListListB)
panel = Panel(line)
param_viewer = ParamViewer(line)
param_viewer_2 = ParamViewer(line)
line_4 = Line(StartPoint=shortest_list.ListListA, EndPoint=shortest_list.ListListB)
param_viewer_3 = ParamViewer(line_2)
param_viewer_4 = ParamViewer(line_2)
panel_2 = Panel(line_2)
param_viewer_5 = ParamViewer(line_3)
param_viewer_6 = ParamViewer(line_3)
panel_3 = Panel(line_3)
param_viewer_7 = ParamViewer(line_4)
param_viewer_8 = ParamViewer(line_4)
panel_4 = Panel(line_4)
