# Grasshopper definition Figure3-11_2.5D_attractor_repeller.gh (Grasshopper 1.0.9)

segments = Slider(6, range=3..12)
# 2.5D Attractor & Repeller (Scaling + Z Offset)
radius = Slider(1.2, range=0.01..5)
cell_x_scale = Slider(1.43, range=0.01..3)
cell_y_scale = Slider(1.25, range=0.01..3)
polygon = Polygon(Plane=PlaneXY(0, 0, 0), Radius=radius, Segments=segments, FilletRadius=0)  # -> Polygon, Length
x_count = Slider(12, range=0..20)
y_count = Slider(10, range=0..20)
bbox = BoundingBox(Content=polygon.Polygon, Plane=PlaneXY(0, 0, 0))  # -> Box, Box_2
scale_nu = ScaleNU(Geometry=bbox.Box, Plane=PlaneXY(0, 0, 0), ScaleX=cell_x_scale, ScaleY=cell_y_scale, ScaleZ=1)  # -> Geometry, Transform
arrrec = RectangularArray(Geometry=polygon.Polygon, Cell=scale_nu.Geometry, XCount=x_count, YCount=y_count)  # -> Geometry, Transform

bbox_2 = BoundingBox(Content=arrrec.Geometry, Plane=PlaneXY(0, 0, 0), UnionBox=True)  # -> Box, Box_2
md_slider = MDSlider(
    SliderMode=0,
    slider_value=Point(0.3655425281, 0.6864460271, 0.5),
    x_domain=Domain(0, 1),
    y_domain=Domain(0, 1),
    z_domain=Domain(0, 1))
debox = DeconstructBox(Box=bbox_2.Box)  # -> Plane, X, Y, Z
pdecon = Deconstruct(Point=md_slider)  # -> XComponent, YComponent, ZComponent
remap = RemapNumbers(Value=pdecon.YComponent, Source=Domain(0, 1), Target=debox.Y)  # -> Mapped, Clipped
remap_2 = RemapNumbers(Value=pdecon.XComponent, Source=Domain(0, 1), Target=debox.X)  # -> Mapped, Clipped
pt = ConstructPoint(XCoordinate=remap_2.Mapped, YCoordinate=remap.Mapped, ZCoordinate=0)

pcen = PolygonCenter(Polyline=arrrec.Geometry)  # -> CenterV, CenterE, CenterA
dist = Distance(PointA=pt, PointB=pcen.CenterV)
bnd = Bounds(Numbers=dist)
dedomain = DeconstructDomain(Domain=bnd)  # -> Start, End
subtraction = Subtraction(A=dedomain.End, B=dedomain.Start)
division = Division(A=dist, B=subtraction)
clamp = Clamp(Value=division, Domain="0.1 to 0.9")
subtraction_2 = Subtraction(A="1.0", B=clamp)

repel = Slider(0, range=0..1)
filter = StreamFilter(Gate=repel, Stream0=subtraction_2, Stream1=clamp)
boundary = BoundarySurfaces(Edges=arrrec.Geometry)
scale = Scale(Geometry=boundary, Center=pcen.CenterV, Factor=filter)  # -> Geometry, Transform

z_offset = Slider(12.5, range=1..50)
multiplication = Multiplication(A=filter, B=z_offset)
Z = UnitZ(Factor=multiplication)
move = Move(Geometry=scale.Geometry, Motion=Z)  # -> Geometry, Transform
