# Grasshopper definition Figure3-12_to_3-15_3D_attractor_repeller.gh (Grasshopper 1.0.9)

segments = Slider(4, range=3..12)
# 3D Attractor (XY Scale + Column Height + Force Field)
radius = Slider(1.84, range=0.01..5)
cell_y_scale = Slider(1.13, range=0.01..3)
cell_x_scale = Slider(1.13, range=0.01..3)
polygon = Polygon(Plane=PlaneXY(0, 0, 0), Radius=radius, Segments=segments, FilletRadius=0)  # -> Polygon, Length
y_count = Slider(11, range=0..20)
x_count = Slider(12, range=0..20)
bbox = BoundingBox(Content=polygon.Polygon, Plane=PlaneXY(0, 0, 0))  # -> Box, Box_2
scale_nu = ScaleNU(Geometry=bbox.Box, Plane=PlaneXY(0, 0, 0), ScaleX=cell_x_scale, ScaleY=cell_y_scale, ScaleZ=1)  # -> Geometry, Transform
arrrec = RectangularArray(Geometry=polygon.Polygon, Cell=scale_nu.Geometry, XCount=x_count, YCount=y_count)  # -> Geometry, Transform

bbox_2 = BoundingBox(Content=arrrec.Geometry, Plane=PlaneXY(0, 0, 0), UnionBox=True)  # -> Box, Box_2
md_slider = MDSlider(
    SliderMode=0,
    slider_value=Point(0.6412200928, 0.6556729573, 0.5),
    x_domain=Domain(0, 1),
    y_domain=Domain(0, 1),
    z_domain=Domain(0, 1))
debox = DeconstructBox(Box=bbox_2.Box)  # -> Plane, X, Y, Z
pdecon = Deconstruct(Point=md_slider)  # -> XComponent, YComponent, ZComponent
remap = RemapNumbers(Value=pdecon.YComponent, Source=Domain(0, 1), Target=debox.Y)  # -> Mapped, Clipped
remap_2 = RemapNumbers(Value=pdecon.XComponent, Source=Domain(0, 1), Target=debox.X)  # -> Mapped, Clipped
pt = ConstructPoint(XCoordinate=remap_2.Mapped, YCoordinate=remap.Mapped, ZCoordinate=0)

pcen = PolygonCenter(Polyline=arrrec.Geometry)  # -> CenterV, CenterE, CenterA
dist = Distance(PointA=pt, PointB=pcen.CenterV)
bnd = Bounds(Numbers=dist)
dedomain = DeconstructDomain(Domain=bnd)  # -> Start, End
subtraction = Subtraction(A=dedomain.End, B=dedomain.Start)
division = Division(A=dist, B=subtraction)
clamp = Clamp(Value=division, Domain="0.1 to 0.9")

repel = Slider(0, range=0..1)
subtraction_2 = Subtraction(A="1.0", B=clamp)
filter = StreamFilter(Gate=repel, Stream0=subtraction_2, Stream1=clamp)
boundary = BoundarySurfaces(Edges=arrrec.Geometry)
scale = Scale(Geometry=boundary, Center=pcen.CenterV, Factor=filter)  # -> Geometry, Transform

height = Slider(18.65, range=1..50)
multiplication = Multiplication(A=filter, B=height)
Z = UnitZ(Factor=multiplication)
extr = Extrude(Base=scale.Geometry, Direction=Z)

vec2pt = Vector2Pt(PointA=pcen.CenterV, PointB=pt, Unitize="False")  # -> Vector, Length
rev = Reverse(Vector=vec2pt.Vector)
filter_2 = StreamFilter(Gate=repel, Stream0=vec2pt.Vector, Stream1=rev)
multiplication_2 = Multiplication(A=filter_2, B=filter)
multiplication_3 = Multiplication(A=multiplication_2, B=Slider(0.75, range=0.01..2))
move = Move(Geometry=extr, Motion=multiplication_3)  # -> Geometry, Transform
vdisex = VectorDisplayEx(Point=pcen.CenterV, Vector=filter_2, Colour=RGB(0, 0, 0), Width=2)
vdisex_2 = VectorDisplayEx(Point=pcen.CenterV, Vector=multiplication_3, Colour=RGB(0, 0, 0), Width=2)
