# Grasshopper definition Figure3-15_polar_arr_example.gh (Grasshopper 1.0.9)

# Polar Arrays on XY Plane, 1/4 PI
x_or_y = Slider(8, range=1..20)
pt = ConstructPoint(XCoordinate=x_or_y, YCoordinate=0, ZCoordinate=0)
pt_2 = ConstructPoint(XCoordinate=0, YCoordinate=x_or_y, ZCoordinate=0)
cir = Circle(Plane=[pt_2, pt], Radius=Slider(1, range=0..10))
arrpolar = PolarArray(Geometry=cir, Plane=PlaneXY(0, 0, 0), Count=Slider(4, range=1..20), Angle="0.25*pi")  # -> Geometry, Transform
