# Grasshopper definition Figure3-16_3-18_3-21_3-22_polar_attractor_repeller.gh (Grasshopper 1.0.9)

# ----
# Polar Attractor/Repeller
radius = Slider(1, range=0..10)
intra_ring_spacing = Slider(0.6, range=0..10)
num_rings = Slider(11, range=1..20)
# 1a
cir = Circle(Plane=PlaneXY(0, 0, 0), Radius=radius)
# 1b
py3 = Python3Script(r=radius, motif=cir, num_rings=num_rings, spacing=intra_ring_spacing)  # -> rings, count, arr_r; inputs r: Double, motif: Curve, num_rings: Int32, spacing: Double
# ---------- py3: Python ----------
__author__ = "isabel"
__version__ = "2025.11.11"

import ghpythonlib.components as ghc

rings = []
count = []
arr_r = 0
motif_diam = (r*2+spacing)

for ring in range(0, num_rings, 1):
    cur_r = r+motif_diam*ring
    cur_circum = 2*3.14*cur_r
    trans_vec = ghc.UnitX(cur_r)
    moved_shp, _ = ghc.Move(motif, trans_vec)
    count.append(cur_circum/motif_diam)
    rings.append(moved_shp)

    if ring == num_rings-1:
        arr_r = cur_r + r
# ---------- end py3 ----------
# 1
# 1c
arrpolar = PolarArray(Geometry=py3.rings, Plane=PlaneXY(0, 0, 0), Count=py3.count, Angle=6.283185307)  # -> flatten(Geometry), Transform

# ----
# 2a
md_slider = MDSlider(
    SliderMode=0,
    slider_value=Point(0.6642661895, 0.3077940222, 0.5),
    x_domain=Domain(-1, 1),
    y_domain=Domain(-1, 1),
    z_domain=Domain(0, 1))
# 2b
# 2
polar = ToPolar(Point=md_slider, System=PlaneXY(0, 0, 0))  # -> Phi, Theta, Radius
# 2c
clamp = Clamp(Value=polar.Radius, Domain=Domain(0, 1))
# 2d
map_md_slider_to_p_arr = Python3Script(x=polar.Phi, md_r=clamp, arr_r=py3.arr_r)  # -> pt; inputs x: Double, md_r: Double, arr_r: Double
# ---------- map_md_slider_to_p_arr: Python ----------
__author__ = "isabel"
__version__ = "2025.11.21"

import ghpythonlib.components as ghcps
from math import sin, cos

scaled_r = md_r*arr_r
px, py = scaled_r*cos(x), scaled_r*sin(x)
pt = ghcps.ConstructPoint(px, py, 0)
# ---------- end map_md_slider_to_p_arr ----------

# ----
# 3a
area = Area(Geometry=arrpolar.Geometry)  # -> Area, Centroid
dist = Distance(PointA=area.Centroid, PointB=map_md_slider_to_p_arr)
bnd = Bounds(Numbers=dist)
# 3
dedomain = DeconstructDomain(Domain=bnd)  # -> Start, End
subtraction = Subtraction(A=dedomain.End, B=dedomain.Start)
division = Division(A=dist, B=subtraction)
clamp_2 = Clamp(Value=division, Domain="0.1 to 0.9")
subtraction_2 = Subtraction(A="1.0", B=clamp_2)

repel = Slider(0, range=0..1)
filter = StreamFilter(Gate=repel, Stream0=subtraction_2, Stream1=clamp_2)
# 4
boundary = BoundarySurfaces(Edges=arrpolar.Geometry)
scale = Scale(Geometry=boundary, Center=area.Centroid, Factor=filter)  # -> Geometry, Transform
