# Grasshopper definition Figure3-17_polar_stats_from_Python.gh (Grasshopper 1.0.9)

# ----
# Creating a Polar Array
radius = Slider(1, range=0..10)
intra_ring_spacing = Slider(0.6, range=0..10)
num_rings = Slider(11, range=1..20)
# 1a
cir = Circle(Plane=PlaneXY(0, 0, 0), Radius=radius)
# 1b
py3 = Python3Script(r=radius, motif=cir, num_rings=num_rings, spacing=intra_ring_spacing)  # -> rings, count, arr_r, ring_rs; inputs r: Double, motif: Curve, num_rings: Int32, spacing: Double
# ---------- py3: Python ----------
__author__ = "isabel"
__version__ = "2025.11.11"

import ghpythonlib.components as ghc

rings = []
count = []
arr_r = 0
ring_rs = []
motif_diam = (r*2+spacing)

for ring in range(0, num_rings, 1):
    cur_r = r+motif_diam*ring
    cur_circum = 2*3.14*cur_r
    trans_vec = ghc.UnitX(cur_r)
    moved_shp, _ = ghc.Move(motif, trans_vec)
    count.append(cur_circum/motif_diam)
    rings.append(moved_shp)
    ring_rs.append(cur_r)

    if ring == num_rings-1:
        arr_r = cur_r + r
# ---------- end py3 ----------
# 1c
arrpolar = PolarArray(Geometry=py3.rings, Plane=PlaneXY(0, 0, 0), Count=py3.count, Angle=6.283185307)  # -> flatten(Geometry), Transform

concentric_rings = Circle(Plane=PlaneXY(0, 0, 0), Radius=[py3.arr_r, py3.ring_rs])

# ---- group: motif at each ring
# 1
crv = Curve(py3.rings)
