# Grasshopper definition Figure3-23_2D_rect_attr_curve_emitter.gh (Grasshopper 1.0.9)

segments = Slider(6, range=3..12)
# 2D Attractor & Repeller with Curve Emitter
radius = Slider(1.2, range=0.01..5)
cell_x_scale = Slider(1.43, range=0.01..3)
cell_y_scale = Slider(1.25, range=0.01..3)
# 1
polygon = Polygon(Plane=PlaneXY(0, 0, 0), Radius=radius, Segments=segments, FilletRadius=0)  # -> Polygon, Length
x_count = Slider(12, range=0..20)
y_count = Slider(10, range=0..20)
bbox = BoundingBox(Content=polygon.Polygon, Plane=PlaneXY(0, 0, 0))  # -> Box, Box_2
scale_nu = ScaleNU(Geometry=bbox.Box, Plane=PlaneXY(0, 0, 0), ScaleX=cell_x_scale, ScaleY=cell_y_scale, ScaleZ=1)  # -> Geometry, Transform
arrrec = RectangularArray(Geometry=polygon.Polygon, Cell=scale_nu.Geometry, XCount=x_count, YCount=y_count)  # -> Geometry, Transform

bbox_2 = BoundingBox(Content=arrrec.Geometry, Plane=PlaneXY(0, 0, 0), UnionBox=True)  # -> Box, Box_2
y_t1 = Slider(0.3, range=0..1)
y_t2 = Slider(0.7, range=0..1)
debox = DeconstructBox(Box=bbox_2.Box)  # -> Plane, X, Y, Z
# 2a
dedomain = DeconstructDomain(Domain=debox.X)  # -> Start, End
# 2b
# 2c
# 2d
dedomain_2 = DeconstructDomain(Domain=debox.Y)  # -> Start, End
# 2e
interp = InterpolateData(Data=[dedomain_2.Start, dedomain_2.End], Parameter=[y_t1, y_t2], Interpolation=2)
# 2f
# 2
pt = ConstructPoint(XCoordinate=[dedomain.Start, dedomain.End], YCoordinate=interp, ZCoordinate=0)
# 2g
intcrv = Interpolate(Vertices=pt, Degree=3, Periodic=False, KnotStyle=1)  # -> Curve, Length, Domain

pcen = PolygonCenter(Polyline=arrrec.Geometry)  # -> CenterV, CenterE, CenterA
# 3a
crv_cp = CurveClosestPoint(Point=pcen.CenterV, Curve=intcrv.Curve)  # -> Point, Parameter, Distance
dist = Distance(PointA=pcen.CenterV, PointB=crv_cp.Point)
bnd = Bounds(Numbers=dist)
# 3
dedomain_3 = DeconstructDomain(Domain=bnd)  # -> Start, End
subtraction = Subtraction(A=dedomain_3.End, B=dedomain_3.Start)
division = Division(A=dist, B=subtraction)
clamp = Clamp(Value=division, Domain="0.1 to 0.9")
subtraction_2 = Subtraction(A="1.0", B=clamp)

repel = Slider(0, range=0..1)
filter = StreamFilter(Gate=repel, Stream0=subtraction_2, Stream1=clamp)
# 4
boundary = BoundarySurfaces(Edges=arrrec.Geometry)
scale = Scale(Geometry=boundary, Center=pcen.CenterV, Factor=filter)  # -> Geometry, Transform
