# Grasshopper definition Figure3-26_polar_attr_curve_emitter.gh (Grasshopper 1.0.9)

# ----
# Polar Attractor/Repeller with Curve Emitter
radius = Slider(1, range=0..10)
intra_ring_spacing = Slider(0.6, range=0..10)
num_rings = Slider(11, range=1..20)
# 1a
cir = Circle(Plane=PlaneXY(0, 0, 0), Radius=radius)
# 1
# 1b
py3 = Python3Script(r=radius, motif=cir, num_rings=num_rings, spacing=intra_ring_spacing)  # -> rings, count, arr_r; inputs r: Double, motif: Curve, num_rings: Int32, spacing: Double
# ---------- py3: Python ----------
__author__ = "isabel"
__version__ = "2025.11.11"

import ghpythonlib.components as ghc

rings = []
count = []
arr_r = 0
motif_diam = (r*2+spacing)

for ring in range(0, num_rings, 1):
    cur_r = r+motif_diam*ring
    cur_circum = 2*3.14*cur_r
    trans_vec = ghc.UnitX(cur_r)
    moved_shp, _ = ghc.Move(motif, trans_vec)
    count.append(cur_circum/motif_diam)
    rings.append(moved_shp)

    if ring == num_rings-1:
        arr_r = cur_r + r
# ---------- end py3 ----------
# 1c
arrpolar = PolarArray(Geometry=py3.rings, Plane=PlaneXY(0, 0, 0), Count=py3.count, Angle=6.283185307)  # -> flatten(Geometry), Transform

bbox = BoundingBox(Content=arrpolar.Geometry, Plane=PlaneXY(0, 0, 0), UnionBox=True)  # -> Box, Box_2
y_t1 = Slider(0.3, range=0..1)
y_t2 = Slider(0.7, range=0..1)
debox = DeconstructBox(Box=bbox.Box)  # -> Plane, X, Y, Z
# 2a
dedomain = DeconstructDomain(Domain=debox.X)  # -> Start, End
# 2b
# 2c
# 2d
dedomain_2 = DeconstructDomain(Domain=debox.Y)  # -> Start, End
# 2e
interp = InterpolateData(Data=[dedomain_2.Start, dedomain_2.End], Parameter=[y_t1, y_t2], Interpolation=2)
# 2
# 2f
pt = ConstructPoint(XCoordinate=[dedomain.Start, dedomain.End], YCoordinate=interp, ZCoordinate=0)
# 2g
intcrv = Interpolate(Vertices=pt, Degree=3, Periodic=False, KnotStyle=1)  # -> Curve, Length, Domain

area = Area(Geometry=arrpolar.Geometry)  # -> Area, Centroid
# 3a
crv_cp = CurveClosestPoint(Point=area.Centroid, Curve=intcrv.Curve)  # -> Point, Parameter, Distance
dist = Distance(PointA=area.Centroid, PointB=crv_cp.Point)
# 3
bnd = Bounds(Numbers=dist)
dedomain_3 = DeconstructDomain(Domain=bnd)  # -> Start, End
subtraction = Subtraction(A=dedomain_3.End, B=dedomain_3.Start)
division = Division(A=dist, B=subtraction)
clamp = Clamp(Value=division, Domain="0.1 to 0.9")
subtraction_2 = Subtraction(A="1.0", B=clamp)

repel = Slider(0, range=0..1)
filter = StreamFilter(Gate=repel, Stream0=subtraction_2, Stream1=clamp)
# 4
boundary = BoundarySurfaces(Edges=arrpolar.Geometry)
scale = Scale(Geometry=boundary, Center=area.Centroid, Factor=filter)  # -> Geometry, Transform
