# Grasshopper definition Figure3-28_3D_attr_curve_emitter.gh (Grasshopper 1.0.9)

segments = Slider(4, range=3..12)
# 3D Attractor with Curve Emitter
radius = Slider(1.84, range=0.01..5)
cell_x_scale = Slider(1.13, range=0.01..3)
cell_y_scale = Slider(1.13, range=0.01..3)
polygon = Polygon(Plane=PlaneXY(0, 0, 0), Radius=radius, Segments=segments, FilletRadius=0)  # -> Polygon, Length
x_count = Slider(12, range=0..20)
y_count = Slider(11, range=0..20)
bbox = BoundingBox(Content=polygon.Polygon, Plane=PlaneXY(0, 0, 0))  # -> Box, Box_2
scale_nu = ScaleNU(Geometry=bbox.Box, Plane=PlaneXY(0, 0, 0), ScaleX=cell_x_scale, ScaleY=cell_y_scale, ScaleZ=1)  # -> Geometry, Transform
arrrec = RectangularArray(Geometry=polygon.Polygon, Cell=scale_nu.Geometry, XCount=x_count, YCount=y_count)  # -> Geometry, Transform

# ----
# 2a
# 2g
# 2f
# 2e
# 2b
# 2c
# 2
# 2d
bbox_2 = BoundingBox(Content=arrrec.Geometry, Plane=PlaneXY(0, 0, 0), UnionBox=True)  # -> Box, Box_2
y_t1 = Slider(0.3, range=0..1)
y_t2 = Slider(0.7, range=0..1)
debox = DeconstructBox(Box=bbox_2.Box)  # -> Plane, X, Y, Z
dedomain = DeconstructDomain(Domain=debox.X)  # -> Start, End
dedomain_2 = DeconstructDomain(Domain=debox.Y)  # -> Start, End
interp = InterpolateData(Data=[dedomain_2.Start, dedomain_2.End], Parameter=[y_t1, y_t2], Interpolation=2)
pt = ConstructPoint(XCoordinate=[dedomain.Start, dedomain.End], YCoordinate=interp, ZCoordinate=0)
intcrv = Interpolate(Vertices=pt, Degree=3, Periodic=False, KnotStyle=1)  # -> Curve, Length, Domain

pcen = PolygonCenter(Polyline=arrrec.Geometry)  # -> CenterV, CenterE, CenterA
crv_cp = CurveClosestPoint(Point=pcen.CenterV, Curve=intcrv.Curve)  # -> Point, Parameter, Distance
dist = Distance(PointA=pcen.CenterV, PointB=crv_cp.Point)
bnd = Bounds(Numbers=dist)
dedomain_3 = DeconstructDomain(Domain=bnd)  # -> Start, End
subtraction = Subtraction(A=dedomain_3.End, B=dedomain_3.Start)
division = Division(A=dist, B=subtraction)
clamp = Clamp(Value=division, Domain="0.1 to 0.9")

repel = Slider(0, range=0..1)
subtraction_2 = Subtraction(A="1.0", B=clamp)
filter = StreamFilter(Gate=repel, Stream0=subtraction_2, Stream1=clamp)
boundary = BoundarySurfaces(Edges=arrrec.Geometry)
scale = Scale(Geometry=boundary, Center=pcen.CenterV, Factor=filter)  # -> Geometry, Transform

height = Slider(18.65, range=1..50)
multiplication = Multiplication(A=filter, B=height)
Z = UnitZ(Factor=multiplication)
extr = Extrude(Base=scale.Geometry, Direction=Z)
