# Grasshopper definition Figure3-2_1D_array.gh (Grasshopper 1.0.9)

segments = Slider(6, range=3..12)
# 3
number_slider = Slider(3, range=1..10)
# 1D Array (Linear)
radius = Slider(1, range=0.01..5)
# 1
polygon = Polygon(Plane=PlaneXY(0, 0, 0), Radius=radius, Segments=segments, FilletRadius=0)  # -> Polygon, Length
X = UnitX(Factor=number_slider)
# 2
arrlinear = LinearArray(Geometry=polygon.Polygon, Direction=X, Count=Slider(5, range=0..20))  # -> Geometry, Transform
