# Grasshopper definition Figure3-3_1D_array_custom_spacing.gh (Grasshopper 1.0.9)

# Adding Additional Offset Between Motif Repeats
radius = Slider(1, range=0.01..5)
segments = Slider(6, range=3..12)
# Use Motif Bounding Box to Derive Linear Offset
radius_2 = Slider(1, range=0.01..5)
segments_2 = Slider(6, range=3..12)
polygon = Polygon(Plane=PlaneXY(0, 0, 0), Radius=radius, Segments=segments, FilletRadius=0)  # -> Polygon, Length
polygon_2 = Polygon(Plane=PlaneXY(0, 0, 0), Radius=radius_2, Segments=segments_2, FilletRadius=0)  # -> Polygon, Length

bbox = BoundingBox(Content=polygon.Polygon, Plane=PlaneXY(0, 0, 0))  # -> Box, Box_2
debox = DeconstructBox(Box=bbox.Box)  # -> Plane, X, Y, Z
dedomain = DeconstructDomain(Domain=debox.X)  # -> Start, End
offset = Slider(2, range=-2..20)
subtraction = Subtraction(A=dedomain.End, B=dedomain.Start)
# 5
addition = Addition(A=subtraction, B=offset)

# ----
# 1
bbox_2 = BoundingBox(Content=polygon_2.Polygon, Plane=PlaneXY(0, 0, 0))  # -> Box, Box_2
# 2
debox_2 = DeconstructBox(Box=bbox_2.Box)  # -> Plane, X, Y, Z
# 3
dedomain_2 = DeconstructDomain(Domain=debox_2.X)  # -> Start, End
# 4
subtraction_2 = Subtraction(A=dedomain_2.End, B=dedomain_2.Start)

count = Slider(5, range=0..20)
X = UnitX(Factor=subtraction_2)
arrlinear = LinearArray(Geometry=polygon_2.Polygon, Direction=X, Count=Slider(5, range=0..20))  # -> Geometry, Transform
X_2 = UnitX(Factor=addition)
arrlinear_2 = LinearArray(Geometry=polygon.Polygon, Direction=X_2, Count=count)  # -> Geometry, Transform
