# Grasshopper definition Figure3-7_1.5D_Y_levitation.gh (Grasshopper 1.0.9)

segments = Slider(6, range=3..12)
# 1.5D Attractor (1D Plus Y Offset)
radius = Slider(1, range=0.01..5)
polygon = Polygon(Plane=PlaneXY(0, 0, 0), Radius=radius, Segments=segments, FilletRadius=0)  # -> Polygon, Length
bbox = BoundingBox(Content=polygon.Polygon, Plane=PlaneXY(0, 0, 0))  # -> Box, Box_2
debox = DeconstructBox(Box=bbox.Box)  # -> Plane, X, Y, Z
dedomain = DeconstructDomain(Domain=debox.X)  # -> Start, End
offset = Slider(0.1, range=-2..20)
subtraction = Subtraction(A=dedomain.End, B=dedomain.Start)
count = Slider(12, range=0..20)
addition = Addition(A=subtraction, B=offset)
X = UnitX(Factor=addition)
arrlinear = LinearArray(Geometry=polygon.Polygon, Direction=X, Count=count)  # -> Geometry, Transform

# ---- group: Emitter t
t = Slider(0.7, range=0..1)

# ---- group: Length Along X
multiplication = Multiplication(A=addition, B=count)

# ----
pcen = PolygonCenter(Polyline=arrlinear.Geometry)  # -> CenterV, CenterE, CenterA
multiplication_2 = Multiplication(A=t, B=multiplication)
pt = ConstructPoint(XCoordinate=multiplication_2, YCoordinate=0, ZCoordinate=0)
dist = Distance(PointA=pcen.CenterV, PointB=pt)
division = Division(A=dist, B=multiplication)

subtraction_2 = Subtraction(A="1.0", B=division)

clamp = Clamp(Value=subtraction_2, Domain="0.1 to 0.9")

# ----
# Attraction (0) or Repulsion (1)
repel = Slider(1, range=0..1)
subtraction_3 = Subtraction(A="1", B=clamp)
filter = StreamFilter(Gate=repel, Stream0=clamp, Stream1=subtraction_3)

scale = Scale(Geometry=arrlinear.Geometry, Center=pcen.CenterV, Factor=filter)  # -> Geometry, Transform
boundary = BoundarySurfaces(Edges=scale.Geometry)

# ----
# Adding Y Offset (Levitation)
max_y = Slider(10, range=1..100)
multiplication_3 = Multiplication(A=max_y, B=filter)
Y = UnitY(Factor=multiplication_3)
move = Move(Geometry=boundary, Motion=Y)  # -> Geometry, Transform
