# Grasshopper definition Figure4-12_radial_lines_1unit_motif_variations1-4.gh (Grasshopper 1.0.9)

size = Slider(5, range=1..10)
# Single Unit Radial Lines Motif - Variation #1, t = 0
rectangle = Rectangle(Plane=PlaneXY(0, 0, 0), XSize=size, YSize=size, Radius=0)  # -> Rectangle, Length
t = Slider(0, range=0..1)
edges = BrepEdges(Brep=rectangle.Rectangle)  # -> Naked, Interior, NonManifold
pcen = PolygonCenter(Polyline=rectangle.Rectangle)  # -> CenterV, CenterE, CenterA
end = EndPoints(Curve=edges.Naked)  # -> Start, End
eval = EvaluateCurve(Curve=reparameterize(edges.Naked), Parameter=t)  # -> Point, Tangent, Angle
ln = Line(StartPoint=pcen.CenterV, EndPoint=end.Start)
ln_2 = Line(StartPoint=pcen.CenterV, EndPoint=eval.Point)
line = Line([ln, ln_2])

size_2 = Slider(5, range=1..10)
# Single Unit Radial Lines Motif - Variation #1, t = 0.4
rectangle_2 = Rectangle(Plane=PlaneXY(0, 0, 0), XSize=size_2, YSize=size_2, Radius=0)  # -> Rectangle, Length
t_2 = Slider(0.4, range=0..1)
edges_2 = BrepEdges(Brep=rectangle_2.Rectangle)  # -> Naked, Interior, NonManifold
pcen_2 = PolygonCenter(Polyline=rectangle_2.Rectangle)  # -> CenterV, CenterE, CenterA
end_2 = EndPoints(Curve=edges_2.Naked)  # -> Start, End
eval_2 = EvaluateCurve(Curve=reparameterize(edges_2.Naked), Parameter=t_2)  # -> Point, Tangent, Angle
ln_3 = Line(StartPoint=pcen_2.CenterV, EndPoint=end_2.Start)
ln_4 = Line(StartPoint=pcen_2.CenterV, EndPoint=eval_2.Point)
line_2 = Line([ln_3, ln_4])

xz = XZPlane(Origin=Point(0, 0, 0))
mirror = Mirror(Geometry=line, Plane=xz)  # -> Geometry, Transform
Y = UnitY(Factor=size)
move = Move(Geometry=mirror.Geometry, Motion=Y)  # -> Geometry, Transform

xz_2 = XZPlane(Origin=Point(0, 0, 0))
mirror_2 = Mirror(Geometry=line_2, Plane=xz_2)  # -> Geometry, Transform
Y_2 = UnitY(Factor=size_2)
move_2 = Move(Geometry=mirror_2.Geometry, Motion=Y_2)  # -> Geometry, Transform

# ---- group: Visualize Which Line is Which
item = ListItem(List=ln, Index=0, Wrap=True)  # -> Item, Item1, Item2, Item3
line_3 = Line(item.Item)
line_4 = Line(item.Item1)
line_5 = Line(item.Item2)
line_6 = Line(item.Item3)

item_2 = ListItem(List=ln_3, Index=0, Wrap=True)  # -> Item, Item1, Item2, Item3
line_7 = Line(item_2.Item)
line_8 = Line(item_2.Item1)
line_9 = Line(item_2.Item2)
line_10 = Line(item_2.Item3)

# ----
tess_x_count = Slider(4, range=1..100)
tess_y_count = Slider(3, range=1..100)

tess_y_count_2 = Slider(3, range=1..100)
tess_x_count_2 = Slider(4, range=1..100)

# ---- group: Single Radial Lines Tile
join = JoinCurves(Curves=[move.Geometry, line], Preserve=False)

join_2 = JoinCurves(Curves=[move_2.Geometry, line_2], Preserve=False)

# ---- group: Tess Interior
arrrec = RectangularArray(Geometry=join, Cell=rectangle.Rectangle, XCount=tess_x_count, YCount=tess_y_count)  # -> Geometry, Transform

arrrec_2 = RectangularArray(Geometry=join_2, Cell=rectangle_2.Rectangle, XCount=tess_x_count_2, YCount=tess_y_count_2)  # -> Geometry, Transform

# ---- group: Tess Border
bbox = BoundingBox(Content=flatten(arrrec.Geometry), Plane=PlaneXY(0, 0, 0), UnionBox=True)  # -> Box, Box_2
edges_3 = BrepEdges(Brep=bbox.Box)  # -> Naked, Interior, NonManifold

bbox_2 = BoundingBox(Content=flatten(arrrec_2.Geometry), Plane=PlaneXY(0, 0, 0), UnionBox=True)  # -> Box, Box_2
edges_4 = BrepEdges(Brep=bbox_2.Box)  # -> Naked, Interior, NonManifold

# ---- group: Tess from Single Unit Radial Lines Motif
mp = MultiPipe(
    Curves=[arrrec.Geometry, edges_3.Naked],
    NodeSize=Slider(0.05, range=0..0.1),
    EndOffset=1,
    StrutSize=1,
    Segment=0,
    KinkAngle=0.6,
    CubeFit=0,
    Caps=0)

# ---- group: Final Output
mp_2 = MultiPipe(
    Curves=[arrrec_2.Geometry, edges_4.Naked],
    NodeSize=Slider(0.05, range=0..0.1),
    EndOffset=1,
    StrutSize=1,
    Segment=0,
    KinkAngle=0.6,
    CubeFit=0,
    Caps=0)

# ----
dim = Dimensions(Surface=bbox.Box)  # -> UDimension, VDimension
addition = Addition(A=dim.VDimension, B=Slider(2, range=0..10))
Y_3 = UnitY(Factor=addition)

# ---- group: Final Output
move_3 = Move(Geometry=mp, Motion=Y_3)  # -> Geometry, Transform

# ----
size_3 = Slider(5, range=1..10)
# Single Unit Radial Lines Motif - Variation #1, t = 0.1
rectangle_3 = Rectangle(Plane=PlaneXY(0, 0, 0), XSize=size_3, YSize=size_3, Radius=0)  # -> Rectangle, Length
t_3 = Slider(0.1, range=0..1)
edges_5 = BrepEdges(Brep=rectangle_3.Rectangle)  # -> Naked, Interior, NonManifold
pcen_3 = PolygonCenter(Polyline=rectangle_3.Rectangle)  # -> CenterV, CenterE, CenterA
end_3 = EndPoints(Curve=edges_5.Naked)  # -> Start, End
eval_3 = EvaluateCurve(Curve=reparameterize(edges_5.Naked), Parameter=t_3)  # -> Point, Tangent, Angle
ln_5 = Line(StartPoint=pcen_3.CenterV, EndPoint=end_3.Start)
ln_6 = Line(StartPoint=pcen_3.CenterV, EndPoint=eval_3.Point)
line_11 = Line([ln_5, ln_6])

size_4 = Slider(5, range=1..10)
# Single Unit Radial Lines Motif - Variation #1, t = 0.5
rectangle_4 = Rectangle(Plane=PlaneXY(0, 0, 0), XSize=size_4, YSize=size_4, Radius=0)  # -> Rectangle, Length
t_4 = Slider(0.5, range=0..1)
edges_6 = BrepEdges(Brep=rectangle_4.Rectangle)  # -> Naked, Interior, NonManifold
pcen_4 = PolygonCenter(Polyline=rectangle_4.Rectangle)  # -> CenterV, CenterE, CenterA
end_4 = EndPoints(Curve=edges_6.Naked)  # -> Start, End
eval_4 = EvaluateCurve(Curve=reparameterize(edges_6.Naked), Parameter=t_4)  # -> Point, Tangent, Angle
ln_7 = Line(StartPoint=pcen_4.CenterV, EndPoint=end_4.Start)
ln_8 = Line(StartPoint=pcen_4.CenterV, EndPoint=eval_4.Point)
line_12 = Line([ln_7, ln_8])

xz_3 = XZPlane(Origin=Point(0, 0, 0))
mirror_3 = Mirror(Geometry=line_11, Plane=xz_3)  # -> Geometry, Transform
Y_4 = UnitY(Factor=size_3)
move_4 = Move(Geometry=mirror_3.Geometry, Motion=Y_4)  # -> Geometry, Transform

# ---- group: Visualize Which Line is Which
item_3 = ListItem(List=ln_5, Index=0, Wrap=True)  # -> Item, Item1, Item2, Item3
line_13 = Line(item_3.Item)
line_14 = Line(item_3.Item1)
line_15 = Line(item_3.Item2)
line_16 = Line(item_3.Item3)

# ----
xz_4 = XZPlane(Origin=Point(0, 0, 0))
mirror_4 = Mirror(Geometry=line_12, Plane=xz_4)  # -> Geometry, Transform
Y_5 = UnitY(Factor=size_4)
move_5 = Move(Geometry=mirror_4.Geometry, Motion=Y_5)  # -> Geometry, Transform

# ---- group: Visualize Which Line is Which
item_4 = ListItem(List=ln_7, Index=0, Wrap=True)  # -> Item, Item1, Item2, Item3
line_17 = Line(item_4.Item)
line_18 = Line(item_4.Item1)
line_19 = Line(item_4.Item2)
line_20 = Line(item_4.Item3)

# ----
tess_x_count_3 = Slider(4, range=1..100)
tess_y_count_3 = Slider(3, range=1..100)

tess_x_count_4 = Slider(4, range=1..100)
tess_y_count_4 = Slider(3, range=1..100)

# ---- group: Single Radial Lines Tile
join_3 = JoinCurves(Curves=[move_4.Geometry, line_11], Preserve=False)

join_4 = JoinCurves(Curves=[move_5.Geometry, line_12], Preserve=False)

# ---- group: Tess Interior
arrrec_3 = RectangularArray(Geometry=join_3, Cell=rectangle_3.Rectangle, XCount=tess_x_count_3, YCount=tess_y_count_3)  # -> Geometry, Transform

arrrec_4 = RectangularArray(Geometry=join_4, Cell=rectangle_4.Rectangle, XCount=tess_x_count_4, YCount=tess_y_count_4)  # -> Geometry, Transform

# ---- group: Tess Border
bbox_3 = BoundingBox(Content=flatten(arrrec_3.Geometry), Plane=PlaneXY(0, 0, 0), UnionBox=True)  # -> Box, Box_2
edges_7 = BrepEdges(Brep=bbox_3.Box)  # -> Naked, Interior, NonManifold

bbox_4 = BoundingBox(Content=flatten(arrrec_4.Geometry), Plane=PlaneXY(0, 0, 0), UnionBox=True)  # -> Box, Box_2
edges_8 = BrepEdges(Brep=bbox_4.Box)  # -> Naked, Interior, NonManifold

# ---- group: Tess from Single Unit Radial Lines Motif
mp_3 = MultiPipe(
    Curves=[arrrec_3.Geometry, edges_7.Naked],
    NodeSize=Slider(0.05, range=0..0.1),
    EndOffset=1,
    StrutSize=1,
    Segment=0,
    KinkAngle=0.6,
    CubeFit=0,
    Caps=0)

mp_4 = MultiPipe(
    Curves=[arrrec_4.Geometry, edges_8.Naked],
    NodeSize=Slider(0.05, range=0..0.1),
    EndOffset=1,
    StrutSize=1,
    Segment=0,
    KinkAngle=0.6,
    CubeFit=0,
    Caps=0)

# ----
dim_2 = Dimensions(Surface=bbox_3.Box)  # -> UDimension, VDimension
dim_3 = Dimensions(Surface=bbox_4.Box)  # -> UDimension, VDimension
addition_2 = Addition(A=dim_2.UDimension, B="2")
addition_3 = Addition(A=dim_2.VDimension, B="2")
addition_4 = Addition(A=dim_3.UDimension, B="2")
vec = VectorXYZ(XComponent=addition_2, YComponent=addition_3, ZComponent=0)  # -> Vector, Length
vec_2 = VectorXYZ(XComponent=addition_4, YComponent=0, ZComponent=0)  # -> Vector, Length

# ---- group: Final Output
move_6 = Move(Geometry=mp_3, Motion=vec.Vector)  # -> Geometry, Transform

move_7 = Move(Geometry=mp_4, Motion=vec_2.Vector)  # -> Geometry, Transform
