# Grasshopper definition Figure4-13_to_4-15_radial_lines_4unit_motif.gh (Grasshopper 1.0.9)

# ----
# Tess form 4-Unit Radial Lines Motif
size = Slider(5, range=1..10)
rectangle = Rectangle(Plane=PlaneXY(0, 0, 0), XSize=size, YSize=size, Radius=0)  # -> Rectangle, Length
t = Slider(0.7, range=0..1)
edges = BrepEdges(Brep=rectangle.Rectangle)  # -> Naked, Interior, NonManifold
pcen = PolygonCenter(Polyline=rectangle.Rectangle)  # -> CenterV, CenterE, CenterA
end = EndPoints(Curve=edges.Naked)  # -> Start, End
eval = EvaluateCurve(Curve=reparameterize(edges.Naked), Parameter=t)  # -> Point, Tangent, Angle
ln = Line(StartPoint=pcen.CenterV, EndPoint=end.Start)
ln_2 = Line(StartPoint=pcen.CenterV, EndPoint=eval.Point)
line = Line([ln, ln_2])

# ---- group: Visualize Which Line is Which
item = ListItem(List=ln, Index=0, Wrap=True)  # -> Item, Item1, Item2, Item3
line_2 = Line(item.Item)
line_3 = Line(item.Item1)
line_4 = Line(item.Item2)
line_5 = Line(item.Item3)

# ----
mirror = Mirror(Geometry=line, Plane=PlaneYZ(0, 0, 0))  # -> Geometry, Transform
xz = XZPlane(Origin=Point(0, 0, 0))
F = Slider(2, range=0..5)
scale_nu = ScaleNU(Geometry=rectangle.Rectangle, Plane=PlaneXY(0, 0, 0), ScaleX=F, ScaleY=F, ScaleZ=1)  # -> Geometry, Transform

# ---- group: Bottom Half
mirror_2 = Mirror(Geometry=[line, mirror.Geometry], Plane=xz)  # -> Geometry, Transform

# ---- group: Top Half
join = JoinCurves(Curves=[line, mirror.Geometry], Preserve=False)

# ---- group: 4-Unit Motif
join_2 = JoinCurves(Curves=[mirror_2.Geometry, join], Preserve=False)

# ----
tess_x_count = Slider(6, range=1..100)
tess_y_count = Slider(3, range=1..100)

# ---- group: Tess Interior
arrrec = RectangularArray(Geometry=join_2, Cell=scale_nu.Geometry, XCount=tess_x_count, YCount=tess_y_count)  # -> Geometry, Transform

# ---- group: Tess Border
bbox = BoundingBox(Content=flatten(arrrec.Geometry), Plane=PlaneXY(0, 0, 0), UnionBox=True)  # -> Box, Box_2
edges_2 = BrepEdges(Brep=bbox.Box)  # -> Naked, Interior, NonManifold

# ---- group: Tess from 4-Unit Radial Lines Motif
mp = MultiPipe(
    Curves=[arrrec.Geometry, edges_2.Naked],
    NodeSize=Slider(0.05, range=0..0.1),
    EndOffset=1,
    StrutSize=1,
    Segment=0,
    KinkAngle=0.6,
    CubeFit=0,
    Caps=0)
