# Grasshopper definition Figure4-16_radial_lines_4unit_motif_variations.gh (Grasshopper 1.0.9)

# ----
# 4-Unit Radial Lines Motif - Variation #1
size = Slider(5, range=1..10)
rectangle = Rectangle(Plane=PlaneXY(0, 0, 0), XSize=size, YSize=size, Radius=0)  # -> Rectangle, Length
t = Slider(0.1, range=0..1)
edges = BrepEdges(Brep=rectangle.Rectangle)  # -> Naked, Interior, NonManifold
pcen = PolygonCenter(Polyline=rectangle.Rectangle)  # -> CenterV, CenterE, CenterA
end = EndPoints(Curve=edges.Naked)  # -> Start, End
eval = EvaluateCurve(Curve=reparameterize(edges.Naked), Parameter=t)  # -> Point, Tangent, Angle
ln = Line(StartPoint=pcen.CenterV, EndPoint=end.Start)
ln_2 = Line(StartPoint=pcen.CenterV, EndPoint=eval.Point)
line = Line([ln, ln_2])

# ---- group: Visualize Which Line is Which
item = ListItem(List=ln, Index=0, Wrap=True)  # -> Item, Item1, Item2, Item3
line_2 = Line(item.Item)
line_3 = Line(item.Item1)
line_4 = Line(item.Item2)
line_5 = Line(item.Item3)

# ----
mirror = Mirror(Geometry=line, Plane=PlaneYZ(0, 0, 0))  # -> Geometry, Transform
xz = XZPlane(Origin=Point(0, 0, 0))
F = Slider(2, range=0..5)
scale_nu = ScaleNU(Geometry=rectangle.Rectangle, Plane=PlaneXY(0, 0, 0), ScaleX=F, ScaleY=F, ScaleZ=1)  # -> Geometry, Transform

# ---- group: Bottom Half
mirror_2 = Mirror(Geometry=[line, mirror.Geometry], Plane=xz)  # -> Geometry, Transform

# ---- group: Top Half
join = JoinCurves(Curves=[line, mirror.Geometry], Preserve=False)

# ---- group: 4-Unit Motif
join_2 = JoinCurves(Curves=[mirror_2.Geometry, join], Preserve=False)

# ----
tess_x_count = Slider(2, range=1..100)
tess_y_count = Slider(2, range=1..100)

# ---- group: Tess Interior
arrrec = RectangularArray(Geometry=join_2, Cell=scale_nu.Geometry, XCount=tess_x_count, YCount=tess_y_count)  # -> Geometry, Transform

# ---- group: Tess Border
bbox = BoundingBox(Content=flatten(arrrec.Geometry), Plane=PlaneXY(0, 0, 0), UnionBox=True)  # -> Box, Box_2
edges_2 = BrepEdges(Brep=bbox.Box)  # -> Naked, Interior, NonManifold

# ---- group: Final Output
mp = MultiPipe(
    Curves=[arrrec.Geometry, edges_2.Naked],
    NodeSize=Slider(0.05, range=0..0.1),
    EndOffset=1,
    StrutSize=1,
    Segment=0,
    KinkAngle=0.6,
    CubeFit=0,
    Caps=0)

# ----
# 4-Unit Radial Lines Motif - Variation #2
size_2 = Slider(5, range=1..10)
rectangle_2 = Rectangle(Plane=PlaneXY(0, 0, 0), XSize=size_2, YSize=size_2, Radius=0)  # -> Rectangle, Length
t_2 = Slider(0.4, range=0..1)
edges_3 = BrepEdges(Brep=rectangle_2.Rectangle)  # -> Naked, Interior, NonManifold
pcen_2 = PolygonCenter(Polyline=rectangle_2.Rectangle)  # -> CenterV, CenterE, CenterA
end_2 = EndPoints(Curve=edges_3.Naked)  # -> Start, End
eval_2 = EvaluateCurve(Curve=reparameterize(edges_3.Naked), Parameter=t_2)  # -> Point, Tangent, Angle
ln_3 = Line(StartPoint=pcen_2.CenterV, EndPoint=end_2.Start)
ln_4 = Line(StartPoint=pcen_2.CenterV, EndPoint=eval_2.Point)
line_6 = Line([ln_3, ln_4])

# ---- group: Visualize Which Line is Which
item_2 = ListItem(List=ln_3, Index=0, Wrap=True)  # -> Item, Item1, Item2, Item3
line_7 = Line(item_2.Item)
line_8 = Line(item_2.Item1)
line_9 = Line(item_2.Item2)
line_10 = Line(item_2.Item3)

# ----
mirror_3 = Mirror(Geometry=line_6, Plane=PlaneYZ(0, 0, 0))  # -> Geometry, Transform
xz_2 = XZPlane(Origin=Point(0, 0, 0))
F_2 = Slider(2, range=0..5)
scale_nu_2 = ScaleNU(Geometry=rectangle_2.Rectangle, Plane=PlaneXY(0, 0, 0), ScaleX=F_2, ScaleY=F_2, ScaleZ=1)  # -> Geometry, Transform

# ---- group: Bottom Half
mirror_4 = Mirror(Geometry=[line_6, mirror_3.Geometry], Plane=xz_2)  # -> Geometry, Transform

# ---- group: Top Half
join_3 = JoinCurves(Curves=[line_6, mirror_3.Geometry], Preserve=False)

# ---- group: 4-Unit Motif
join_4 = JoinCurves(Curves=[mirror_4.Geometry, join_3], Preserve=False)

# ----
tess_x_count_2 = Slider(2, range=1..100)
tess_y_count_2 = Slider(2, range=1..100)

# ---- group: Tess Interior
arrrec_2 = RectangularArray(Geometry=join_4, Cell=scale_nu_2.Geometry, XCount=tess_x_count_2, YCount=tess_y_count_2)  # -> Geometry, Transform

# ---- group: Tess Border
bbox_2 = BoundingBox(Content=flatten(arrrec_2.Geometry), Plane=PlaneXY(0, 0, 0), UnionBox=True)  # -> Box, Box_2
edges_4 = BrepEdges(Brep=bbox_2.Box)  # -> Naked, Interior, NonManifold

# ---- group: Tess from 4-Unit Radial Lines Motif
mp_2 = MultiPipe(
    Curves=[arrrec_2.Geometry, edges_4.Naked],
    NodeSize=Slider(0.05, range=0..0.1),
    EndOffset=1,
    StrutSize=1,
    Segment=0,
    KinkAngle=0.6,
    CubeFit=0,
    Caps=0)

# ----
dim = Dimensions(Surface=bbox_2.Box)  # -> UDimension, VDimension
addition = Addition(A=dim.UDimension, B="2")
X = UnitX(Factor=addition)

# ---- group: Final Output
move = Move(Geometry=mp_2, Motion=X)  # -> Geometry, Transform
