# Grasshopper definition Figure4-17_to_4-20_sliding_pts_along_diagonals.gh (Grasshopper 1.0.9)

size = Slider(5, range=1..10)
rectangle = Rectangle(Plane=PlaneXY(0, 0, 0), XSize=size, YSize=size, Radius=0)  # -> Rectangle, Length
# Motif from Connecting Sliding Points Along Diagonals
# 1
t = Slider(0.3, range=0..1)
edges = BrepEdges(Brep=rectangle.Rectangle)  # -> Naked, Interior, NonManifold
eval = EvaluateCurve(Curve=reparameterize(edges.Naked), Parameter=t)  # -> Point, Tangent, Angle
end = EndPoints(Curve=edges.Naked)  # -> Start, End

# ---- group: Cell Edge Sliding Points
item = ListItem(List=eval.Point, Index=0, Wrap=True)  # -> Item, Item1, Item2, Item3
p0 = Point(item.Item)
p1 = Point(item.Item1)
p2 = Point(item.Item2)
p3 = Point(item.Item3)

# ---- group: Cell Corners
item_2 = ListItem(List=end.Start, Index=0, Wrap=True)  # -> Item, Item1, Item2, Item3
p0_2 = Point(item_2.Item)
p1_2 = Point(item_2.Item1)
p2_2 = Point(item_2.Item2)
p3_2 = Point(item_2.Item3)

# ---- group: R Diagonal
ln = Line(StartPoint=p0_2, EndPoint=p2_2)

# ---- group: L Diagonal
ln_2 = Line(StartPoint=p1_2, EndPoint=p3_2)

# ----
t_2 = Slider(0.7, range=0..1)
t_3 = Slider(0.7, range=0..1)
eval_2 = EvaluateCurve(Curve=reparameterize(ln_2), Parameter=t_3)  # -> Point, Tangent, Angle
eval_3 = EvaluateCurve(Curve=reparameterize(ln), Parameter=t_2)  # -> Point, Tangent, Angle
subtraction = Subtraction(A="1.0", B=t_2)
subtraction_2 = Subtraction(A="1.0", B=t_3)
# 2
eval_4 = EvaluateCurve(Curve=reparameterize(ln), Parameter=subtraction)  # -> Point, Tangent, Angle
eval_5 = EvaluateCurve(Curve=reparameterize(ln_2), Parameter=subtraction_2)  # -> Point, Tangent, Angle

# ---- group: Star Right Corner
ln_3 = Line(StartPoint=p1, EndPoint=[eval_3.Point, eval_5.Point])

# ---- group: Star Top Corner
ln_4 = Line(StartPoint=p2, EndPoint=[eval_3.Point, eval_2.Point])

# ---- group: Star Left Corner
ln_5 = Line(StartPoint=p3, EndPoint=[eval_4.Point, eval_2.Point])

# ---- group: Star Bottom Corner
ln_6 = Line(StartPoint=p0, EndPoint=[eval_4.Point, eval_5.Point])

# ---- group: Inner Motif
line = Line([ln_6, ln_3, ln_4, ln_5])

# ----
multiplication = Multiplication(A="2", B=size)
mirror = Mirror(Geometry=line, Plane=PlaneYZ(0, 0, 0))  # -> Geometry, Transform
xz = XZPlane(Origin=Point(0, 0, 0))
rectangle_2 = Rectangle(Plane=PlaneXY(0, 0, 0), XSize=multiplication, YSize=multiplication, Radius=0)  # -> Rectangle, Length
tess_y = Slider(3, range=1..100)
tess_x = Slider(6, range=1..100)

# ---- group: Top Half
crv = Curve([mirror.Geometry, line])

# ---- group: Bottom Half
mirror_2 = Mirror(Geometry=[mirror.Geometry, crv], Plane=xz)  # -> Geometry, Transform

# ---- group: Motif from 4 Mirrored Units
crv_2 = Curve([mirror_2.Geometry, crv])

# ----
arrrec = RectangularArray(Geometry=crv_2, Cell=rectangle_2.Rectangle, XCount=tess_x, YCount=tess_y)  # -> Geometry, Transform

# ---- group: Final Output
# 3
mp = MultiPipe(
    Curves=arrrec.Geometry,
    NodeSize=Slider(0.1, range=0..1),
    EndOffset=1,
    StrutSize=1,
    Segment=0,
    KinkAngle=0.6,
    CubeFit=0,
    Caps=0)
