# Grasshopper definition Figure4-1_tess_examples.gh (Grasshopper 1.0.9)

segments = Slider(8, range=3..12)
# Method #1: Overlapping Polygons
radius = Slider(10, range=0.01..20)
cell_x_scale = Slider(0.84, range=0.01..3)
cell_y_scale = Slider(1.14, range=0.01..3)
# 1
polygon = Polygon(Plane=PlaneXY(0, 0, 0), Radius=radius, Segments=segments, FilletRadius=Slider(1.19, range=0..5))  # -> Polygon, Length
x_count = Slider(4, range=0..20)
y_count = Slider(6, range=0..20)
bbox = BoundingBox(Content=polygon.Polygon, Plane=PlaneXY(0, 0, 0))  # -> Box, Box_2
scale_nu = ScaleNU(Geometry=bbox.Box, Plane=PlaneXY(0, 0, 0), ScaleX=cell_x_scale, ScaleY=cell_y_scale, ScaleZ=1)  # -> Geometry, Transform
arrrec = RectangularArray(Geometry=polygon.Polygon, Cell=scale_nu.Geometry, XCount=x_count, YCount=y_count)  # -> Geometry, Transform

number_slider = Slider(0.5, range=0.1..1)
dim = Dimensions(Surface=scale_nu.Geometry)  # -> UDimension, VDimension
# 2
multiplication = Multiplication(A=dim.UDimension, B=number_slider)
multiplication_2 = Multiplication(A=dim.VDimension, B=number_slider)
vec = VectorXYZ(XComponent=multiplication, YComponent=multiplication_2, ZComponent=0)  # -> Vector, Length
move = Move(Geometry=arrrec.Geometry, Motion=vec.Vector)  # -> Geometry, Transform

# ----
# 3
crv = Curve([arrrec.Geometry, move.Geometry])

# ---- group: Final Output
mp = MultiPipe(Curves=crv, NodeSize=Slider(0.2, range=0.01..1), EndOffset=1, StrutSize=1, Segment=0, KinkAngle=0.6, CubeFit=0, Caps=0)

# ----
size = Slider(5, range=1..10)
rectangle = Rectangle(Plane=PlaneXY(0, 0, 0), XSize=size, YSize=size, Radius=0)  # -> Rectangle, Length
# Method #3: Connecting Sliding Points Along Diagonals
# 1
t = Slider(0.5, range=0..1)
edges = BrepEdges(Brep=rectangle.Rectangle)  # -> Naked, Interior, NonManifold
eval = EvaluateCurve(Curve=reparameterize(edges.Naked), Parameter=t)  # -> Point, Tangent, Angle
end = EndPoints(Curve=edges.Naked)  # -> Start, End

# ---- group: Cell Edge Sliding Points
item = ListItem(List=eval.Point, Index=0, Wrap=True)  # -> Item, Item1, Item2, Item3
p0 = Point(item.Item)
p1 = Point(item.Item1)
p2 = Point(item.Item2)
p3 = Point(item.Item3)

# ---- group: Cell Corners
item_2 = ListItem(List=end.Start, Index=0, Wrap=True)  # -> Item, Item1, Item2, Item3
p0_2 = Point(item_2.Item)
p1_2 = Point(item_2.Item1)
p2_2 = Point(item_2.Item2)
p3_2 = Point(item_2.Item3)

# ---- group: R Diagonal
ln = Line(StartPoint=p0_2, EndPoint=p2_2)

# ---- group: L Diagonal
ln_2 = Line(StartPoint=p1_2, EndPoint=p3_2)

# ----
t_2 = Slider(0, range=0..1)
t_3 = Slider(0.9, range=0..1)
eval_2 = EvaluateCurve(Curve=reparameterize(ln_2), Parameter=t_3)  # -> Point, Tangent, Angle
eval_3 = EvaluateCurve(Curve=reparameterize(ln), Parameter=t_2)  # -> Point, Tangent, Angle
subtraction = Subtraction(A="1.0", B=t_2)
subtraction_2 = Subtraction(A="1.0", B=t_3)
# 2
eval_4 = EvaluateCurve(Curve=reparameterize(ln), Parameter=subtraction)  # -> Point, Tangent, Angle
eval_5 = EvaluateCurve(Curve=reparameterize(ln_2), Parameter=subtraction_2)  # -> Point, Tangent, Angle

# ---- group: Star Right Corner
ln_3 = Line(StartPoint=p1, EndPoint=[eval_3.Point, eval_5.Point])

# ---- group: Star Top Corner
ln_4 = Line(StartPoint=p2, EndPoint=[eval_3.Point, eval_2.Point])

# ---- group: Star Left Corner
ln_5 = Line(StartPoint=p3, EndPoint=[eval_4.Point, eval_2.Point])

# ---- group: Star Bottom Corner
ln_6 = Line(StartPoint=p0, EndPoint=[eval_4.Point, eval_5.Point])

# ---- group: Inner Motif
line = Line([ln_6, ln_3, ln_4, ln_5])

# ----
# Method #4: Maelstrom
size_2 = Slider(5, range=1..10)
rectangle_2 = Rectangle(Plane=PlaneXY(0, 0, 0), XSize=size_2, YSize=size_2, Radius=0)  # -> Rectangle, Length
division = Division(A=size_2, B="2")
t_4 = Slider(0.8, range=0..1)
edges_2 = BrepEdges(Brep=rectangle_2.Rectangle)  # -> Naked, Interior, NonManifold
pcen = PolygonCenter(Polyline=rectangle_2.Rectangle)  # -> CenterV, CenterE, CenterA
# 1
# 1
end_2 = EndPoints(Curve=edges_2.Naked)  # -> Start, End
eval_6 = EvaluateCurve(Curve=reparameterize(edges_2.Naked), Parameter=t_4)  # -> Point, Tangent, Angle
multiplication_3 = Multiplication(A=division, B=Slider(0.2, range=0..1))
multiplication_4 = Multiplication(A=Slider(1, range=0..1), B=division)
ln_7 = Line(StartPoint=pcen.CenterV, EndPoint=end_2.Start)
xy = XYPlane(Origin=pcen.CenterV)
ln_8 = Line(StartPoint=pcen.CenterV, EndPoint=eval_6.Point)

size_3 = Slider(5, range=1..10)
rectangle_3 = Rectangle(Plane=PlaneXY(0, 0, 0), XSize=size_3, YSize=size_3, Radius=0)  # -> Rectangle, Length
division_2 = Division(A=size_3, B="2")
t_5 = Slider(1, range=0..1)
edges_3 = BrepEdges(Brep=rectangle_3.Rectangle)  # -> Naked, Interior, NonManifold
pcen_2 = PolygonCenter(Polyline=rectangle_3.Rectangle)  # -> CenterV, CenterE, CenterA
end_3 = EndPoints(Curve=edges_3.Naked)  # -> Start, End
eval_7 = EvaluateCurve(Curve=reparameterize(edges_3.Naked), Parameter=t_5)  # -> Point, Tangent, Angle
multiplication_5 = Multiplication(A=division_2, B=Slider(1, range=0..1))
multiplication_6 = Multiplication(A=Slider(0.1, range=0..1), B=division_2)
ln_9 = Line(StartPoint=pcen_2.CenterV, EndPoint=end_3.Start)
xy_2 = XYPlane(Origin=pcen_2.CenterV)
ln_10 = Line(StartPoint=pcen_2.CenterV, EndPoint=eval_7.Point)

# ---- group: Motif Basis
maelstrom = Maelstrom(Geometry=[ln_7, ln_8], Plane=xy, First=multiplication_4, Second=multiplication_3, Angle=1.570796327, Rigid=False)

maelstrom_2 = Maelstrom(Geometry=[ln_9, ln_10], Plane=xy_2, First=multiplication_6, Second=multiplication_5, Angle=1.570796327, Rigid=False)

# ----
xz = XZPlane(Origin=Point(0, 0, 0))
# 2
# 2
mirror = Mirror(Geometry=maelstrom, Plane=xz)  # -> Geometry, Transform
Y = UnitY(Factor=size_2)
move_2 = Move(Geometry=mirror.Geometry, Motion=Y)  # -> Geometry, Transform

xz_2 = XZPlane(Origin=Point(0, 0, 0))
mirror_2 = Mirror(Geometry=maelstrom_2, Plane=xz_2)  # -> Geometry, Transform
Y_2 = UnitY(Factor=size_3)
move_3 = Move(Geometry=mirror_2.Geometry, Motion=Y_2)  # -> Geometry, Transform

# ---- group: Motif
join = JoinCurves(Curves=[move_2.Geometry, maelstrom], Preserve=False)

join_2 = JoinCurves(Curves=[move_3.Geometry, maelstrom_2], Preserve=False)

# ----
multiplication_7 = Multiplication(A="2", B=size)
mirror_3 = Mirror(Geometry=line, Plane=PlaneYZ(0, 0, 0))  # -> Geometry, Transform
xz_3 = XZPlane(Origin=Point(0, 0, 0))
rectangle_4 = Rectangle(Plane=PlaneXY(0, 0, 0), XSize=multiplication_7, YSize=multiplication_7, Radius=0)  # -> Rectangle, Length
tess_y = Slider(3, range=1..100)
tess_x = Slider(4, range=1..100)

# ---- group: Top Half
crv_2 = Curve([mirror_3.Geometry, line])

# ---- group: Bottom Half
mirror_4 = Mirror(Geometry=[mirror_3.Geometry, crv_2], Plane=xz_3)  # -> Geometry, Transform

# ---- group: Motif from 4 Mirrored Units
crv_3 = Curve([mirror_4.Geometry, crv_2])

# ----
arrrec_2 = RectangularArray(Geometry=crv_3, Cell=rectangle_4.Rectangle, XCount=tess_x, YCount=tess_y)  # -> Geometry, Transform

# ---- group: Final Output
# 3
mp_2 = MultiPipe(
    Curves=arrrec_2.Geometry,
    NodeSize=Slider(0.1, range=0..1),
    EndOffset=1,
    StrutSize=1,
    Segment=0,
    KinkAngle=0.6,
    CubeFit=0,
    Caps=0)

# ----
Y_3 = Slider(2, range=1..100)
X = Slider(2, range=1..100)

# ---- group: Tess Interior
arrrec_3 = RectangularArray(Geometry=join, Cell=rectangle_2.Rectangle, XCount=X, YCount=Y_3)  # -> Geometry, Transform

# ----
Y_4 = Slider(4, range=1..100)
X_2 = Slider(5, range=1..100)

# ---- group: Tess Interior
arrrec_4 = RectangularArray(Geometry=join_2, Cell=rectangle_3.Rectangle, XCount=X_2, YCount=Y_4)  # -> Geometry, Transform

# ----
# 3
# 3
bbox_2 = BoundingBox(Content=flatten(arrrec_3.Geometry), Plane=PlaneXY(0, 0, 0), UnionBox=True)  # -> Box, Box_2

# ---- group: Tess Border
edges_4 = BrepEdges(Brep=bbox_2.Box)  # -> Naked, Interior, NonManifold

# ----
final_output = Curve([edges_4.Naked, arrrec_3.Geometry])

bbox_3 = BoundingBox(Content=flatten(arrrec_4.Geometry), Plane=PlaneXY(0, 0, 0), UnionBox=True)  # -> Box, Box_2

# ---- group: Tess Border
edges_5 = BrepEdges(Brep=bbox_3.Box)  # -> Naked, Interior, NonManifold

# ----
final_output_2 = Curve([edges_5.Naked, arrrec_4.Geometry])
