# Grasshopper definition Figure4-21_sliding_pts_along_diags_var1to6.gh (Grasshopper 1.0.9)

size = Slider(5, range=1..10)
rectangle = Rectangle(Plane=PlaneXY(0, 0, 0), XSize=size, YSize=size, Radius=0)  # -> Rectangle, Length
# Motif from Connecting Sliding Points Along Diagonals - Variation #1
# 1
t = Slider(0.4, range=0..1)
edges = BrepEdges(Brep=rectangle.Rectangle)  # -> Naked, Interior, NonManifold
eval = EvaluateCurve(Curve=reparameterize(edges.Naked), Parameter=t)  # -> Point, Tangent, Angle
end = EndPoints(Curve=edges.Naked)  # -> Start, End

size_2 = Slider(5, range=1..10)
rectangle_2 = Rectangle(Plane=PlaneXY(0, 0, 0), XSize=size_2, YSize=size_2, Radius=0)  # -> Rectangle, Length
# Motif from Connecting Sliding Points Along Diagonals - Variation #5
# 1
t_2 = Slider(0.6, range=0..1)
edges_2 = BrepEdges(Brep=rectangle_2.Rectangle)  # -> Naked, Interior, NonManifold
eval_2 = EvaluateCurve(Curve=reparameterize(edges_2.Naked), Parameter=t_2)  # -> Point, Tangent, Angle
end_2 = EndPoints(Curve=edges_2.Naked)  # -> Start, End

size_3 = Slider(5, range=1..10)
rectangle_3 = Rectangle(Plane=PlaneXY(0, 0, 0), XSize=size_3, YSize=size_3, Radius=0)  # -> Rectangle, Length
# Motif from Connecting Sliding Points Along Diagonals - Variation #3
# 1
t_3 = Slider(0.5, range=0..1)
edges_3 = BrepEdges(Brep=rectangle_3.Rectangle)  # -> Naked, Interior, NonManifold
eval_3 = EvaluateCurve(Curve=reparameterize(edges_3.Naked), Parameter=t_3)  # -> Point, Tangent, Angle
end_3 = EndPoints(Curve=edges_3.Naked)  # -> Start, End

# ---- group: Cell Edge Sliding Points
item = ListItem(List=eval.Point, Index=0, Wrap=True)  # -> Item, Item1, Item2, Item3
p0 = Point(item.Item)
p1 = Point(item.Item1)
p2 = Point(item.Item2)
p3 = Point(item.Item3)

# ---- group: Cell Corners
item_2 = ListItem(List=end.Start, Index=0, Wrap=True)  # -> Item, Item1, Item2, Item3
p0_2 = Point(item_2.Item)
p1_2 = Point(item_2.Item1)
p2_2 = Point(item_2.Item2)
p3_2 = Point(item_2.Item3)

# ---- group: Cell Edge Sliding Points
item_3 = ListItem(List=eval_2.Point, Index=0, Wrap=True)  # -> Item, Item1, Item2, Item3
p0_3 = Point(item_3.Item)
p1_3 = Point(item_3.Item1)
p2_3 = Point(item_3.Item2)
p3_3 = Point(item_3.Item3)

# ---- group: Cell Corners
item_4 = ListItem(List=end_2.Start, Index=0, Wrap=True)  # -> Item, Item1, Item2, Item3
p0_4 = Point(item_4.Item)
p1_4 = Point(item_4.Item1)
p2_4 = Point(item_4.Item2)
p3_4 = Point(item_4.Item3)

# ---- group: Cell Edge Sliding Points
item_5 = ListItem(List=eval_3.Point, Index=0, Wrap=True)  # -> Item, Item1, Item2, Item3
p0_5 = Point(item_5.Item)
p1_5 = Point(item_5.Item1)
p2_5 = Point(item_5.Item2)
p3_5 = Point(item_5.Item3)

# ---- group: Cell Corners
item_6 = ListItem(List=end_3.Start, Index=0, Wrap=True)  # -> Item, Item1, Item2, Item3
p0_6 = Point(item_6.Item)
p1_6 = Point(item_6.Item1)
p2_6 = Point(item_6.Item2)
p3_6 = Point(item_6.Item3)

# ---- group: R Diagonal
ln = Line(StartPoint=p0_2, EndPoint=p2_2)

# ---- group: L Diagonal
ln_2 = Line(StartPoint=p1_2, EndPoint=p3_2)

# ---- group: R Diagonal
ln_3 = Line(StartPoint=p0_4, EndPoint=p2_4)

# ---- group: L Diagonal
ln_4 = Line(StartPoint=p1_4, EndPoint=p3_4)

# ---- group: R Diagonal
ln_5 = Line(StartPoint=p0_6, EndPoint=p2_6)

# ---- group: L Diagonal
ln_6 = Line(StartPoint=p1_6, EndPoint=p3_6)

# ----
t_4 = Slider(1, range=0..1)
t_5 = Slider(0.2, range=0..1)
eval_4 = EvaluateCurve(Curve=reparameterize(ln_2), Parameter=t_5)  # -> Point, Tangent, Angle
eval_5 = EvaluateCurve(Curve=reparameterize(ln), Parameter=t_4)  # -> Point, Tangent, Angle
subtraction = Subtraction(A="1.0", B=t_4)
subtraction_2 = Subtraction(A="1.0", B=t_5)
# 2
eval_6 = EvaluateCurve(Curve=reparameterize(ln), Parameter=subtraction)  # -> Point, Tangent, Angle
eval_7 = EvaluateCurve(Curve=reparameterize(ln_2), Parameter=subtraction_2)  # -> Point, Tangent, Angle

t_6 = Slider(1, range=0..1)
t_7 = Slider(0.4, range=0..1)
eval_8 = EvaluateCurve(Curve=reparameterize(ln_4), Parameter=t_7)  # -> Point, Tangent, Angle
eval_9 = EvaluateCurve(Curve=reparameterize(ln_3), Parameter=t_6)  # -> Point, Tangent, Angle
subtraction_3 = Subtraction(A="1.0", B=t_6)
subtraction_4 = Subtraction(A="1.0", B=t_7)
# 2
eval_10 = EvaluateCurve(Curve=reparameterize(ln_3), Parameter=subtraction_3)  # -> Point, Tangent, Angle
eval_11 = EvaluateCurve(Curve=reparameterize(ln_4), Parameter=subtraction_4)  # -> Point, Tangent, Angle

t_8 = Slider(0.9, range=0..1)
t_9 = Slider(0.5, range=0..1)
eval_12 = EvaluateCurve(Curve=reparameterize(ln_6), Parameter=t_9)  # -> Point, Tangent, Angle
eval_13 = EvaluateCurve(Curve=reparameterize(ln_5), Parameter=t_8)  # -> Point, Tangent, Angle
subtraction_5 = Subtraction(A="1.0", B=t_8)
subtraction_6 = Subtraction(A="1.0", B=t_9)
# 2
eval_14 = EvaluateCurve(Curve=reparameterize(ln_5), Parameter=subtraction_5)  # -> Point, Tangent, Angle
eval_15 = EvaluateCurve(Curve=reparameterize(ln_6), Parameter=subtraction_6)  # -> Point, Tangent, Angle

# ---- group: Star Right Corner
ln_7 = Line(StartPoint=p1, EndPoint=[eval_5.Point, eval_7.Point])

# ---- group: Star Top Corner
ln_8 = Line(StartPoint=p2, EndPoint=[eval_5.Point, eval_4.Point])

# ---- group: Star Left Corner
ln_9 = Line(StartPoint=p3, EndPoint=[eval_6.Point, eval_4.Point])

# ---- group: Star Bottom Corner
ln_10 = Line(StartPoint=p0, EndPoint=[eval_6.Point, eval_7.Point])

# ---- group: Star Right Corner
ln_11 = Line(StartPoint=p1_3, EndPoint=[eval_9.Point, eval_11.Point])

# ---- group: Star Top Corner
ln_12 = Line(StartPoint=p2_3, EndPoint=[eval_9.Point, eval_8.Point])

# ---- group: Star Left Corner
ln_13 = Line(StartPoint=p3_3, EndPoint=[eval_10.Point, eval_8.Point])

# ---- group: Star Bottom Corner
ln_14 = Line(StartPoint=p0_3, EndPoint=[eval_10.Point, eval_11.Point])

# ---- group: Star Right Corner
ln_15 = Line(StartPoint=p1_5, EndPoint=[eval_13.Point, eval_15.Point])

# ---- group: Star Top Corner
ln_16 = Line(StartPoint=p2_5, EndPoint=[eval_13.Point, eval_12.Point])

# ---- group: Star Left Corner
ln_17 = Line(StartPoint=p3_5, EndPoint=[eval_14.Point, eval_12.Point])

# ---- group: Star Bottom Corner
ln_18 = Line(StartPoint=p0_5, EndPoint=[eval_14.Point, eval_15.Point])

# ---- group: Inner Motif
line = Line([ln_10, ln_7, ln_8, ln_9])

line_2 = Line([ln_14, ln_11, ln_12, ln_13])

line_3 = Line([ln_18, ln_15, ln_16, ln_17])

# ----
size_4 = Slider(5, range=1..10)
rectangle_4 = Rectangle(Plane=PlaneXY(0, 0, 0), XSize=size_4, YSize=size_4, Radius=0)  # -> Rectangle, Length
# Motif from Connecting Sliding Points Along Diagonals - Variation #4
# 1
t_10 = Slider(0, range=0..1)
edges_4 = BrepEdges(Brep=rectangle_4.Rectangle)  # -> Naked, Interior, NonManifold
eval_16 = EvaluateCurve(Curve=reparameterize(edges_4.Naked), Parameter=t_10)  # -> Point, Tangent, Angle
end_4 = EndPoints(Curve=edges_4.Naked)  # -> Start, End

size_5 = Slider(5, range=1..10)
rectangle_5 = Rectangle(Plane=PlaneXY(0, 0, 0), XSize=size_5, YSize=size_5, Radius=0)  # -> Rectangle, Length
# Motif from Connecting Sliding Points Along Diagonals - Variation #6
# 1
t_11 = Slider(0.6, range=0..1)
edges_5 = BrepEdges(Brep=rectangle_5.Rectangle)  # -> Naked, Interior, NonManifold
eval_17 = EvaluateCurve(Curve=reparameterize(edges_5.Naked), Parameter=t_11)  # -> Point, Tangent, Angle
end_5 = EndPoints(Curve=edges_5.Naked)  # -> Start, End

size_6 = Slider(5, range=1..10)
rectangle_6 = Rectangle(Plane=PlaneXY(0, 0, 0), XSize=size_6, YSize=size_6, Radius=0)  # -> Rectangle, Length
# Motif from Connecting Sliding Points Along Diagonals - Variation #2
# 1
t_12 = Slider(1, range=0..1)
edges_6 = BrepEdges(Brep=rectangle_6.Rectangle)  # -> Naked, Interior, NonManifold
eval_18 = EvaluateCurve(Curve=reparameterize(edges_6.Naked), Parameter=t_12)  # -> Point, Tangent, Angle
end_6 = EndPoints(Curve=edges_6.Naked)  # -> Start, End

# ---- group: Cell Edge Sliding Points
item_7 = ListItem(List=eval_16.Point, Index=0, Wrap=True)  # -> Item, Item1, Item2, Item3
p0_7 = Point(item_7.Item)
p1_7 = Point(item_7.Item1)
p2_7 = Point(item_7.Item2)
p3_7 = Point(item_7.Item3)

# ---- group: Cell Corners
item_8 = ListItem(List=end_4.Start, Index=0, Wrap=True)  # -> Item, Item1, Item2, Item3
p0_8 = Point(item_8.Item)
p1_8 = Point(item_8.Item1)
p2_8 = Point(item_8.Item2)
p3_8 = Point(item_8.Item3)

# ---- group: Cell Edge Sliding Points
item_9 = ListItem(List=eval_17.Point, Index=0, Wrap=True)  # -> Item, Item1, Item2, Item3
p0_9 = Point(item_9.Item)
p1_9 = Point(item_9.Item1)
p2_9 = Point(item_9.Item2)
p3_9 = Point(item_9.Item3)

# ---- group: Cell Corners
item_10 = ListItem(List=end_5.Start, Index=0, Wrap=True)  # -> Item, Item1, Item2, Item3
p0_10 = Point(item_10.Item)
p1_10 = Point(item_10.Item1)
p2_10 = Point(item_10.Item2)
p3_10 = Point(item_10.Item3)

# ---- group: Cell Edge Sliding Points
item_11 = ListItem(List=eval_18.Point, Index=0, Wrap=True)  # -> Item, Item1, Item2, Item3
p0_11 = Point(item_11.Item)
p1_11 = Point(item_11.Item1)
p2_11 = Point(item_11.Item2)
p3_11 = Point(item_11.Item3)

# ---- group: Cell Corners
item_12 = ListItem(List=end_6.Start, Index=0, Wrap=True)  # -> Item, Item1, Item2, Item3
p0_12 = Point(item_12.Item)
p1_12 = Point(item_12.Item1)
p2_12 = Point(item_12.Item2)
p3_12 = Point(item_12.Item3)

# ---- group: R Diagonal
ln_19 = Line(StartPoint=p0_8, EndPoint=p2_8)

# ---- group: L Diagonal
ln_20 = Line(StartPoint=p1_8, EndPoint=p3_8)

# ---- group: R Diagonal
ln_21 = Line(StartPoint=p0_10, EndPoint=p2_10)

# ---- group: L Diagonal
ln_22 = Line(StartPoint=p1_10, EndPoint=p3_10)

# ---- group: R Diagonal
ln_23 = Line(StartPoint=p0_12, EndPoint=p2_12)

# ---- group: L Diagonal
ln_24 = Line(StartPoint=p1_12, EndPoint=p3_12)

# ----
t_13 = Slider(0.6, range=0..1)
t_14 = Slider(0.2, range=0..1)
eval_19 = EvaluateCurve(Curve=reparameterize(ln_20), Parameter=t_14)  # -> Point, Tangent, Angle
eval_20 = EvaluateCurve(Curve=reparameterize(ln_19), Parameter=t_13)  # -> Point, Tangent, Angle
subtraction_7 = Subtraction(A="1.0", B=t_13)
subtraction_8 = Subtraction(A="1.0", B=t_14)
# 2
eval_21 = EvaluateCurve(Curve=reparameterize(ln_19), Parameter=subtraction_7)  # -> Point, Tangent, Angle
eval_22 = EvaluateCurve(Curve=reparameterize(ln_20), Parameter=subtraction_8)  # -> Point, Tangent, Angle

t_15 = Slider(0, range=0..1)
t_16 = Slider(0.4, range=0..1)
eval_23 = EvaluateCurve(Curve=reparameterize(ln_22), Parameter=t_16)  # -> Point, Tangent, Angle
eval_24 = EvaluateCurve(Curve=reparameterize(ln_21), Parameter=t_15)  # -> Point, Tangent, Angle
subtraction_9 = Subtraction(A="1.0", B=t_15)
subtraction_10 = Subtraction(A="1.0", B=t_16)
# 2
eval_25 = EvaluateCurve(Curve=reparameterize(ln_21), Parameter=subtraction_9)  # -> Point, Tangent, Angle
eval_26 = EvaluateCurve(Curve=reparameterize(ln_22), Parameter=subtraction_10)  # -> Point, Tangent, Angle

t_17 = Slider(0.9, range=0..1)
t_18 = Slider(0.5, range=0..1)
eval_27 = EvaluateCurve(Curve=reparameterize(ln_24), Parameter=t_18)  # -> Point, Tangent, Angle
eval_28 = EvaluateCurve(Curve=reparameterize(ln_23), Parameter=t_17)  # -> Point, Tangent, Angle
subtraction_11 = Subtraction(A="1.0", B=t_17)
subtraction_12 = Subtraction(A="1.0", B=t_18)
# 2
eval_29 = EvaluateCurve(Curve=reparameterize(ln_23), Parameter=subtraction_11)  # -> Point, Tangent, Angle
eval_30 = EvaluateCurve(Curve=reparameterize(ln_24), Parameter=subtraction_12)  # -> Point, Tangent, Angle

# ---- group: Star Right Corner
ln_25 = Line(StartPoint=p1_7, EndPoint=[eval_20.Point, eval_22.Point])

# ---- group: Star Top Corner
ln_26 = Line(StartPoint=p2_7, EndPoint=[eval_20.Point, eval_19.Point])

# ---- group: Star Left Corner
ln_27 = Line(StartPoint=p3_7, EndPoint=[eval_21.Point, eval_19.Point])

# ---- group: Star Bottom Corner
ln_28 = Line(StartPoint=p0_7, EndPoint=[eval_21.Point, eval_22.Point])

# ---- group: Star Right Corner
ln_29 = Line(StartPoint=p1_9, EndPoint=[eval_24.Point, eval_26.Point])

# ---- group: Star Top Corner
ln_30 = Line(StartPoint=p2_9, EndPoint=[eval_24.Point, eval_23.Point])

# ---- group: Star Left Corner
ln_31 = Line(StartPoint=p3_9, EndPoint=[eval_25.Point, eval_23.Point])

# ---- group: Star Bottom Corner
ln_32 = Line(StartPoint=p0_9, EndPoint=[eval_25.Point, eval_26.Point])

# ---- group: Star Right Corner
ln_33 = Line(StartPoint=p1_11, EndPoint=[eval_28.Point, eval_30.Point])

# ---- group: Star Top Corner
ln_34 = Line(StartPoint=p2_11, EndPoint=[eval_28.Point, eval_27.Point])

# ---- group: Star Left Corner
ln_35 = Line(StartPoint=p3_11, EndPoint=[eval_29.Point, eval_27.Point])

# ---- group: Star Bottom Corner
ln_36 = Line(StartPoint=p0_11, EndPoint=[eval_29.Point, eval_30.Point])

# ---- group: Inner Motif
line_4 = Line([ln_28, ln_25, ln_26, ln_27])

line_5 = Line([ln_32, ln_29, ln_30, ln_31])

line_6 = Line([ln_36, ln_33, ln_34, ln_35])

# ----
multiplication = Multiplication(A="2", B=size)
mirror = Mirror(Geometry=line, Plane=PlaneYZ(0, 0, 0))  # -> Geometry, Transform
xz = XZPlane(Origin=Point(0, 0, 0))
rectangle_7 = Rectangle(Plane=PlaneXY(0, 0, 0), XSize=multiplication, YSize=multiplication, Radius=0)  # -> Rectangle, Length
tess_y = Slider(3, range=1..100)
tess_x = Slider(3, range=1..100)

# ---- group: Top Half
crv = Curve([mirror.Geometry, line])

# ---- group: Bottom Half
mirror_2 = Mirror(Geometry=[mirror.Geometry, crv], Plane=xz)  # -> Geometry, Transform

# ---- group: Motif from 4 Mirrored Units
crv_2 = Curve([mirror_2.Geometry, crv])

# ----
arrrec = RectangularArray(Geometry=crv_2, Cell=rectangle_7.Rectangle, XCount=tess_x, YCount=tess_y)  # -> Geometry, Transform

# ---- group: Final Output
# 3
mp = MultiPipe(
    Curves=arrrec.Geometry,
    NodeSize=Slider(0.1, range=0..1),
    EndOffset=1,
    StrutSize=1,
    Segment=0,
    KinkAngle=0.6,
    CubeFit=0,
    Caps=0)

# ----
multiplication_2 = Multiplication(A="2", B=size_2)
mirror_3 = Mirror(Geometry=line_2, Plane=PlaneYZ(0, 0, 0))  # -> Geometry, Transform
xz_2 = XZPlane(Origin=Point(0, 0, 0))
rectangle_8 = Rectangle(Plane=PlaneXY(0, 0, 0), XSize=multiplication_2, YSize=multiplication_2, Radius=0)  # -> Rectangle, Length
tess_y_2 = Slider(3, range=1..100)
tess_x_2 = Slider(3, range=1..100)

# ---- group: Top Half
crv_3 = Curve([mirror_3.Geometry, line_2])

# ---- group: Bottom Half
mirror_4 = Mirror(Geometry=[mirror_3.Geometry, crv_3], Plane=xz_2)  # -> Geometry, Transform

# ---- group: Motif from 4 Mirrored Units
crv_4 = Curve([mirror_4.Geometry, crv_3])

# ----
arrrec_2 = RectangularArray(Geometry=crv_4, Cell=rectangle_8.Rectangle, XCount=tess_x_2, YCount=tess_y_2)  # -> Geometry, Transform
# 3
mp_2 = MultiPipe(
    Curves=arrrec_2.Geometry,
    NodeSize=Slider(0.1, range=0..1),
    EndOffset=1,
    StrutSize=1,
    Segment=0,
    KinkAngle=0.6,
    CubeFit=0,
    Caps=0)

bbox = BoundingBox(Content=flatten(arrrec_2.Geometry), Plane=PlaneXY(0, 0, 0), UnionBox=True)  # -> Box, Box_2
dim = Dimensions(Surface=bbox.Box)  # -> UDimension, VDimension
addition = Addition(A=dim.VDimension, B="3")
subtraction_13 = Subtraction(A="0", B=addition)
multiplication_3 = Multiplication(A="2", B=subtraction_13)
vec = VectorXYZ(XComponent=0, YComponent=multiplication_3, ZComponent=0)  # -> Vector, Length

# ---- group: Final Output
move = Move(Geometry=mp_2, Motion=vec.Vector)  # -> Geometry, Transform

# ----
multiplication_4 = Multiplication(A="2", B=size_3)
mirror_5 = Mirror(Geometry=line_3, Plane=PlaneYZ(0, 0, 0))  # -> Geometry, Transform
xz_3 = XZPlane(Origin=Point(0, 0, 0))
rectangle_9 = Rectangle(Plane=PlaneXY(0, 0, 0), XSize=multiplication_4, YSize=multiplication_4, Radius=0)  # -> Rectangle, Length
tess_y_3 = Slider(3, range=1..100)
tess_x_3 = Slider(3, range=1..100)

# ---- group: Top Half
crv_5 = Curve([mirror_5.Geometry, line_3])

# ---- group: Bottom Half
mirror_6 = Mirror(Geometry=[mirror_5.Geometry, crv_5], Plane=xz_3)  # -> Geometry, Transform

# ---- group: Motif from 4 Mirrored Units
crv_6 = Curve([mirror_6.Geometry, crv_5])

# ----
arrrec_3 = RectangularArray(Geometry=crv_6, Cell=rectangle_9.Rectangle, XCount=tess_x_3, YCount=tess_y_3)  # -> Geometry, Transform
# 3
mp_3 = MultiPipe(
    Curves=arrrec_3.Geometry,
    NodeSize=Slider(0.1, range=0..1),
    EndOffset=1,
    StrutSize=1,
    Segment=0,
    KinkAngle=0.6,
    CubeFit=0,
    Caps=0)

bbox_2 = BoundingBox(Content=flatten(arrrec_3.Geometry), Plane=PlaneXY(0, 0, 0), UnionBox=True)  # -> Box, Box_2
dim_2 = Dimensions(Surface=bbox_2.Box)  # -> UDimension, VDimension
addition_2 = Addition(A=dim_2.VDimension, B="3")
subtraction_14 = Subtraction(A="0", B=addition_2)
Y = UnitY(Factor=subtraction_14)

# ---- group: Final Output
move_2 = Move(Geometry=mp_3, Motion=Y)  # -> Geometry, Transform

# ----
multiplication_5 = Multiplication(A="2", B=size_4)
mirror_7 = Mirror(Geometry=line_4, Plane=PlaneYZ(0, 0, 0))  # -> Geometry, Transform
xz_4 = XZPlane(Origin=Point(0, 0, 0))
rectangle_10 = Rectangle(Plane=PlaneXY(0, 0, 0), XSize=multiplication_5, YSize=multiplication_5, Radius=0)  # -> Rectangle, Length
tess_y_4 = Slider(3, range=1..100)
tess_x_4 = Slider(3, range=1..100)

# ---- group: Top Half
crv_7 = Curve([mirror_7.Geometry, line_4])

# ---- group: Bottom Half
mirror_8 = Mirror(Geometry=[mirror_7.Geometry, crv_7], Plane=xz_4)  # -> Geometry, Transform

# ---- group: Motif from 4 Mirrored Units
crv_8 = Curve([mirror_8.Geometry, crv_7])

# ----
arrrec_4 = RectangularArray(Geometry=crv_8, Cell=rectangle_10.Rectangle, XCount=tess_x_4, YCount=tess_y_4)  # -> Geometry, Transform
# 3
mp_4 = MultiPipe(
    Curves=arrrec_4.Geometry,
    NodeSize=Slider(0.1, range=0..1),
    EndOffset=1,
    StrutSize=1,
    Segment=0,
    KinkAngle=0.6,
    CubeFit=0,
    Caps=0)

bbox_3 = BoundingBox(Content=flatten(arrrec_4.Geometry), Plane=PlaneXY(0, 0, 0), UnionBox=True)  # -> Box, Box_2
dim_3 = Dimensions(Surface=bbox_3.Box)  # -> UDimension, VDimension
addition_3 = Addition(A=dim_3.VDimension, B="3")
addition_4 = Addition(A=dim_3.UDimension, B="3")
subtraction_15 = Subtraction(A="0", B=addition_3)
vec_2 = VectorXYZ(XComponent=addition_4, YComponent=subtraction_15, ZComponent=0)  # -> Vector, Length

# ---- group: Final Output
move_3 = Move(Geometry=mp_4, Motion=vec_2.Vector)  # -> Geometry, Transform

# ----
multiplication_6 = Multiplication(A="2", B=size_5)
mirror_9 = Mirror(Geometry=line_5, Plane=PlaneYZ(0, 0, 0))  # -> Geometry, Transform
xz_5 = XZPlane(Origin=Point(0, 0, 0))
rectangle_11 = Rectangle(Plane=PlaneXY(0, 0, 0), XSize=multiplication_6, YSize=multiplication_6, Radius=0)  # -> Rectangle, Length
tess_y_5 = Slider(3, range=1..100)
tess_x_5 = Slider(3, range=1..100)

# ---- group: Top Half
crv_9 = Curve([mirror_9.Geometry, line_5])

# ---- group: Bottom Half
mirror_10 = Mirror(Geometry=[mirror_9.Geometry, crv_9], Plane=xz_5)  # -> Geometry, Transform

# ---- group: Motif from 4 Mirrored Units
crv_10 = Curve([mirror_10.Geometry, crv_9])

# ----
arrrec_5 = RectangularArray(Geometry=crv_10, Cell=rectangle_11.Rectangle, XCount=tess_x_5, YCount=tess_y_5)  # -> Geometry, Transform
# 3
mp_5 = MultiPipe(
    Curves=arrrec_5.Geometry,
    NodeSize=Slider(0.1, range=0..1),
    EndOffset=1,
    StrutSize=1,
    Segment=0,
    KinkAngle=0.6,
    CubeFit=0,
    Caps=0)

bbox_4 = BoundingBox(Content=flatten(arrrec_5.Geometry), Plane=PlaneXY(0, 0, 0), UnionBox=True)  # -> Box, Box_2
dim_4 = Dimensions(Surface=bbox_4.Box)  # -> UDimension, VDimension
addition_5 = Addition(A=dim_4.VDimension, B="3")
addition_6 = Addition(A=dim_4.UDimension, B="3")
subtraction_16 = Subtraction(A="0", B=addition_5)
multiplication_7 = Multiplication(A="2", B=subtraction_16)
vec_3 = VectorXYZ(XComponent=addition_6, YComponent=multiplication_7, ZComponent=0)  # -> Vector, Length

# ---- group: Final Output
move_4 = Move(Geometry=mp_5, Motion=vec_3.Vector)  # -> Geometry, Transform

# ----
multiplication_8 = Multiplication(A="2", B=size_6)
mirror_11 = Mirror(Geometry=line_6, Plane=PlaneYZ(0, 0, 0))  # -> Geometry, Transform
xz_6 = XZPlane(Origin=Point(0, 0, 0))
rectangle_12 = Rectangle(Plane=PlaneXY(0, 0, 0), XSize=multiplication_8, YSize=multiplication_8, Radius=0)  # -> Rectangle, Length
tess_y_6 = Slider(3, range=1..100)
tess_x_6 = Slider(3, range=1..100)

# ---- group: Top Half
crv_11 = Curve([mirror_11.Geometry, line_6])

# ---- group: Bottom Half
mirror_12 = Mirror(Geometry=[mirror_11.Geometry, crv_11], Plane=xz_6)  # -> Geometry, Transform

# ---- group: Motif from 4 Mirrored Units
crv_12 = Curve([mirror_12.Geometry, crv_11])

# ----
arrrec_6 = RectangularArray(Geometry=crv_12, Cell=rectangle_12.Rectangle, XCount=tess_x_6, YCount=tess_y_6)  # -> Geometry, Transform
# 3
mp_6 = MultiPipe(
    Curves=arrrec_6.Geometry,
    NodeSize=Slider(0.1, range=0..1),
    EndOffset=1,
    StrutSize=1,
    Segment=0,
    KinkAngle=0.6,
    CubeFit=0,
    Caps=0)

bbox_5 = BoundingBox(Content=flatten(arrrec_6.Geometry), Plane=PlaneXY(0, 0, 0), UnionBox=True)  # -> Box, Box_2
dim_5 = Dimensions(Surface=bbox_5.Box)  # -> UDimension, VDimension
addition_7 = Addition(A=dim_5.UDimension, B="3")
X = UnitX(Factor=addition_7)

# ---- group: Final Output
move_5 = Move(Geometry=mp_6, Motion=X)  # -> Geometry, Transform
