# Grasshopper definition Figure4-22_to_4-25_maelstrom.gh (Grasshopper 1.0.9)

# ----
# Maelstrom - Variation #1
size = Slider(5, range=1..10)
rectangle = Rectangle(Plane=PlaneXY(0, 0, 0), XSize=size, YSize=size, Radius=0)  # -> Rectangle, Length
division = Division(A=size, B="2")
t = Slider(0.6, range=0..1)
edges = BrepEdges(Brep=rectangle.Rectangle)  # -> Naked, Interior, NonManifold
pcen = PolygonCenter(Polyline=rectangle.Rectangle)  # -> CenterV, CenterE, CenterA
# 1
end = EndPoints(Curve=edges.Naked)  # -> Start, End
eval = EvaluateCurve(Curve=reparameterize(edges.Naked), Parameter=t)  # -> Point, Tangent, Angle
multiplication = Multiplication(A=division, B=Slider(0.9, range=0..1))
multiplication_2 = Multiplication(A=Slider(0.2, range=0..1), B=division)
ln = Line(StartPoint=pcen.CenterV, EndPoint=end.Start)
xy = XYPlane(Origin=pcen.CenterV)
ln_2 = Line(StartPoint=pcen.CenterV, EndPoint=eval.Point)

# ---- group: Motif Basis
maelstrom = Maelstrom(Geometry=[ln, ln_2], Plane=xy, First=multiplication_2, Second=multiplication, Angle=1.570796327, Rigid=False)

# ----
xz = XZPlane(Origin=Point(0, 0, 0))
# 2
mirror = Mirror(Geometry=maelstrom, Plane=xz)  # -> Geometry, Transform
Y = UnitY(Factor=size)
move = Move(Geometry=mirror.Geometry, Motion=Y)  # -> Geometry, Transform

# ---- group: Motif
join = JoinCurves(Curves=[move.Geometry, maelstrom], Preserve=False)

# ----
X = Slider(4, range=1..100)
Y_2 = Slider(3, range=1..100)

# ---- group: Tess Interior
arrrec = RectangularArray(Geometry=join, Cell=rectangle.Rectangle, XCount=X, YCount=Y_2)  # -> Geometry, Transform

# ----
# 3
bbox = BoundingBox(Content=flatten(arrrec.Geometry), Plane=PlaneXY(0, 0, 0), UnionBox=True)  # -> Box, Box_2

# ---- group: Tess Border
edges_2 = BrepEdges(Brep=bbox.Box)  # -> Naked, Interior, NonManifold

# ---- group: Final Output
crv = Curve([edges_2.Naked, arrrec.Geometry])
