# Grasshopper definition Figure4-26_maelstrom_var1to6.gh (Grasshopper 1.0.9)

# ----
# Maelstrom - Variation #3
size = Slider(5, range=1..10)
rectangle = Rectangle(Plane=PlaneXY(0, 0, 0), XSize=size, YSize=size, Radius=0)  # -> Rectangle, Length
division = Division(A=size, B="2")
t = Slider(0.4, range=0..1)
edges = BrepEdges(Brep=rectangle.Rectangle)  # -> Naked, Interior, NonManifold
pcen = PolygonCenter(Polyline=rectangle.Rectangle)  # -> CenterV, CenterE, CenterA
# 1
end = EndPoints(Curve=edges.Naked)  # -> Start, End
eval = EvaluateCurve(Curve=reparameterize(edges.Naked), Parameter=t)  # -> Point, Tangent, Angle
multiplication = Multiplication(A=division, B=Slider(0.9, range=0..1))
multiplication_2 = Multiplication(A=Slider(0.9, range=0..1), B=division)
ln = Line(StartPoint=pcen.CenterV, EndPoint=end.Start)
xy = XYPlane(Origin=pcen.CenterV)
ln_2 = Line(StartPoint=pcen.CenterV, EndPoint=eval.Point)

# ----
# Maelstrom - Variation #1
size_2 = Slider(5, range=1..10)
rectangle_2 = Rectangle(Plane=PlaneXY(0, 0, 0), XSize=size_2, YSize=size_2, Radius=0)  # -> Rectangle, Length
division_2 = Division(A=size_2, B="2")
t_2 = Slider(0.5, range=0..1)
edges_2 = BrepEdges(Brep=rectangle_2.Rectangle)  # -> Naked, Interior, NonManifold
pcen_2 = PolygonCenter(Polyline=rectangle_2.Rectangle)  # -> CenterV, CenterE, CenterA
# 1
end_2 = EndPoints(Curve=edges_2.Naked)  # -> Start, End
eval_2 = EvaluateCurve(Curve=reparameterize(edges_2.Naked), Parameter=t_2)  # -> Point, Tangent, Angle
multiplication_3 = Multiplication(A=division_2, B=Slider(0.9, range=0..1))
multiplication_4 = Multiplication(A=Slider(0.6, range=0..1), B=division_2)
ln_3 = Line(StartPoint=pcen_2.CenterV, EndPoint=end_2.Start)
xy_2 = XYPlane(Origin=pcen_2.CenterV)
ln_4 = Line(StartPoint=pcen_2.CenterV, EndPoint=eval_2.Point)

# ----
# Maelstrom - Variation #5
size_3 = Slider(5, range=1..10)
rectangle_3 = Rectangle(Plane=PlaneXY(0, 0, 0), XSize=size_3, YSize=size_3, Radius=0)  # -> Rectangle, Length
division_3 = Division(A=size_3, B="2")
t_3 = Slider(0.7, range=0..1)
edges_3 = BrepEdges(Brep=rectangle_3.Rectangle)  # -> Naked, Interior, NonManifold
pcen_3 = PolygonCenter(Polyline=rectangle_3.Rectangle)  # -> CenterV, CenterE, CenterA
# 1
end_3 = EndPoints(Curve=edges_3.Naked)  # -> Start, End
eval_3 = EvaluateCurve(Curve=reparameterize(edges_3.Naked), Parameter=t_3)  # -> Point, Tangent, Angle
multiplication_5 = Multiplication(A=division_3, B=Slider(0.5, range=0..1))
multiplication_6 = Multiplication(A=Slider(0.9, range=0..1), B=division_3)
ln_5 = Line(StartPoint=pcen_3.CenterV, EndPoint=end_3.Start)
xy_3 = XYPlane(Origin=pcen_3.CenterV)
ln_6 = Line(StartPoint=pcen_3.CenterV, EndPoint=eval_3.Point)

# ---- group: Motif Basis
maelstrom = Maelstrom(Geometry=[ln, ln_2], Plane=xy, First=multiplication_2, Second=multiplication, Angle=1.570796327, Rigid=False)

maelstrom_2 = Maelstrom(Geometry=[ln_3, ln_4], Plane=xy_2, First=multiplication_4, Second=multiplication_3, Angle=1.570796327, Rigid=False)

maelstrom_3 = Maelstrom(Geometry=[ln_5, ln_6], Plane=xy_3, First=multiplication_6, Second=multiplication_5, Angle=1.570796327, Rigid=False)

# ----
xz = XZPlane(Origin=Point(0, 0, 0))
# 2
mirror = Mirror(Geometry=maelstrom, Plane=xz)  # -> Geometry, Transform
Y = UnitY(Factor=size)
move = Move(Geometry=mirror.Geometry, Motion=Y)  # -> Geometry, Transform

xz_2 = XZPlane(Origin=Point(0, 0, 0))
# 2
mirror_2 = Mirror(Geometry=maelstrom_2, Plane=xz_2)  # -> Geometry, Transform
Y_2 = UnitY(Factor=size_2)
move_2 = Move(Geometry=mirror_2.Geometry, Motion=Y_2)  # -> Geometry, Transform

xz_3 = XZPlane(Origin=Point(0, 0, 0))
# 2
mirror_3 = Mirror(Geometry=maelstrom_3, Plane=xz_3)  # -> Geometry, Transform
Y_3 = UnitY(Factor=size_3)
move_3 = Move(Geometry=mirror_3.Geometry, Motion=Y_3)  # -> Geometry, Transform

# ---- group: Motif
join = JoinCurves(Curves=[move.Geometry, maelstrom], Preserve=False)

join_2 = JoinCurves(Curves=[move_2.Geometry, maelstrom_2], Preserve=False)

join_3 = JoinCurves(Curves=[move_3.Geometry, maelstrom_3], Preserve=False)

# ----
# Maelstrom - Variation #6
size_4 = Slider(5, range=1..10)
rectangle_4 = Rectangle(Plane=PlaneXY(0, 0, 0), XSize=size_4, YSize=size_4, Radius=0)  # -> Rectangle, Length
division_4 = Division(A=size_4, B="2")
t_4 = Slider(0.8, range=0..1)
edges_4 = BrepEdges(Brep=rectangle_4.Rectangle)  # -> Naked, Interior, NonManifold
pcen_4 = PolygonCenter(Polyline=rectangle_4.Rectangle)  # -> CenterV, CenterE, CenterA
# 1
end_4 = EndPoints(Curve=edges_4.Naked)  # -> Start, End
eval_4 = EvaluateCurve(Curve=reparameterize(edges_4.Naked), Parameter=t_4)  # -> Point, Tangent, Angle
multiplication_7 = Multiplication(A=division_4, B=Slider(0.2, range=0..1))
multiplication_8 = Multiplication(A=Slider(1, range=0..1), B=division_4)
ln_7 = Line(StartPoint=pcen_4.CenterV, EndPoint=end_4.Start)
xy_4 = XYPlane(Origin=pcen_4.CenterV)
ln_8 = Line(StartPoint=pcen_4.CenterV, EndPoint=eval_4.Point)

# ----
# Maelstrom - Variation #4
size_5 = Slider(5, range=1..10)
rectangle_5 = Rectangle(Plane=PlaneXY(0, 0, 0), XSize=size_5, YSize=size_5, Radius=0)  # -> Rectangle, Length
division_5 = Division(A=size_5, B="2")
t_5 = Slider(0.4, range=0..1)
edges_5 = BrepEdges(Brep=rectangle_5.Rectangle)  # -> Naked, Interior, NonManifold
pcen_5 = PolygonCenter(Polyline=rectangle_5.Rectangle)  # -> CenterV, CenterE, CenterA
# 1
end_5 = EndPoints(Curve=edges_5.Naked)  # -> Start, End
eval_5 = EvaluateCurve(Curve=reparameterize(edges_5.Naked), Parameter=t_5)  # -> Point, Tangent, Angle
multiplication_9 = Multiplication(A=division_5, B=Slider(0.6, range=0..1))
multiplication_10 = Multiplication(A=Slider(0.9, range=0..1), B=division_5)
ln_9 = Line(StartPoint=pcen_5.CenterV, EndPoint=end_5.Start)
xy_5 = XYPlane(Origin=pcen_5.CenterV)
ln_10 = Line(StartPoint=pcen_5.CenterV, EndPoint=eval_5.Point)

# ----
# Maelstrom - Variation #2
size_6 = Slider(5, range=1..10)
rectangle_6 = Rectangle(Plane=PlaneXY(0, 0, 0), XSize=size_6, YSize=size_6, Radius=0)  # -> Rectangle, Length
division_6 = Division(A=size_6, B="2")
t_6 = Slider(0.5, range=0..1)
edges_6 = BrepEdges(Brep=rectangle_6.Rectangle)  # -> Naked, Interior, NonManifold
pcen_6 = PolygonCenter(Polyline=rectangle_6.Rectangle)  # -> CenterV, CenterE, CenterA
# 1
end_6 = EndPoints(Curve=edges_6.Naked)  # -> Start, End
eval_6 = EvaluateCurve(Curve=reparameterize(edges_6.Naked), Parameter=t_6)  # -> Point, Tangent, Angle
multiplication_11 = Multiplication(A=division_6, B=Slider(0.9, range=0..1))
multiplication_12 = Multiplication(A=Slider(0.3, range=0..1), B=division_6)
ln_11 = Line(StartPoint=pcen_6.CenterV, EndPoint=end_6.Start)
xy_6 = XYPlane(Origin=pcen_6.CenterV)
ln_12 = Line(StartPoint=pcen_6.CenterV, EndPoint=eval_6.Point)

# ---- group: Motif Basis
maelstrom_4 = Maelstrom(Geometry=[ln_7, ln_8], Plane=xy_4, First=multiplication_8, Second=multiplication_7, Angle=1.570796327, Rigid=False)

maelstrom_5 = Maelstrom(Geometry=[ln_9, ln_10], Plane=xy_5, First=multiplication_10, Second=multiplication_9, Angle=1.570796327, Rigid=False)

maelstrom_6 = Maelstrom(Geometry=[ln_11, ln_12], Plane=xy_6, First=multiplication_12, Second=multiplication_11, Angle=1.570796327, Rigid=False)

# ----
xz_4 = XZPlane(Origin=Point(0, 0, 0))
# 2
mirror_4 = Mirror(Geometry=maelstrom_4, Plane=xz_4)  # -> Geometry, Transform
Y_4 = UnitY(Factor=size_4)
move_4 = Move(Geometry=mirror_4.Geometry, Motion=Y_4)  # -> Geometry, Transform

xz_5 = XZPlane(Origin=Point(0, 0, 0))
# 2
mirror_5 = Mirror(Geometry=maelstrom_5, Plane=xz_5)  # -> Geometry, Transform
Y_5 = UnitY(Factor=size_5)
move_5 = Move(Geometry=mirror_5.Geometry, Motion=Y_5)  # -> Geometry, Transform

xz_6 = XZPlane(Origin=Point(0, 0, 0))
# 2
mirror_6 = Mirror(Geometry=maelstrom_6, Plane=xz_6)  # -> Geometry, Transform
Y_6 = UnitY(Factor=size_6)
move_6 = Move(Geometry=mirror_6.Geometry, Motion=Y_6)  # -> Geometry, Transform

# ---- group: Motif
join_4 = JoinCurves(Curves=[move_4.Geometry, maelstrom_4], Preserve=False)

join_5 = JoinCurves(Curves=[move_5.Geometry, maelstrom_5], Preserve=False)

join_6 = JoinCurves(Curves=[move_6.Geometry, maelstrom_6], Preserve=False)

# ----
Y_7 = Slider(2, range=1..100)
X = Slider(2, range=1..100)

# ---- group: Tess Interior
arrrec = RectangularArray(Geometry=join, Cell=rectangle.Rectangle, XCount=X, YCount=Y_7)  # -> Geometry, Transform

# ----
X_2 = Slider(2, range=1..100)
Y_8 = Slider(2, range=1..100)

# ---- group: Tess Interior
arrrec_2 = RectangularArray(Geometry=join_2, Cell=rectangle_2.Rectangle, XCount=X_2, YCount=Y_8)  # -> Geometry, Transform

# ----
Y_9 = Slider(2, range=1..100)
X_3 = Slider(2, range=1..100)

# ---- group: Tess Interior
arrrec_3 = RectangularArray(Geometry=join_3, Cell=rectangle_3.Rectangle, XCount=X_3, YCount=Y_9)  # -> Geometry, Transform

# ----
# 3
bbox = BoundingBox(Content=flatten(arrrec.Geometry), Plane=PlaneXY(0, 0, 0), UnionBox=True)  # -> Box, Box_2

dim = Dimensions(Surface=bbox.Box)  # -> UDimension, VDimension

# ---- group: Tess Border
edges_7 = BrepEdges(Brep=bbox.Box)  # -> Naked, Interior, NonManifold

# ----
addition = Addition(A=dim.VDimension, B="0.8")

final_output = Curve([edges_7.Naked, arrrec.Geometry])

Y_10 = UnitY(Factor=addition)

# ---- group: Final Output
move_7 = Move(Geometry=final_output, Motion=Y_10)  # -> Geometry, Transform

# ----
# 3
bbox_2 = BoundingBox(Content=flatten(arrrec_2.Geometry), Plane=PlaneXY(0, 0, 0), UnionBox=True)  # -> Box, Box_2

dim_2 = Dimensions(Surface=bbox_2.Box)  # -> UDimension, VDimension

# ---- group: Tess Border
edges_8 = BrepEdges(Brep=bbox_2.Box)  # -> Naked, Interior, NonManifold

# ----
addition_2 = Addition(A=dim_2.VDimension, B="2.1")
multiplication_13 = Multiplication(A=addition_2, B="2.1")

crv = Curve([edges_8.Naked, arrrec_2.Geometry])

Y_11 = UnitY(Factor=multiplication_13)

# ---- group: Final Output
move_8 = Move(Geometry=crv, Motion=Y_11)  # -> Geometry, Transform

# ----
# 3
bbox_3 = BoundingBox(Content=flatten(arrrec_3.Geometry), Plane=PlaneXY(0, 0, 0), UnionBox=True)  # -> Box, Box_2

# ---- group: Tess Border
edges_9 = BrepEdges(Brep=bbox_3.Box)  # -> Naked, Interior, NonManifold

# ----
final_output_2 = Curve([edges_9.Naked, arrrec_3.Geometry])

Y_12 = Slider(2, range=1..100)
X_4 = Slider(2, range=1..100)

# ---- group: Tess Interior
arrrec_4 = RectangularArray(Geometry=join_4, Cell=rectangle_4.Rectangle, XCount=X_4, YCount=Y_12)  # -> Geometry, Transform

# ----
Y_13 = Slider(2, range=1..100)
X_5 = Slider(2, range=1..100)

# ---- group: Tess Interior
arrrec_5 = RectangularArray(Geometry=join_5, Cell=rectangle_5.Rectangle, XCount=X_5, YCount=Y_13)  # -> Geometry, Transform

# ----
Y_14 = Slider(2, range=1..100)
X_6 = Slider(2, range=1..100)

# ---- group: Tess Interior
arrrec_6 = RectangularArray(Geometry=join_6, Cell=rectangle_6.Rectangle, XCount=X_6, YCount=Y_14)  # -> Geometry, Transform

# ----
# 3
bbox_4 = BoundingBox(Content=flatten(arrrec_4.Geometry), Plane=PlaneXY(0, 0, 0), UnionBox=True)  # -> Box, Box_2

# ---- group: Tess Border
edges_10 = BrepEdges(Brep=bbox_4.Box)  # -> Naked, Interior, NonManifold

# ----
dim_3 = Dimensions(Surface=bbox_4.Box)  # -> UDimension, VDimension

final_output_3 = Curve([edges_10.Naked, arrrec_4.Geometry])

addition_3 = Addition(A=dim_3.VDimension, B="2.3")
multiplication_14 = Multiplication(A=addition_3, B="2.3")
addition_4 = Addition(A=dim_3.UDimension, B="2")
X_7 = UnitX(Factor=addition_4)
vec = VectorXYZ(XComponent=X_7, YComponent=0, ZComponent=0)  # -> Vector, Length

# ---- group: Final Output
move_9 = Move(Geometry=final_output_3, Motion=vec.Vector)  # -> Geometry, Transform

# ----
# 3
bbox_5 = BoundingBox(Content=flatten(arrrec_5.Geometry), Plane=PlaneXY(0, 0, 0), UnionBox=True)  # -> Box, Box_2

# ---- group: Tess Border
edges_11 = BrepEdges(Brep=bbox_5.Box)  # -> Naked, Interior, NonManifold

# ----
dim_4 = Dimensions(Surface=bbox_5.Box)  # -> UDimension, VDimension

final_output_4 = Curve([edges_11.Naked, arrrec_5.Geometry])

addition_5 = Addition(A=dim_4.VDimension, B="1.15")
addition_6 = Addition(A=dim_4.UDimension, B="2")
multiplication_15 = Multiplication(A=addition_5, B="1.15")
X_8 = UnitX(Factor=addition_6)
Y_15 = UnitY(Factor=multiplication_15)
vec_2 = VectorXYZ(XComponent=X_8, YComponent=Y_15, ZComponent=0)  # -> Vector, Length

# ---- group: Final Output
move_10 = Move(Geometry=final_output_4, Motion=vec_2.Vector)  # -> Geometry, Transform

# ----
# 3
bbox_6 = BoundingBox(Content=flatten(arrrec_6.Geometry), Plane=PlaneXY(0, 0, 0), UnionBox=True)  # -> Box, Box_2

# ---- group: Tess Border
edges_12 = BrepEdges(Brep=bbox_6.Box)  # -> Naked, Interior, NonManifold

# ----
dim_5 = Dimensions(Surface=bbox_6.Box)  # -> UDimension, VDimension

crv_2 = Curve([edges_12.Naked, arrrec_6.Geometry])

addition_7 = Addition(A=dim_5.VDimension, B="2.1")
multiplication_16 = Multiplication(A=addition_7, B="2.1")
addition_8 = Addition(A=dim_5.UDimension, B="2")
Y_16 = UnitY(Factor=multiplication_16)
X_9 = UnitX(Factor=addition_8)
vec_3 = VectorXYZ(XComponent=X_9, YComponent=Y_16, ZComponent=0)  # -> Vector, Length

# ---- group: Final Output
move_11 = Move(Geometry=crv_2, Motion=vec_3.Vector)  # -> Geometry, Transform
