# Grasshopper definition Figure4-2_4-3_overlap_polygons.gh (Grasshopper 1.0.9)

segments = Slider(3, range=3..12)
# Tessellation from Overlapping Polygons
radius = Slider(10, range=0.01..20)
cell_x_scale = Slider(0.84, range=0.01..3)
cell_y_scale = Slider(1.14, range=0.01..3)
# 1
polygon = Polygon(Plane=PlaneXY(0, 0, 0), Radius=radius, Segments=segments, FilletRadius=Slider(1.19, range=0..5))  # -> Polygon, Length
x_count = Slider(12, range=0..20)
y_count = Slider(10, range=0..20)
bbox = BoundingBox(Content=polygon.Polygon, Plane=PlaneXY(0, 0, 0))  # -> Box, Box_2
scale_nu = ScaleNU(Geometry=bbox.Box, Plane=PlaneXY(0, 0, 0), ScaleX=cell_x_scale, ScaleY=cell_y_scale, ScaleZ=1)  # -> Geometry, Transform
arrrec = RectangularArray(Geometry=polygon.Polygon, Cell=scale_nu.Geometry, XCount=x_count, YCount=y_count)  # -> Geometry, Transform

number_slider = Slider(0.5, range=0.1..1)
dim = Dimensions(Surface=scale_nu.Geometry)  # -> UDimension, VDimension
# 2
multiplication = Multiplication(A=dim.UDimension, B=number_slider)
multiplication_2 = Multiplication(A=dim.VDimension, B=number_slider)
vec = VectorXYZ(XComponent=multiplication, YComponent=multiplication_2, ZComponent=0)  # -> Vector, Length
move = Move(Geometry=arrrec.Geometry, Motion=vec.Vector)  # -> Geometry, Transform

crv = Curve([arrrec.Geometry, move.Geometry])
# 3
mp = MultiPipe(Curves=crv, NodeSize=Slider(0.2, range=0.01..1), EndOffset=1, StrutSize=1, Segment=0, KinkAngle=0.6, CubeFit=0, Caps=0)
