# Grasshopper definition Figure4-4_to_4-8_overlap_polygons_variations.gh (Grasshopper 1.0.9)

segments = Slider(4, range=3..12)
radius = Slider(10, range=0.01..20)
# Squares: No Filet, 1/4 PI Rotation
number_slider = Slider(0.25, range=0..2)
polygon = Polygon(Plane=PlaneXY(0, 0, 0), Radius=radius, Segments=segments, FilletRadius=Slider(0, range=0..5))  # -> Polygon, Length
pi = Pi(Factor=number_slider)
cell_x_scale = Slider(0.58, range=0.01..3)
cell_y_scale = Slider(1.14, range=0.01..3)
rotate = Rotate(Geometry=polygon.Polygon, Angle=pi, Plane=PlaneXY(0, 0, 0))  # -> Geometry, Transform
bbox = BoundingBox(Content=rotate.Geometry, Plane=PlaneXY(0, 0, 0))  # -> Box, Box_2
x_count = Slider(12, range=0..20)
y_count = Slider(10, range=0..20)
scale_nu = ScaleNU(Geometry=bbox.Box, Plane=PlaneXY(0, 0, 0), ScaleX=cell_x_scale, ScaleY=cell_y_scale, ScaleZ=1)  # -> Geometry, Transform
arrrec = RectangularArray(Geometry=rotate.Geometry, Cell=scale_nu.Geometry, XCount=x_count, YCount=y_count)  # -> Geometry, Transform

segments_2 = Slider(6, range=3..12)
radius_2 = Slider(10, range=0.01..20)
# Hexagons: No Filet, 1/2 PI Rotation
number_slider_2 = Slider(0.5, range=0..2)
polygon_2 = Polygon(Plane=PlaneXY(0, 0, 0), Radius=radius_2, Segments=segments_2, FilletRadius=Slider(0, range=0..5))  # -> Polygon, Length
pi_2 = Pi(Factor=number_slider_2)
cell_x_scale_2 = Slider(0.58, range=0.01..3)
cell_y_scale_2 = Slider(1.14, range=0.01..3)
rotate_2 = Rotate(Geometry=polygon_2.Polygon, Angle=pi_2, Plane=PlaneXY(0, 0, 0))  # -> Geometry, Transform
bbox_2 = BoundingBox(Content=rotate_2.Geometry, Plane=PlaneXY(0, 0, 0))  # -> Box, Box_2
y_count_2 = Slider(10, range=0..20)
x_count_2 = Slider(12, range=0..20)
scale_nu_2 = ScaleNU(Geometry=bbox_2.Box, Plane=PlaneXY(0, 0, 0), ScaleX=cell_x_scale_2, ScaleY=cell_y_scale_2, ScaleZ=1)  # -> Geometry, Transform
arrrec_2 = RectangularArray(Geometry=rotate_2.Geometry, Cell=scale_nu_2.Geometry, XCount=x_count_2, YCount=y_count_2)  # -> Geometry, Transform

segments_3 = Slider(6, range=3..12)
radius_3 = Slider(10, range=0.01..20)
# Hexagons: No Filet, No Rotation
number_slider_3 = Slider(0, range=0..2)
polygon_3 = Polygon(Plane=PlaneXY(0, 0, 0), Radius=radius_3, Segments=segments_3, FilletRadius=Slider(0, range=0..5))  # -> Polygon, Length
pi_3 = Pi(Factor=number_slider_3)
cell_x_scale_3 = Slider(0.58, range=0.01..3)
cell_y_scale_3 = Slider(1.14, range=0.01..3)
rotate_3 = Rotate(Geometry=polygon_3.Polygon, Angle=pi_3, Plane=PlaneXY(0, 0, 0))  # -> Geometry, Transform
bbox_3 = BoundingBox(Content=rotate_3.Geometry, Plane=PlaneXY(0, 0, 0))  # -> Box, Box_2
x_count_3 = Slider(12, range=0..20)
y_count_3 = Slider(10, range=0..20)
scale_nu_3 = ScaleNU(Geometry=bbox_3.Box, Plane=PlaneXY(0, 0, 0), ScaleX=cell_x_scale_3, ScaleY=cell_y_scale_3, ScaleZ=1)  # -> Geometry, Transform
arrrec_3 = RectangularArray(Geometry=rotate_3.Geometry, Cell=scale_nu_3.Geometry, XCount=x_count_3, YCount=y_count_3)  # -> Geometry, Transform

segments_4 = Slider(6, range=3..12)
radius_4 = Slider(10, range=0.01..20)
# Hexagons: No Filet, 1/4 PI Rotation
number_slider_4 = Slider(0.25, range=0..2)
polygon_4 = Polygon(Plane=PlaneXY(0, 0, 0), Radius=radius_4, Segments=segments_4, FilletRadius=Slider(0, range=0..5))  # -> Polygon, Length
pi_4 = Pi(Factor=number_slider_4)
cell_x_scale_4 = Slider(0.58, range=0.01..3)
cell_y_scale_4 = Slider(1.14, range=0.01..3)
rotate_4 = Rotate(Geometry=polygon_4.Polygon, Angle=pi_4, Plane=PlaneXY(0, 0, 0))  # -> Geometry, Transform
bbox_4 = BoundingBox(Content=rotate_4.Geometry, Plane=PlaneXY(0, 0, 0))  # -> Box, Box_2
y_count_4 = Slider(10, range=0..20)
x_count_4 = Slider(12, range=0..20)
scale_nu_4 = ScaleNU(Geometry=bbox_4.Box, Plane=PlaneXY(0, 0, 0), ScaleX=cell_x_scale_4, ScaleY=cell_y_scale_4, ScaleZ=1)  # -> Geometry, Transform
arrrec_4 = RectangularArray(Geometry=rotate_4.Geometry, Cell=scale_nu_4.Geometry, XCount=x_count_4, YCount=y_count_4)  # -> Geometry, Transform

segments_5 = Slider(4, range=3..12)
# Overlapping Polygons: Variations
# Squares: No Filet, No Rotation
radius_5 = Slider(10, range=0.01..20)
cell_x_scale_5 = Slider(0.58, range=0.01..3)
cell_y_scale_5 = Slider(1.14, range=0.01..3)
polygon_5 = Polygon(Plane=PlaneXY(0, 0, 0), Radius=radius_5, Segments=segments_5, FilletRadius=Slider(0, range=0..5))  # -> Polygon, Length
x_count_5 = Slider(12, range=0..20)
y_count_5 = Slider(10, range=0..20)
bbox_5 = BoundingBox(Content=polygon_5.Polygon, Plane=PlaneXY(0, 0, 0))  # -> Box, Box_2
scale_nu_5 = ScaleNU(Geometry=bbox_5.Box, Plane=PlaneXY(0, 0, 0), ScaleX=cell_x_scale_5, ScaleY=cell_y_scale_5, ScaleZ=1)  # -> Geometry, Transform
arrrec_5 = RectangularArray(Geometry=polygon_5.Polygon, Cell=scale_nu_5.Geometry, XCount=x_count_5, YCount=y_count_5)  # -> Geometry, Transform

number_slider_5 = Slider(0.5, range=0.1..1)
dim = Dimensions(Surface=scale_nu_5.Geometry)  # -> UDimension, VDimension
multiplication = Multiplication(A=dim.UDimension, B=number_slider_5)
multiplication_2 = Multiplication(A=dim.VDimension, B=number_slider_5)
vec = VectorXYZ(XComponent=multiplication, YComponent=multiplication_2, ZComponent=0)  # -> Vector, Length
move = Move(Geometry=arrrec_5.Geometry, Motion=vec.Vector)  # -> Geometry, Transform

number_slider_6 = Slider(0.5, range=0.1..1)
dim_2 = Dimensions(Surface=scale_nu.Geometry)  # -> UDimension, VDimension
multiplication_3 = Multiplication(A=dim_2.UDimension, B=number_slider_6)
multiplication_4 = Multiplication(A=dim_2.VDimension, B=number_slider_6)
vec_2 = VectorXYZ(XComponent=multiplication_3, YComponent=multiplication_4, ZComponent=0)  # -> Vector, Length
move_2 = Move(Geometry=arrrec.Geometry, Motion=vec_2.Vector)  # -> Geometry, Transform

number_slider_7 = Slider(0.5, range=0.1..1)
dim_3 = Dimensions(Surface=scale_nu_2.Geometry)  # -> UDimension, VDimension
multiplication_5 = Multiplication(A=dim_3.UDimension, B=number_slider_7)
multiplication_6 = Multiplication(A=dim_3.VDimension, B=number_slider_7)
vec_3 = VectorXYZ(XComponent=multiplication_5, YComponent=multiplication_6, ZComponent=0)  # -> Vector, Length
move_3 = Move(Geometry=arrrec_2.Geometry, Motion=vec_3.Vector)  # -> Geometry, Transform

number_slider_8 = Slider(0.5, range=0.1..1)
dim_4 = Dimensions(Surface=scale_nu_3.Geometry)  # -> UDimension, VDimension
multiplication_7 = Multiplication(A=dim_4.UDimension, B=number_slider_8)
multiplication_8 = Multiplication(A=dim_4.VDimension, B=number_slider_8)
vec_4 = VectorXYZ(XComponent=multiplication_7, YComponent=multiplication_8, ZComponent=0)  # -> Vector, Length
move_4 = Move(Geometry=arrrec_3.Geometry, Motion=vec_4.Vector)  # -> Geometry, Transform

number_slider_9 = Slider(0.5, range=0.1..1)
dim_5 = Dimensions(Surface=scale_nu_4.Geometry)  # -> UDimension, VDimension
multiplication_9 = Multiplication(A=dim_5.UDimension, B=number_slider_9)
multiplication_10 = Multiplication(A=dim_5.VDimension, B=number_slider_9)
vec_5 = VectorXYZ(XComponent=multiplication_9, YComponent=multiplication_10, ZComponent=0)  # -> Vector, Length
move_5 = Move(Geometry=arrrec_4.Geometry, Motion=vec_5.Vector)  # -> Geometry, Transform

crv = Curve([arrrec_5.Geometry, move.Geometry])
mp = MultiPipe(Curves=crv, NodeSize=Slider(0.2, range=0.01..1), EndOffset=1, StrutSize=1, Segment=0, KinkAngle=0.6, CubeFit=0, Caps=0)

crv_2 = Curve([arrrec.Geometry, move_2.Geometry])
mp_2 = MultiPipe(Curves=crv_2, NodeSize=Slider(0.2, range=0.01..1), EndOffset=1, StrutSize=1, Segment=0, KinkAngle=0.6, CubeFit=0, Caps=0)

crv_3 = Curve([arrrec_2.Geometry, move_3.Geometry])
mp_3 = MultiPipe(Curves=crv_3, NodeSize=Slider(0.2, range=0.01..1), EndOffset=1, StrutSize=1, Segment=0, KinkAngle=0.6, CubeFit=0, Caps=0)

crv_4 = Curve([arrrec_3.Geometry, move_4.Geometry])
mp_4 = MultiPipe(Curves=crv_4, NodeSize=Slider(0.2, range=0.01..1), EndOffset=1, StrutSize=1, Segment=0, KinkAngle=0.6, CubeFit=0, Caps=0)

crv_5 = Curve([arrrec_4.Geometry, move_5.Geometry])
mp_5 = MultiPipe(Curves=crv_5, NodeSize=Slider(0.2, range=0.01..1), EndOffset=1, StrutSize=1, Segment=0, KinkAngle=0.6, CubeFit=0, Caps=0)
