# Grasshopper definition Figure4-9_to_4-11_radial_lines_1unit_motif.gh (Grasshopper 1.0.9)

size = Slider(5, range=1..10)
# Tess from Single Unit Radial Lines Motif
rectangle = Rectangle(Plane=PlaneXY(0, 0, 0), XSize=size, YSize=size, Radius=0)  # -> Rectangle, Length
t = Slider(0.7, range=0..1)
edges = BrepEdges(Brep=rectangle.Rectangle)  # -> Naked, Interior, NonManifold
pcen = PolygonCenter(Polyline=rectangle.Rectangle)  # -> CenterV, CenterE, CenterA
end = EndPoints(Curve=edges.Naked)  # -> Start, End
eval = EvaluateCurve(Curve=reparameterize(edges.Naked), Parameter=t)  # -> Point, Tangent, Angle
ln = Line(StartPoint=pcen.CenterV, EndPoint=end.Start)
ln_2 = Line(StartPoint=pcen.CenterV, EndPoint=eval.Point)
line = Line([ln, ln_2])

xz = XZPlane(Origin=Point(0, 0, 0))
mirror = Mirror(Geometry=line, Plane=xz)  # -> Geometry, Transform
Y = UnitY(Factor=size)
move = Move(Geometry=mirror.Geometry, Motion=Y)  # -> Geometry, Transform

# ---- group: Visualize Which Line is Which
item = ListItem(List=ln, Index=0, Wrap=True)  # -> Item, Item1, Item2, Item3
line_2 = Line(item.Item)
line_3 = Line(item.Item1)
line_4 = Line(item.Item2)
line_5 = Line(item.Item3)

# ----
tess_x_count = Slider(12, range=1..100)
tess_y_count = Slider(6, range=1..100)

# ---- group: Single Radial Lines Tile
join = JoinCurves(Curves=[move.Geometry, line], Preserve=False)

# ---- group: Tess Interior
arrrec = RectangularArray(Geometry=join, Cell=rectangle.Rectangle, XCount=tess_x_count, YCount=tess_y_count)  # -> Geometry, Transform

# ---- group: Tess Border
bbox = BoundingBox(Content=flatten(arrrec.Geometry), Plane=PlaneXY(0, 0, 0), UnionBox=True)  # -> Box, Box_2
edges_2 = BrepEdges(Brep=bbox.Box)  # -> Naked, Interior, NonManifold

# ---- group: Tess from Single Unit Radial Lines Motif
mp = MultiPipe(
    Curves=[arrrec.Geometry, edges_2.Naked],
    NodeSize=Slider(0.05, range=0..0.1),
    EndOffset=1,
    StrutSize=1,
    Segment=0,
    KinkAngle=0.6,
    CubeFit=0,
    Caps=0)
