# Grasshopper definition Figure5-11_to_5-26_spiral_staircase.gh (Grasshopper 1.0.9)

center_pole_r = Slider(1.5, range=1..50)
center_pole_h = Slider(265.6, range=5..300)
pt = ConstructPoint(XCoordinate=0, YCoordinate=0, ZCoordinate=0)
horizontal_div = Slider(40, range=1..50)
vertical_div = Slider(64, range=1..201)
circle = CircleCNR(Center=pt, Normal=Vector(0, 0, 1), Radius=center_pole_r)
Z = UnitZ(Factor=center_pole_h)
# 1
extr = Extrude(Base=circle, Direction=Z)
sdivide = DivideSurface(Surface=extr, UCount=vertical_div, VCount=horizontal_div)  # -> flatten(Points), Normals, Parameters
subtraction = Subtraction(A=horizontal_div, B="1")
culln = CullNth(List=sdivide.Points, CullFrequency=subtraction)
num_treads = Slider(51, range=1..200)
difference = SetDifference(SetA=sdivide.Points, SetB=culln)
# Spiral Staircase
intcrv = Interpolate(Vertices=difference, Degree=3, Periodic=False, KnotStyle=1)  # -> Curve, Length, Domain
hframes = HorizontalFrames(Curve=intcrv.Curve, Count=num_treads)  # -> Frames, Parameters

tread_half_width = Slider(5.4, range=1..20)
tread_inset_into_pole = Slider(-5.4, range=-20..0)
tread_length = Slider(31.2, range=1..60)
# 2
subtraction_2 = Subtraction(A="0", B=tread_half_width)
dom = ConstructDomain(DomainStart=subtraction_2, DomainEnd=tread_half_width)
dom_2 = ConstructDomain(DomainStart=tread_inset_into_pole, DomainEnd=tread_length)
rectangle = Rectangle(Plane=hframes.Frames, XSize=dom, YSize=dom_2, Radius=0)  # -> Rectangle, Length

edges = BrepEdges(Brep=rectangle.Rectangle)  # -> Naked, Interior, NonManifold
item = ListItem(List=edges.Naked, Index="2", Wrap=True)
# 3
item_2 = ListItem(List=edges.Naked, Index=0, Wrap=True)
end = EndPoints(Curve=item)  # -> Start, End
eval = EvaluateCurve(Curve=item_2, Parameter="0.5")  # -> Point, Tangent, Angle
ln = Line(StartPoint=end.End, EndPoint=end.Start)
scale = Scale(Geometry=item_2, Center=eval.Point, Factor=Slider(0.41, range=0..1))  # -> Geometry, Transform
loft = Loft(
    Curves=[scale.Geometry, ln],
    Options={Adjust=False, Closed=False, LoftEnds=0, LoftSimp=0, LoftType=0, Rebuild=10, Refit=0.01})

panel = Panel("""0
2""")
item_3 = ListItem(List=edges.Naked, Index=panel, Wrap=True)
eval_2 = EvaluateCurve(Curve=reparameterize(item_3), Parameter="0.5")  # -> Point, Tangent, Angle
railing_inset_t = Slider(0.15, range=0.1..0.9)
item_4 = ListItem(List=eval_2.Point, Index=0, Wrap=True)  # -> Item, Item1
railing_height = Slider(25, range=1..25)
railing_radius = Slider(0.5, range=0.1..1.1)
ln_2 = Line(StartPoint=item_4.Item1, EndPoint=item_4.Item)
# 5
eval_3 = EvaluateCurve(Curve=reparameterize(ln_2), Parameter=railing_inset_t)  # -> flatten(Point), Tangent, Angle
cir = Circle(Plane=eval_3.Point, Radius=railing_radius)
Z_2 = UnitZ(Factor=railing_height)
extr_2 = Extrude(Base=cir, Direction=Z_2)

pt_2 = ConstructPoint(XCoordinate="0.5", YCoordinate="0.5", ZCoordinate=0)
evalsrf = EvaluateSurface(Surface=loft, Point=pt_2)  # -> Point, Normal, UDirection, VDirection, Frame
# 4
multiplication = Multiplication(A=evalsrf.Normal, B=Slider(1.2, range=0.1..10))
extr_3 = Extrude(Base=loft, Direction=multiplication)

move = Move(Geometry=eval_3.Point, Motion=Z_2)  # -> Geometry, Transform
intcrv_t = InterpolateT(Vertices=move.Geometry, TangentStart=Vector(0, 0, 0), TangentEnd=Vector(0, 0, 0), KnotStyle=1)  # -> Curve, Length, Domain
# 6
pipe = Pipe(Curve=intcrv_t.Curve, Radius=1, Caps="2", FitRail=False)

geo = Geometry([extr_3, extr, extr_2, pipe])
