# Grasshopper definition Figure5-2_to_5-3_mobius_with_LunchBox.gh (Grasshopper 1.0.9)
# plug-ins: LunchBox

# Mobius with LunchBox
# (Mobius Surface node)
# 1
mobius_surface = MobiusSurface(
    UDivisions=100,
    VDivisions=100,
    RParameter=4,
    TParameter=0.5,
    Scale=5,
    Domain1=Domain(-3.141592654, 3.141592654),
    Domain2=Domain(-1, 1))

# ----
# 2
u_divisions = Slider(34, range=1..100)
v_divisions = Slider(3, range=1..100)
# 3
triangular_panels_a = TriangularPanelsA(Surface=mobius_surface, UDivisions=u_divisions, VDivisions=v_divisions)
# 4
quad_panels = QuadPanels(Surface=mobius_surface, UDivisions=u_divisions, VDivisions=v_divisions)
# 5
staggered_quad_panels = StaggeredQuadPanels(Surface=mobius_surface, UDivisions=u_divisions, VDivisions=v_divisions)
# 6
triangle_panels_c = TrianglePanelsC(Surface=mobius_surface, UDivisions=u_divisions, VDivisions=v_divisions)
# 7
brep_edges = BrepEdges(Brep=triangular_panels_a)  # -> Naked, Interior, NonManifold
brep_edges_2 = BrepEdges(Brep=quad_panels)  # -> Naked, Interior, NonManifold
brep_edges_3 = BrepEdges(Brep=staggered_quad_panels)  # -> Naked, Interior, NonManifold
brep_edges_4 = BrepEdges(Brep=triangle_panels_c)  # -> Naked, Interior, NonManifold
