# Grasshopper definition Figure5-4_to_5-5_twist_mobius.gh (Grasshopper 1.0.9)
# plug-ins: LunchBox

number_slider = Slider(5, range=1..20)
# Twist Mobius
# 1
panel = Panel("2*pi")
# 2
multiplication = Multiplication(A=panel, B=number_slider)
dom = ConstructDomain(DomainStart=0, DomainEnd=multiplication)
Y = UnitY(Factor=1)
# 3
rectangle = Rectangle(Plane=PlaneXY(0, 0, 0), XSize=Domain(-1, 1), YSize=dom, Radius=0)  # -> Rectangle, Length
# 6
line = LineSDL(Start="{0,0,0}", Direction=Y, Length=multiplication)
pi = Pi(Factor=Slider(1, range=1..20))
# 4
boundary = BoundarySurfaces(Edges=rectangle.Rectangle)
# 7
cir = Circle(Plane=PlaneXY(0, 0, 0), Radius=number_slider)
# 5
twist = Twist(Geometry=boundary, Axis=line, Angle=pi, Infinite=False, Rigid=False)
# 8
flow = Flow(Geometry=twist, Base=line, Target=cir, ReverseBase=False, ReverseTarget=False, Stretch=True, Rigid=False)
number_slider_2 = Slider(5, range=1..20)
# Twist Mobius - Variations
panel_2 = Panel("2*pi")
multiplication_2 = Multiplication(A=panel_2, B=number_slider_2)
dom_2 = ConstructDomain(DomainStart=0, DomainEnd=multiplication_2)
Y_2 = UnitY(Factor=1)
rectangle_2 = Rectangle(Plane=PlaneXY(0, 0, 0), XSize=Domain(-1, 1), YSize=dom_2, Radius=0)  # -> Rectangle, Length
line_2 = LineSDL(Start="{0,0,0}", Direction=Y_2, Length=multiplication_2)
pi_2 = Pi(Factor=Slider(1, range=1..20))
boundary_2 = BoundarySurfaces(Edges=rectangle_2.Rectangle)
cir_2 = Circle(Plane=PlaneXY(0, 0, 0), Radius=number_slider_2)
twist_2 = Twist(Geometry=boundary_2, Axis=line_2, Angle=pi_2, Infinite=False, Rigid=False)
flow_2 = Flow(Geometry=twist_2, Base=line_2, Target=cir_2, ReverseBase=False, ReverseTarget=False, Stretch=True, Rigid=False)

number_slider_3 = Slider(3, range=1..100)
number_slider_4 = Slider(34, range=1..100)
tria = TriangularPanelsA(Surface=flow_2, UDivisions=number_slider_3, VDivisions=number_slider_4)
quads = QuadPanels(Surface=flow_2, UDivisions=number_slider_3, VDivisions=number_slider_4)
quadstag = StaggeredQuadPanels(Surface=flow_2, UDivisions=number_slider_3, VDivisions=number_slider_4)
tric = TrianglePanelsC(Surface=flow_2, UDivisions=number_slider_3, VDivisions=number_slider_4)
edges = BrepEdges(Brep=tria)  # -> Naked, Interior, NonManifold
edges_2 = BrepEdges(Brep=quads)  # -> Naked, Interior, NonManifold
edges_3 = BrepEdges(Brep=quadstag)  # -> Naked, Interior, NonManifold
edges_4 = BrepEdges(Brep=tric)  # -> Naked, Interior, NonManifold
