# Grasshopper definition Figure5-6_to_5-7_math_mobius_exp_nodes.gh (Grasshopper 1.0.9)
# plug-ins: LunchBox

# Mobius from Math Formula: Expression Nodes
number_slider = Slider(0.5, range=0.1..100)
# Formula source:
# https://www.pleacher.com/handley/lessons/calc2004/param.html
panel = Panel("-1")
number_slider_2 = Slider(15, range=0..100)
multiplication = Multiplication(A=number_slider, B=panel)
dom = ConstructDomain(DomainStart=multiplication, DomainEnd=number_slider)
range = Range(Domain=dom, Steps=number_slider_2)
range_2 = Range(Domain="0 to 2*pi", Steps=number_slider_2)
crossref = CrossReference(ListA=range_2, ListB=range, CrossMode=1)  # -> ListA, ListB

expression = Expression(s=crossref.ListA, t=crossref.ListB, Expression="sin(s)+t*cos(s/2)*sin(s)")
expression_2 = Expression(s=crossref.ListA, t=crossref.ListB, Expression="cos(s)+t*cos(s/2)*cos(s)")
expression_3 = Expression(s=crossref.ListA, t=crossref.ListB, Expression="t*sin(s/2)")
pt = ConstructPoint(XCoordinate=expression_2, YCoordinate=expression, ZCoordinate=expression_3)

addition = Addition(A=number_slider_2, B="1")
series = Series(Start=addition, Step="0", Count=addition)
partition = PartitionList(List=pt, Size=series)  # -> simplify(Chunks)
flip = FlipMatrix(Data=partition)
intcrv = Interpolate(Vertices=flip, Degree=3, Periodic=False, KnotStyle=1)  # -> flatten(Curve), Length, Domain
intcrv_2 = Interpolate(Vertices=partition, Degree=3, Periodic=False, KnotStyle=1)  # -> flatten(Curve), Length, Domain
loft = Loft(Curves=intcrv.Curve, Options={Adjust=False, Closed=False, LoftEnds=0, LoftSimp=0, LoftType=0, Rebuild=10, Refit=0.01})
loft_2 = Loft(Curves=intcrv_2.Curve, Options={Adjust=False, Closed=False, LoftEnds=0, LoftSimp=0, LoftType=0, Rebuild=10, Refit=0.01})
# Mobius from Math Formula: Expression Nodes
number_slider_3 = Slider(0.5, range=0.1..100)
# Formula source:
# https://www.pleacher.com/handley/lessons/calc2004/param.html
panel_2 = Panel("-1")
number_slider_4 = Slider(15, range=0..100)
multiplication_2 = Multiplication(A=number_slider_3, B=panel_2)
dom_2 = ConstructDomain(DomainStart=multiplication_2, DomainEnd=number_slider_3)
range_3 = Range(Domain="0 to 2*pi", Steps=number_slider_4)
range_4 = Range(Domain=dom_2, Steps=number_slider_4)
crossref_2 = CrossReference(ListA=range_3, ListB=range_4, CrossMode=1)  # -> ListA, ListB

expression_4 = Expression(s=crossref_2.ListA, t=crossref_2.ListB, Expression="sin(s)+t*cos(s/2)*sin(s)")
expression_5 = Expression(s=crossref_2.ListA, t=crossref_2.ListB, Expression="cos(s)+t*cos(s/2)*cos(s)")
expression_6 = Expression(s=crossref_2.ListA, t=crossref_2.ListB, Expression="t*sin(s/2)")
pt_2 = ConstructPoint(XCoordinate=expression_5, YCoordinate=expression_4, ZCoordinate=expression_6)

addition_2 = Addition(A=number_slider_4, B="1")
series_2 = Series(Start=addition_2, Step="0", Count=addition_2)
partition_2 = PartitionList(List=pt_2, Size=series_2)  # -> simplify(Chunks)
flip_2 = FlipMatrix(Data=partition_2)
intcrv_3 = Interpolate(Vertices=flip_2, Degree=3, Periodic=False, KnotStyle=1)  # -> flatten(Curve), Length, Domain
intcrv_4 = Interpolate(Vertices=partition_2, Degree=3, Periodic=False, KnotStyle=1)  # -> flatten(Curve), Length, Domain
loft_3 = Loft(Curves=intcrv_3.Curve, Options={Adjust=False, Closed=False, LoftEnds=0, LoftSimp=0, LoftType=0, Rebuild=10, Refit=0.01})
loft_4 = Loft(Curves=intcrv_4.Curve, Options={Adjust=False, Closed=False, LoftEnds=0, LoftSimp=0, LoftType=0, Rebuild=10, Refit=0.01})

number_slider_5 = Slider(3, range=1..100)
number_slider_6 = Slider(34, range=1..100)
tria = TriangularPanelsA(Surface=loft_4, UDivisions=number_slider_5, VDivisions=number_slider_6)
quads = QuadPanels(Surface=loft_4, UDivisions=number_slider_5, VDivisions=number_slider_6)
quadstag = StaggeredQuadPanels(Surface=loft_4, UDivisions=number_slider_5, VDivisions=number_slider_6)
tric = TrianglePanelsC(Surface=loft_4, UDivisions=number_slider_5, VDivisions=number_slider_6)
edges = BrepEdges(Brep=tria)  # -> Naked, Interior, NonManifold
edges_2 = BrepEdges(Brep=quads)  # -> Naked, Interior, NonManifold
edges_3 = BrepEdges(Brep=quadstag)  # -> Naked, Interior, NonManifold
edges_4 = BrepEdges(Brep=tric)  # -> Naked, Interior, NonManifold

number_slider_7 = Slider(34, range=1..100)
number_slider_8 = Slider(3, range=1..100)
tria_2 = TriangularPanelsA(Surface=loft_3, UDivisions=number_slider_7, VDivisions=number_slider_8)
quads_2 = QuadPanels(Surface=loft_3, UDivisions=number_slider_7, VDivisions=number_slider_8)
quadstag_2 = StaggeredQuadPanels(Surface=loft_3, UDivisions=number_slider_7, VDivisions=number_slider_8)
tric_2 = TrianglePanelsC(Surface=loft_3, UDivisions=number_slider_7, VDivisions=number_slider_8)
edges_5 = BrepEdges(Brep=tria_2)  # -> Naked, Interior, NonManifold
edges_6 = BrepEdges(Brep=quads_2)  # -> Naked, Interior, NonManifold
edges_7 = BrepEdges(Brep=quadstag_2)  # -> Naked, Interior, NonManifold
edges_8 = BrepEdges(Brep=tric_2)  # -> Naked, Interior, NonManifold
