# Grasshopper definition Figure5-8_math_mobius_python3.gh (Grasshopper 1.0.9)

# Mobius from Math Formula: Python 3
number_slider = Slider(0.5, range=0.1..100)
# Formula source:
# https://www.pleacher.com/handley/lessons/calc2004/param.html
panel = Panel("-1")
number_slider_2 = Slider(15, range=0..100)
multiplication = Multiplication(A=number_slider, B=panel)
dom = ConstructDomain(DomainStart=multiplication, DomainEnd=number_slider)
range = Range(Domain=dom, Steps=number_slider_2)
range_2 = Range(Domain="0 to 2*pi", Steps=number_slider_2)
crossref = CrossReference(ListA=range_2, ListB=range, CrossMode=1)  # -> ListA, ListB
addition = Addition(A=number_slider_2, B="1")
py3 = Python3Script(s_list=crossref.ListA, t_list=crossref.ListB)  # -> pts; inputs s_list: list of Double, t_list: list of Double
# ---------- py3: Python ----------
__author__ = "isabe"
__version__ = "2026.01.20"

import ghpythonlib.components as ghcps
from math import sin, cos

pts = []
for s, t in zip(s_list, t_list):
    x = cos(s) + t*cos(s/2)*cos(s)
    y = sin(s) + t*cos(s/2)*sin(s)
    z = t*sin(s/2)
    pts.append(ghcps.ConstructPoint(x, y, z))
# ---------- end py3 ----------
series = Series(Start=addition, Step="0", Count=addition)
partition = PartitionList(List=py3, Size=series)  # -> simplify(Chunks)
flip = FlipMatrix(Data=partition)
intcrv = Interpolate(Vertices=flip, Degree=3, Periodic=False, KnotStyle=1)  # -> flatten(Curve), Length, Domain
intcrv_2 = Interpolate(Vertices=partition, Degree=3, Periodic=False, KnotStyle=1)  # -> flatten(Curve), Length, Domain
loft = Loft(Curves=intcrv.Curve, Options={Adjust=False, Closed=False, LoftEnds=0, LoftSimp=0, LoftType=0, Rebuild=10, Refit=0.01})
loft_2 = Loft(Curves=intcrv_2.Curve, Options={Adjust=False, Closed=False, LoftEnds=0, LoftSimp=0, LoftType=0, Rebuild=10, Refit=0.01})
