# Grasshopper definition Figure5-9_5-10_log_shell.gh (Grasshopper 1.0.9)

# ----
# Logarithmic Spiral Shell
number_slider = Slider(10, range=0..10)
number_slider_2 = Slider(200, range=0..1000)
pi = Pi(Factor=number_slider)
division = Division(A=pi, B=number_slider_2)
series = Series(Start=Slider(0, range=0..100), Step=division, Count=number_slider_2)
py3 = Python3Script(b=Slider(0.1, range=0..100), theta=series)  # -> pts, rs; inputs b: Double, theta: list of Double
# ---------- py3: Python ----------
__author__ = "isabel"
__version__ = "2026.01.15"

import ghpythonlib.components as ghcps
from math import e, cos, sin, pow

pts = []
rs = []
for i in range(len(theta)):
    ti = theta[i]
    r = pow(e, b*ti)
    x = r*cos(ti)
    y = r*sin(ti)

    p = ghcps.ConstructPoint(x, y, 0)
    pts.append(p)
    rs.append(r)
# ---------- end py3 ----------
pline = PolyLine(Vertices=py3.pts, Closed=False)
pframes = PerpFrames(Curve=pline, Count=number_slider_2, Align=True)  # -> Frames, Parameters
cir = Circle(Plane=pframes.Frames, Radius=py3.rs)
loft = Loft(Curves=cir, Options={Adjust=False, Closed=False, LoftEnds=0, LoftSimp=0, LoftType=0, Rebuild=10, Refit=0.01})
