# Grasshopper definition Figure6-10_stacking_along_curve_variations.gh (Grasshopper 1.0.9)

range = Range(Domain=Domain(0, 1), Steps=10)
# Stacking Random Blocks Along a Curve - Bezier
graph = GraphMapper(range, x0=0, x1=1, y0=0, y1=1, container_name="Bezier", cpx=[0, 0.3028320372, 0.6427013278, 1], cpy=[0, 1, 0, 1])
dom = ConstructDomain(DomainStart=0, DomainEnd=Slider(26.83, range=1..100))
# 1
remap = RemapNumbers(Value=graph, Source=Domain(0, 1), Target=dom)  # -> Mapped, Clipped
remap_2 = RemapNumbers(Value=range, Source=Domain(0, 1), Target=dom)  # -> Mapped, Clipped
pt = ConstructPoint(XCoordinate=remap_2.Mapped, YCoordinate=0, ZCoordinate=remap.Mapped)
intcrv = Interpolate(Vertices=pt, Degree=3, Periodic=False, KnotStyle=1)  # -> Curve, Length, Domain

dom_2 = ConstructDomain(DomainStart=Slider(4.28, range=1..100), DomainEnd=Slider(10, range=1..100))
random = Random(Range=dom_2, Number=Slider(15, range=1..100), Seed=Slider(11, range=1..100))
ma = MassAddition(Input=random)  # -> Result, PartialResults
# 2
division = Division(A=random, B=ma.Result)
py3 = Python3Script(ts=division)  # -> sums; inputs ts: list of Double
# ---------- py3: Python ----------
__author__ = "isabel"
__version__ = "2026.02.02"

num_items = len(ts)
sums = []
for i in range(1, num_items+1):
    sums.append(sum(ts[:i]))
# ---------- end py3 ----------
eval = EvaluateLength(Curve=intcrv.Curve, Length=py3, Normalized=True)  # -> Point, Tangent, Parameter
shatter = Shatter(Curve=intcrv.Curve, Parameters=eval.Parameter)

range_2 = Range(Domain=Domain(0, 1), Steps=10)
# Stacking Random Blocks Along a Curve - Sine Summation
graph_2 = GraphMapper(
    range_2,
    x0=0,
    x1=1,
    y0=0,
    y1=1,
    container_name="Sine Summation",
    Equation0_px=[0.2, 0.2930979729],
    Equation0_py=[0.2, 0.2898320556],
    Equation1_px=[0.6252838969, 0.8902416825],
    Equation1_py=[0.1158306003, 0.3995290399])
dom_3 = ConstructDomain(DomainStart=0, DomainEnd=Slider(37.9, range=1..100))
# 1
remap_3 = RemapNumbers(Value=graph_2, Source=Domain(0, 1), Target=dom_3)  # -> Mapped, Clipped
remap_4 = RemapNumbers(Value=range_2, Source=Domain(0, 1), Target=dom_3)  # -> Mapped, Clipped
pt_2 = ConstructPoint(XCoordinate=remap_4.Mapped, YCoordinate=0, ZCoordinate=remap_3.Mapped)
intcrv_2 = Interpolate(Vertices=pt_2, Degree=3, Periodic=False, KnotStyle=1)  # -> Curve, Length, Domain

dom_4 = ConstructDomain(DomainStart=Slider(4.28, range=1..100), DomainEnd=Slider(10, range=1..100))
random_2 = Random(Range=dom_4, Number=Slider(21, range=1..100), Seed=Slider(16, range=1..100))
ma_2 = MassAddition(Input=random_2)  # -> Result, PartialResults
# 2
division_2 = Division(A=random_2, B=ma_2.Result)
py3_2 = Python3Script(ts=division_2)  # -> sums; inputs ts: list of Double; same code as py3
eval_2 = EvaluateLength(Curve=intcrv_2.Curve, Length=py3_2, Normalized=True)  # -> Point, Tangent, Parameter
shatter_2 = Shatter(Curve=intcrv_2.Curve, Parameters=eval_2.Parameter)

range_3 = Range(Domain=Domain(0, 1), Steps=10)
# Stacking Random Blocks Along a Curve - Power
graph_3 = GraphMapper(range_3, x0=0, x1=1, y0=0, y1=1, Gx=0.7927805781, Gy=0.6031547189, container_name="Power", power=2.177271258)
dom_5 = ConstructDomain(DomainStart=0, DomainEnd=Slider(22.88, range=1..100))
# 1
remap_5 = RemapNumbers(Value=graph_3, Source=Domain(0, 1), Target=dom_5)  # -> Mapped, Clipped
remap_6 = RemapNumbers(Value=range_3, Source=Domain(0, 1), Target=dom_5)  # -> Mapped, Clipped
pt_3 = ConstructPoint(XCoordinate=remap_6.Mapped, YCoordinate=0, ZCoordinate=remap_5.Mapped)
intcrv_3 = Interpolate(Vertices=pt_3, Degree=3, Periodic=False, KnotStyle=1)  # -> Curve, Length, Domain

dom_6 = ConstructDomain(DomainStart=Slider(4.28, range=1..100), DomainEnd=Slider(10, range=1..100))
random_3 = Random(Range=dom_6, Number=Slider(16, range=1..100), Seed=Slider(16, range=1..100))
ma_3 = MassAddition(Input=random_3)  # -> Result, PartialResults
# 2
division_3 = Division(A=random_3, B=ma_3.Result)
py3_3 = Python3Script(ts=division_3)  # -> sums; inputs ts: list of Double; same code as py3
eval_3 = EvaluateLength(Curve=intcrv_3.Curve, Length=py3_3, Normalized=True)  # -> Point, Tangent, Parameter
shatter_3 = Shatter(Curve=intcrv_3.Curve, Parameters=eval_3.Parameter)

end = EndPoints(Curve=shatter_2)  # -> Start, End
lng = ListLength(List=shatter_2)
xy = XYPlane(Origin=end.Start)
py3_4 = Python3Script(ds=Slider(3, range=1..20), dn=Slider(1, range=1..20), N=lng, seed=Slider(4, range=1..10))  # -> D; inputs ds: Double, dn: Double, N: Int32, seed: Int32
# ---------- py3_4: Python ----------
__author__ = "isabel"
__version__ = "2026.02.02"

import ghpythonlib.components as ghcps

ran_range = ghcps.ConstructDomain(ds, dn)
ran_numbers = ghcps.Random(ran_range, N, seed)
D = ghcps.ConstructDomain(ghcps.Negative(ran_numbers), ran_numbers)
# ---------- end py3_4 ----------
py3_5 = Python3Script(ds=Slider(9, range=1..20), dn=Slider(4, range=1..20), N=lng, seed=Slider(2, range=1..10))  # -> D; inputs ds: Double, dn: Double, N: Int32, seed: Int32; same code as py3_4
# 3
rectangle = Rectangle(Plane=xy, XSize=py3_4, YSize=py3_5, Radius=0)  # -> Rectangle, Length

end_2 = EndPoints(Curve=shatter)  # -> Start, End
lng_2 = ListLength(List=shatter)
xy_2 = XYPlane(Origin=end_2.Start)
py3_6 = Python3Script(ds=Slider(6, range=1..20), dn=Slider(2, range=1..20), N=lng_2, seed=Slider(2, range=1..10))  # -> D; inputs ds: Double, dn: Double, N: Int32, seed: Int32; same code as py3_4
py3_7 = Python3Script(ds=Slider(9, range=1..20), dn=Slider(15, range=1..20), N=lng_2, seed=Slider(5, range=1..10))  # -> D; inputs ds: Double, dn: Double, N: Int32, seed: Int32; same code as py3_4
# 3
rectangle_2 = Rectangle(Plane=xy_2, XSize=py3_6, YSize=py3_7, Radius=0)  # -> Rectangle, Length

end_3 = EndPoints(Curve=shatter_3)  # -> Start, End
lng_3 = ListLength(List=shatter_3)
xy_3 = XYPlane(Origin=end_3.Start)
py3_8 = Python3Script(ds=Slider(2, range=1..20), dn=Slider(1, range=1..20), N=lng_3, seed=Slider(4, range=1..10))  # -> D; inputs ds: Double, dn: Double, N: Int32, seed: Int32; same code as py3_4
py3_9 = Python3Script(ds=Slider(8, range=1..20), dn=Slider(3, range=1..20), N=lng_3, seed=Slider(3, range=1..10))  # -> D; inputs ds: Double, dn: Double, N: Int32, seed: Int32; same code as py3_4
# 3
rectangle_3 = Rectangle(Plane=xy_3, XSize=py3_8, YSize=py3_9, Radius=0)  # -> Rectangle, Length

subtraction = Subtraction(A=end.End, B=end.Start)
pdecon = Deconstruct(Point=subtraction)  # -> XComponent, YComponent, ZComponent
# 4
Z = UnitZ(Factor=pdecon.ZComponent)
boundary = BoundarySurfaces(Edges=rectangle.Rectangle)
extr = Extrude(Base=boundary, Direction=Z)

subtraction_2 = Subtraction(A=end_2.End, B=end_2.Start)
pdecon_2 = Deconstruct(Point=subtraction_2)  # -> XComponent, YComponent, ZComponent
# 4
Z_2 = UnitZ(Factor=pdecon_2.ZComponent)
boundary_2 = BoundarySurfaces(Edges=rectangle_2.Rectangle)
extr_2 = Extrude(Base=boundary_2, Direction=Z_2)

subtraction_3 = Subtraction(A=end_3.End, B=end_3.Start)
pdecon_3 = Deconstruct(Point=subtraction_3)  # -> XComponent, YComponent, ZComponent
# 4
Z_3 = UnitZ(Factor=pdecon_3.ZComponent)
boundary_3 = BoundarySurfaces(Edges=rectangle_3.Rectangle)
extr_3 = Extrude(Base=boundary_3, Direction=Z_3)

X = UnitX(Factor=Slider(35, range=0..100))
move = Move(Geometry=extr, Motion=X)  # -> Geometry, Transform
X_2 = UnitX(Factor=Slider(-27, range=-100..0))
move_2 = Move(Geometry=extr_2, Motion=X_2)  # -> Geometry, Transform
geo = Geometry([move_2.Geometry, extr_3, move.Geometry])
