# Grasshopper definition Figure6-11_6-13_stacking_in_volume.gh (Grasshopper 1.0.9)

# ----
# Stacking Random Blocks in a Volume
number_slider = Slider(50, range=1..100)
Z = UnitZ(Factor=number_slider)
box = CenterBox(Base=PlaneXY(0, 0, 0), X=number_slider, Y=number_slider, Z=number_slider)
move = Move(Geometry=box, Motion=Z)  # -> Geometry, Transform
pop3d = Populate3D(Region=move.Geometry, Count=Slider(100, range=1..200), Seed=1)

lng = ListLength(List=pop3d)
py3 = Python3Script(ds=Slider(6, range=1..20), dn=Slider(15, range=1..20), N=lng, seed=Slider(2, range=1..10))  # -> D; inputs ds: Double, dn: Double, N: Int32, seed: Int32
# ---------- py3: Python ----------
__author__ = "isabel"
__version__ = "2026.02.02"

import ghpythonlib.components as ghcps

ran_range = ghcps.ConstructDomain(ds, dn)
ran_numbers = ghcps.Random(ran_range, N, seed)
D = ghcps.ConstructDomain(ghcps.Negative(ran_numbers), ran_numbers)
# ---------- end py3 ----------
py3_2 = Python3Script(ds=Slider(6, range=1..20), dn=Slider(15, range=1..20), N=lng, seed=Slider(3, range=1..10))  # -> D; inputs ds: Double, dn: Double, N: Int32, seed: Int32; same code as py3
py3_3 = Python3Script(ds=Slider(6, range=1..20), dn=Slider(12, range=1..20), N=lng, seed=Slider(4, range=1..10))  # -> D; inputs ds: Double, dn: Double, N: Int32, seed: Int32; same code as py3
rectangle = Rectangle(Plane=pop3d, XSize=py3, YSize=py3_2, Radius=0)  # -> Rectangle, Length
boxrec = BoxRectangle(Rectangle=rectangle.Rectangle, Height=py3_3)

project = Project(Geometry=pop3d, Plane=PlaneXY(0, 0, 0))  # -> Geometry, Transform
ln = Line(StartPoint=pop3d, EndPoint=project.Geometry)
pipe = Pipe(Curve=ln, Radius=Slider(1.41, range=1..10), Caps="0", FitRail=False)
geo = Geometry([pipe, boxrec])
