# Grasshopper definition Figure6-14_6-16_voxelizing_divided_surface.gh (Grasshopper 1.0.9)

# ----
# Stacking on Divided Surface - Sphere
Z = Slider(50, range=1..100)
pt = ConstructPoint(XCoordinate=0, YCoordinate=0, ZCoordinate=Z)
# 1
number_slider = Slider(13, range=1..200)
xy = XYPlane(Origin=pt)
sph = Sphere(Base=xy, Radius=Z)
sdivide = DivideSurface(Surface=sph, UCount=Slider(15, range=1..200), VCount=number_slider)  # -> Points, Normals, Parameters

# ----
# Stacking on Divided Surface - Cylinder
number_slider_2 = Slider(39, range=1..100)
# 1
number_slider_3 = Slider(13, range=1..200)
cyl = Cylinder(Base=PlaneXY(0, 0, 0), Radius=number_slider_2, Length=Slider(93, range=1..100))
sdivide_2 = DivideSurface(Surface=cyl, UCount=Slider(13, range=1..200), VCount=number_slider_3)  # -> Points, Normals, Parameters

lng = ListLength(List=sdivide_2.Points)
# 2
py3 = Python3Script(ds=Slider(6, range=1..20), dn=Slider(15, range=1..20), N=lng, seed=Slider(2, range=1..10))  # -> D; inputs ds: Double, dn: Double, N: Int32, seed: Int32
# ---------- py3: Python ----------
__author__ = "isabel"
__version__ = "2026.02.02"

import ghpythonlib.components as ghcps

ran_range = ghcps.ConstructDomain(ds, dn)
ran_numbers = ghcps.Random(ran_range, N, seed)
D = ghcps.ConstructDomain(ghcps.Negative(ran_numbers), ran_numbers)
# ---------- end py3 ----------
py3_2 = Python3Script(ds=Slider(6, range=1..20), dn=Slider(15, range=1..20), N=lng, seed=Slider(3, range=1..10))  # -> D; inputs ds: Double, dn: Double, N: Int32, seed: Int32; same code as py3
py3_3 = Python3Script(ds=Slider(6, range=1..20), dn=Slider(12, range=1..20), N=lng, seed=Slider(4, range=1..10))  # -> D; inputs ds: Double, dn: Double, N: Int32, seed: Int32; same code as py3
rectangle = Rectangle(Plane=sdivide_2.Points, XSize=py3, YSize=py3_2, Radius=0)  # -> Rectangle, Length
boxrec = BoxRectangle(Rectangle=rectangle.Rectangle, Height=py3_3)

lng_2 = ListLength(List=sdivide.Points)
# 2
py3_4 = Python3Script(ds=Slider(6, range=1..20), dn=Slider(15, range=1..20), N=lng_2, seed=Slider(2, range=1..10))  # -> D; inputs ds: Double, dn: Double, N: Int32, seed: Int32; same code as py3
py3_5 = Python3Script(ds=Slider(6, range=1..20), dn=Slider(15, range=1..20), N=lng_2, seed=Slider(3, range=1..10))  # -> D; inputs ds: Double, dn: Double, N: Int32, seed: Int32; same code as py3
py3_6 = Python3Script(ds=Slider(6, range=1..20), dn=Slider(12, range=1..20), N=lng_2, seed=Slider(4, range=1..10))  # -> D; inputs ds: Double, dn: Double, N: Int32, seed: Int32; same code as py3
rectangle_2 = Rectangle(Plane=sdivide.Points, XSize=py3_4, YSize=py3_5, Radius=0)  # -> Rectangle, Length
boxrec_2 = BoxRectangle(Rectangle=rectangle_2.Rectangle, Height=py3_6)
