# Grasshopper definition Figure6-17_to_6-19_voronoi_voxelizer.gh (Grasshopper 1.0.9)

# ----
# 1c
qrsettings = QuadRemeshSettings(TargetCount=1000, AdaptiveSize=0, AdaptiveCount=False, HardEdges=False, SeamEdges=0, Symmetry=0, GuideCurves=0)
# Voronoi Cell Voxelizer - Bubbles
# 1a
mesh = Mesh(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)
# 1b
# 1
qrmesh = QuadRemesh(Geometry=mesh, Settings=qrsettings)
# 1d
subdmesh = SubDFromMesh(Mesh=qrmesh, Creases=1, Corners=1, Interpolate=False)

# ----
# 1c
qrsettings_2 = QuadRemeshSettings(TargetCount=1000, AdaptiveSize=0, AdaptiveCount=False, HardEdges=False, SeamEdges=0, Symmetry=0, GuideCurves=0)
# Voronoi Cell Voxelizer - Cubes
# 1a
mesh_2 = Mesh(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)
# 1b
# 1
qrmesh_2 = QuadRemesh(Geometry=mesh_2, Settings=qrsettings_2)
# 1d
subdmesh_2 = SubDFromMesh(Mesh=qrmesh_2, Creases=1, Corners=1, Interpolate=False)

# ----
# 2a
bbox = BoundingBox(Content=subdmesh, Plane=PlaneXY(0, 0, 0))  # -> Box, Box_2
# 2b
boxprop = BoxProperties(Box=bbox.Box)  # -> Center, Diagonal, Area, Volume, Degeneracy
# 2
panel = Panel("1.1")
# 2c
scale = Scale(Geometry=bbox.Box, Center=boxprop.Center, Factor=panel)  # -> Geometry, Transform

# ----
# 2a
bbox_2 = BoundingBox(Content=subdmesh_2, Plane=PlaneXY(0, 0, 0))  # -> Box, Box_2
# 2b
boxprop_2 = BoxProperties(Box=bbox_2.Box)  # -> Center, Diagonal, Area, Volume, Degeneracy
# 2
panel_2 = Panel("1.1")
# 2c
scale_2 = Scale(Geometry=bbox_2.Box, Center=boxprop_2.Center, Factor=panel_2)  # -> Geometry, Transform

# ----
# 3a
# 3
pop3d = Populate3D(Region=scale.Geometry, Count=Slider(300, range=0..2000), Seed=Slider(46, range=0..100))
# 3b
voronoi³ = Voronoi3D(Points=pop3d, Box=scale.Geometry)  # -> Cells, Boundary

# ----
# 3a
# 3
pop3d_2 = Populate3D(Region=scale_2.Geometry, Count=Slider(300, range=0..2000), Seed=Slider(46, range=0..100))
# 3b
voronoi³_2 = Voronoi3D(Points=pop3d_2, Box=scale_2.Geometry)  # -> Cells, Boundary

# ----
# 4a
sint = SolidIntersection(BrepsA=subdmesh, BrepsB=voronoi³.Cells)
# 4
# 4b
bbox_3 = BoundingBox(Content=sint, Plane=PlaneXY(0, 0, 0))  # -> Box, Box_2
# 4c
area = Area(Geometry=bbox_3.Box)  # -> Area, Centroid
# 4d
sph = Sphere(Base=area.Centroid, Radius=Slider(9, range=1.1..100.5))

# ----
# 4a
sint_2 = SolidIntersection(BrepsA=subdmesh_2, BrepsB=voronoi³_2.Cells)
number_slider = Slider(8.9, range=1.1..100.5)
# 4
# 4b
bbox_4 = BoundingBox(Content=sint_2, Plane=PlaneXY(0, 0, 0))  # -> Box, Box_2
# 4c
area_2 = Area(Geometry=bbox_4.Box)  # -> Area, Centroid
# 4d
box = CenterBox(Base=area_2.Centroid, X=number_slider, Y=number_slider, Z=number_slider)
