# Grasshopper definition Figure6-1_6-2_stacking_column_scale.gh (Grasshopper 1.0.9)

# ----
# Stacking Column with Scaling
pt = ConstructPoint(XCoordinate=0, YCoordinate=0, ZCoordinate=0)
Z = UnitZ(Factor=1)
line = LineSDL(Start=pt, Direction=Z, Length=Slider(27.75, range=1..100))
number_slider = Slider(6, range=1..50)
# 1
end = EndPoints(Curve=line)  # -> Start, End
pline = PolyLine(Vertices=[end.Start, end.End], Closed=False)
divide = DivideCurve(Curve=pline, Count=number_slider, Kinks=False)  # -> Points, Tangents, Parameters
cull_i = CullIndex(List=divide.Points, Indices=number_slider, Wrap=True)

# ----
# 2
number_slider_2 = Slider(0.25, range=0.25..1)
dom = ConstructDomain(DomainStart=Slider(1, range=0.1..1), DomainEnd=number_slider_2)
subtraction = Subtraction(A=number_slider, B="1")
range = Range(Domain=dom, Steps=subtraction)

len = Length(Curve=pline)
polygon = Polygon(Plane=cull_i, Radius=Slider(10, range=1..100), Segments=Slider(4, range=3..20), FilletRadius=0)  # -> Polygon, Length
division = Division(A=len, B=number_slider)
boundary = BoundarySurfaces(Edges=polygon.Polygon)
Z_2 = UnitZ(Factor=division)
# 3
extr = Extrude(Base=boundary, Direction=Z_2)
scale_nu = ScaleNU(Geometry=extr, Plane=PlaneXY(0, 0, 0), ScaleX=range, ScaleY=range, ScaleZ=1)  # -> Geometry, Transform
