# Grasshopper definition Figure6-3_6-4_stacking_column_rotation.gh (Grasshopper 1.0.9)

# ----
# Stacking Column with Rotation
pt = ConstructPoint(XCoordinate=0, YCoordinate=0, ZCoordinate=0)
Z = UnitZ(Factor=1)
line = LineSDL(Start=pt, Direction=Z, Length=Slider(27.75, range=1..100))
# 2
number_slider = Slider(6, range=1..50)
# 1
end = EndPoints(Curve=line)  # -> Start, End
pline = PolyLine(Vertices=[end.Start, end.End], Closed=False)
divide = DivideCurve(Curve=pline, Count=number_slider, Kinks=False)  # -> Points, Tangents, Parameters
cull_i = CullIndex(List=divide.Points, Indices=number_slider, Wrap=True)

dom = ConstructDomain(DomainStart=Slider(1, range=0.1..1), DomainEnd=Slider(0.25, range=0.25..1))
subtraction = Subtraction(A=number_slider, B="1")
# 2a
range = Range(Domain=dom, Steps=subtraction)
# 2c
pi = Pi(Factor=1)
# 2d
multiplication = Multiplication(A=pi, B=range)

len = Length(Curve=pline)
division = Division(A=len, B=number_slider)
polygon = Polygon(Plane=cull_i, Radius=Slider(10, range=1..100), Segments=Slider(4, range=3..20), FilletRadius=0)  # -> Polygon, Length
boundary = BoundarySurfaces(Edges=polygon.Polygon)
Z_2 = UnitZ(Factor=division)
# 3
# 3c
extr = Extrude(Base=boundary, Direction=Z_2)
# 3f
rotate = Rotate(Geometry=extr, Angle=multiplication, Plane=PlaneXY(0, 0, 0))  # -> Geometry, Transform
