# Grasshopper definition Figure6-5_6-7_stacking_column_taper_and_shifts.gh (Grasshopper 1.0.9)

# ----
# Stacking a Column with Tapering and Horizontal Offsets
pt = ConstructPoint(XCoordinate=0, YCoordinate=0, ZCoordinate=0)
Z = UnitZ(Factor=1)
# 1
line = LineSDL(Start=pt, Direction=Z, Length=Slider(27.75, range=1..100))
end = EndPoints(Curve=line)  # -> Start, End
pline = PolyLine(Vertices=[end.Start, end.End], Closed=False)

dom = ConstructDomain(DomainStart=Slider(4.28, range=1..100), DomainEnd=Slider(13.36, range=1..100))
random = Random(Range=dom, Number=Slider(13, range=1..100), Seed=Slider(9, range=1..100))
ma = MassAddition(Input=random)  # -> Result, PartialResults
# 2
division = Division(A=random, B=ma.Result)
py3 = Python3Script(ts=division)  # -> sums; inputs ts: list of Double
# ---------- py3: Python ----------
__author__ = "isabel"
__version__ = "2026.02.02"

num_items = len(ts)
sums = []
for i in range(1, num_items+1):
    sums.append(sum(ts[:i]))
# ---------- end py3 ----------
eval = EvaluateLength(Curve=pline, Length=py3, Normalized=True)  # -> Point, Tangent, Parameter
shatter = Shatter(Curve=pline, Parameters=eval.Parameter)

end_2 = EndPoints(Curve=shatter)  # -> Start, End
number_slider = Slider(10, range=1..100)
subtraction = Subtraction(A=end_2.End, B=end_2.Start)
xy = XYPlane(Origin=end_2.Start)
pdecon = Deconstruct(Point=subtraction)  # -> XComponent, YComponent, ZComponent
polygon = Polygon(Plane=xy, Radius=number_slider, Segments=Slider(4, range=3..20), FilletRadius=0)  # -> Polygon, Length
# 3
Z_2 = UnitZ(Factor=pdecon.ZComponent)
boundary = BoundarySurfaces(Edges=polygon.Polygon)
extr = Extrude(Base=boundary, Direction=Z_2)

multiplication = Multiplication(A=number_slider, B=Slider(0.25, range=0.01..1))
# 4
taper = Taper(Geometry=extr, Axis=line, Start=number_slider, End=multiplication, Flat=False, Infinite=False, Rigid=False)

py3_2 = Python3Script(boxes=taper, ds=Slider(0.25, range=0.25..0.5), dn=Slider(0.5, range=0.25..0.5))  # -> V; inputs boxes: list of Box, ds: Double, dn: Double
# ---------- py3_2: Python ----------
__author__ = "isabel"
__version__ = "2026.02.03"

import ghpythonlib.components as ghcps
from random import randint, uniform

V = []
for b in boxes:
    ca, cb, cc, cd, _, _, _, _ = ghcps.BoxCorners(b)
    c = [ca, cb, cc, cd][randint(0, 3)]
    b_center, _, _, _, _ = ghcps.BoxProperties(b)
    raw_v, _ = ghcps.Vector2Pt(b_center, c, False)
    x, y, _ = ghcps.Deconstruct(raw_v)
    scale = uniform(ds, dn)
    v_zero_z, _ = ghcps.VectorXYZ(x*scale, y*scale, 0)
    V.append(v_zero_z)
# ---------- end py3_2 ----------
# 5
boxprop = BoxProperties(Box=taper)  # -> Center, Diagonal, Area, Volume, Degeneracy
vdisex = VectorDisplayEx(Point=boxprop.Center, Vector=py3_2, Colour=RGB(0, 0, 0), Width=2)
move = Move(Geometry=taper, Motion=py3_2)  # -> Geometry, Transform
