# Grasshopper definition Figure6-8_6-9_stacking_along_curve_sine.gh (Grasshopper 1.0.9)

range = Range(Domain=Domain(0, 1), Steps=10)
# Stacking Random Blocks
# Along a Curve - Sine Wave
graph = GraphMapper(range, x0=0, x1=1, y0=0, y1=1, container_name="Sine", Equation_px=[0, 0.4624814093], Equation_py=[0, 0.7299264669])
dom = ConstructDomain(DomainStart=0, DomainEnd=Slider(22.88, range=1..100))
# 1
remap = RemapNumbers(Value=graph, Source=Domain(0, 1), Target=dom)  # -> Mapped, Clipped
remap_2 = RemapNumbers(Value=range, Source=Domain(0, 1), Target=dom)  # -> Mapped, Clipped
pt = ConstructPoint(XCoordinate=remap_2.Mapped, YCoordinate=0, ZCoordinate=remap.Mapped)
intcrv = Interpolate(Vertices=pt, Degree=3, Periodic=False, KnotStyle=1)  # -> Curve, Length, Domain

dom_2 = ConstructDomain(DomainStart=Slider(4.28, range=1..100), DomainEnd=Slider(10, range=1..100))
random = Random(Range=dom_2, Number=Slider(16, range=1..100), Seed=Slider(16, range=1..100))
ma = MassAddition(Input=random)  # -> Result, PartialResults
# 2
division = Division(A=random, B=ma.Result)
py3 = Python3Script(ts=division)  # -> sums; inputs ts: list of Double
# ---------- py3: Python ----------
__author__ = "isabel"
__version__ = "2026.02.02"

num_items = len(ts)
sums = []
for i in range(1, num_items+1):
    sums.append(sum(ts[:i]))
# ---------- end py3 ----------
eval = EvaluateLength(Curve=intcrv.Curve, Length=py3, Normalized=True)  # -> Point, Tangent, Parameter
shatter = Shatter(Curve=intcrv.Curve, Parameters=eval.Parameter)

end = EndPoints(Curve=shatter)  # -> Start, End
lng = ListLength(List=shatter)
xy = XYPlane(Origin=end.Start)
py3_2 = Python3Script(ds=Slider(2, range=1..20), dn=Slider(1, range=1..20), N=lng, seed=Slider(4, range=1..10))  # -> D; inputs ds: Double, dn: Double, N: Int32, seed: Int32
# ---------- py3_2: Python ----------
__author__ = "isabel"
__version__ = "2026.02.02"

import ghpythonlib.components as ghcps

ran_range = ghcps.ConstructDomain(ds, dn)
ran_numbers = ghcps.Random(ran_range, N, seed)
D = ghcps.ConstructDomain(ghcps.Negative(ran_numbers), ran_numbers)
# ---------- end py3_2 ----------
py3_3 = Python3Script(ds=Slider(8, range=1..20), dn=Slider(3, range=1..20), N=lng, seed=Slider(3, range=1..10))  # -> D; inputs ds: Double, dn: Double, N: Int32, seed: Int32; same code as py3_2
# 3
rectangle = Rectangle(Plane=xy, XSize=py3_2, YSize=py3_3, Radius=0)  # -> Rectangle, Length

subtraction = Subtraction(A=end.End, B=end.Start)
pdecon = Deconstruct(Point=subtraction)  # -> XComponent, YComponent, ZComponent
# 4
Z = UnitZ(Factor=pdecon.ZComponent)
boundary = BoundarySurfaces(Edges=rectangle.Rectangle)
extr = Extrude(Base=boundary, Direction=Z)
