# Grasshopper definition Figure7-10_7-11_wireframe_cracks_cube.gh (Grasshopper 1.0.9)

# ----
# Voronoi Cracks Wireframe - Cube
number_slider = Slider(25, range=0..100)
# 1a
box = CenterBox(Base=PlaneXY(0, 0, 0), X=number_slider, Y=number_slider, Z=number_slider)
# 1b
# 1
pop3d = Populate3D(Region=box, Count=Slider(100, range=1..2000), Seed=1)
# 1c
voronoi³ = Voronoi3D(Points=pop3d, Box=box)  # -> Cells, Boundary

# ----
# 2a
edges = BrepEdges(Brep=voronoi³.Cells)  # -> Naked, Interior, NonManifold
# 2
# 2b
mp = MultiPipe(
    Curves=edges.Interior,
    NodeSize=Slider(0.46, range=0.1..2),
    EndOffset=1,
    StrutSize=1,
    Segment=0,
    KinkAngle=0.6,
    CubeFit=0,
    Caps=0)
