# Grasshopper definition Figure7-12_7-13_wireframe_cracks_sphere.gh (Grasshopper 1.0.9)

# ----
# Voronoi Cracks Wireframe - Sphere
number_slider = Slider(25, range=0..100)
# 1a
box = CenterBox(Base=PlaneXY(0, 0, 0), X=number_slider, Y=number_slider, Z=number_slider)
# 1b
# 1
pop3d = Populate3D(Region=box, Count=Slider(100, range=1..2000), Seed=1)
# 1c
voronoi³ = Voronoi3D(Points=pop3d, Box=box)  # -> Cells, Boundary

# ----
# 2a
sph = Sphere(Base=PlaneXY(0, 0, 0), Radius=number_slider)
# 2b
# 2
bbx = BrepBrep(BrepA=voronoi³.Cells, BrepB=sph)  # -> Curves, Points
# 2c
mp = MultiPipe(
    Curves=bbx.Curves,
    NodeSize=Slider(0.36, range=0.1..2),
    EndOffset=1,
    StrutSize=1,
    Segment=0,
    KinkAngle=0.6,
    CubeFit=0,
    Caps=0)
