# Grasshopper definition Figure7-14_to_7-16_cracks_cube_explosion.gh (Grasshopper 1.0.9)

# ----
# Voronoi Cracks - Cube, Exploded
# 1
number_slider = Slider(25, range=0..100)
# 1a
box = CenterBox(Base=PlaneXY(0, 0, 0), X=number_slider, Y=number_slider, Z=number_slider)
# 1b
pop3d = Populate3D(Region=box, Count=Slider(100, range=1..2000), Seed=1)
# 1c
voronoi³ = Voronoi3D(Points=pop3d, Box=box)  # -> Cells, Boundary

# ----
# 2a
boxprop = BoxProperties(Box=box)  # -> Center, Diagonal, Area, Volume, Degeneracy
# 2b
bbox = BoundingBox(Content=voronoi³.Cells, Plane=PlaneXY(0, 0, 0))  # -> Box, Box_2
# 2c
boxprop_2 = BoxProperties(Box=bbox.Box)  # -> Center, Diagonal, Area, Volume, Degeneracy
# 2d
vec2pt = Vector2Pt(PointA=boxprop.Center, PointB=boxprop_2.Center, Unitize="True")  # -> Vector, Length
# 2e
# 2
multiplication = Multiplication(A=vec2pt.Vector, B=Slider(8.5, range=1..100))
# 2f
move = Move(Geometry=voronoi³.Cells, Motion=multiplication)  # -> Geometry, Transform
# 2g
sint = SolidIntersection(BrepsA=move.Geometry, BrepsB=box)
