# Grasshopper definition Figure7-17_7-18_cracks_sphere_explosion.gh (Grasshopper 1.0.9)

# ----
# Voronoi Cracks - Sphere, Exploded
# 1
number_slider = Slider(25, range=0..100)
# 1a
box = CenterBox(Base=PlaneXY(0, 0, 0), X=number_slider, Y=number_slider, Z=number_slider)
# 1b
pop3d = Populate3D(Region=box, Count=Slider(100, range=1..2000), Seed=1)
# 1c
voronoi³ = Voronoi3D(Points=pop3d, Box=box)  # -> Cells, Boundary

# ----
# 3a
# 3
sph = Sphere(Base=PlaneXY(0, 0, 0), Radius=number_slider)
# 3b
sint = SolidIntersection(BrepsA=sph, BrepsB=voronoi³.Cells)

# ----
# 2a
boxprop = BoxProperties(Box=box)  # -> Center, Diagonal, Area, Volume, Degeneracy
# 2b
bbox = BoundingBox(Content=sint, Plane=PlaneXY(0, 0, 0))  # -> Box, Box_2
# 2c
boxprop_2 = BoxProperties(Box=bbox.Box)  # -> Center, Diagonal, Area, Volume, Degeneracy
# 2d
vec2pt = Vector2Pt(PointA=boxprop.Center, PointB=boxprop_2.Center, Unitize="True")  # -> Vector, Length
# 2e
# 2
multiplication = Multiplication(A=vec2pt.Vector, B=Slider(6.33, range=1..100))
# 2f
move = Move(Geometry=sint, Motion=multiplication)  # -> Geometry, Transform
# 2g
sint_2 = SolidIntersection(BrepsA=move.Geometry, BrepsB=sph)
