# Grasshopper definition Figure7-19_to_7-21_cracks_voronoi_input_mesh.gh (Grasshopper 1.0.9)

# ----
# 0c
# 0
qrsettings = QuadRemeshSettings(TargetCount=1000, AdaptiveSize=0, AdaptiveCount=False, HardEdges=False, SeamEdges=0, Symmetry=0, GuideCurves=0)
# 0a
mesh = Mesh(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)
# 0b
qrmesh = QuadRemesh(Geometry=mesh, Settings=qrsettings)
# 0d
subdmesh = SubDFromMesh(Mesh=qrmesh, Creases=1, Corners=1, Interpolate=False)
# Cracking & Exploding a Mesh
# 0e
bbox = BoundingBox(Content=subdmesh, Plane=PlaneXY(0, 0, 0))  # -> Box, Box_2
# 0f
boxprop = BoxProperties(Box=bbox.Box)  # -> Center, Diagonal, Area, Volume, Degeneracy
# 0g
scale = Scale(Geometry=bbox.Box, Center=boxprop.Center, Factor="1.1")  # -> Geometry, Transform

# ----
# 1
number_slider = Slider(46, range=0..100)
# 1b
pop3d = Populate3D(Region=scale.Geometry, Count=Slider(300, range=1..2000), Seed=number_slider)
# 1c
voronoi³ = Voronoi3D(Points=pop3d, Box=scale.Geometry)  # -> Cells, Boundary
# 1d
sint = SolidIntersection(BrepsA=subdmesh, BrepsB=voronoi³.Cells)

# ----
# 2a
boxprop_2 = BoxProperties(Box=scale.Geometry)  # -> Center, Diagonal, Area, Volume, Degeneracy
# 2b
bbox_2 = BoundingBox(Content=sint, Plane=PlaneXY(0, 0, 0))  # -> Box, Box_2
# 2c
boxprop_3 = BoxProperties(Box=bbox_2.Box)  # -> Center, Diagonal, Area, Volume, Degeneracy
# 2d
vec2pt = Vector2Pt(PointA=boxprop_2.Center, PointB=boxprop_3.Center, Unitize="True")  # -> Vector, Length
# 2e
# 2
multiplication = Multiplication(A=vec2pt.Vector, B=Slider(7.6, range=1..100))
# 2f
move = Move(Geometry=sint, Motion=multiplication)  # -> Geometry, Transform
# 2g
sint_2 = SolidIntersection(BrepsA=subdmesh, BrepsB=move.Geometry)
