# Grasshopper definition Figure7-1_7-2_wireframe_LunchBox_star_dome.gh (Grasshopper 1.0.9)
# plug-ins: LunchBox

# ----
# Wireframe LunchBox Star Dome
# 1f
# 1a
# 1e
# 1b
# 1d
# 1c
dome_radius = Slider(9.57, range=1..15)
neg = Negative(Value=dome_radius)
Z = UnitZ(Factor=neg)
dom = ConstructDomain(DomainStart=neg, DomainEnd=dome_radius)
# 1
rectangle = Rectangle(Plane=PlaneXY(0, 0, 0), XSize=dom, YSize=dom, Radius=0)  # -> Rectangle, Length
boundary = BoundarySurfaces(Edges=rectangle.Rectangle)
extr = Extrude(Base=boundary, Direction=Z)

# ----
# 2a
sph = Sphere(Base=PlaneXY(0, 0, 0), Radius=dome_radius)
# 2b
# 2
squads = SkewedQuads(Surface=sph, UDivisions=Slider(12, range=5..50), VDivisions=Slider(10, range=5..50), TParameter=0)  # -> FullPanels, EdgePanels
# 2c
join = BrepJoin(Breps=squads.FullPanels)  # -> Breps, Closed

# ----
# 3a
sdiff = SolidDifference(BrepsA=join.Breps, BrepsB=extr)
# 3
# 3b
debrep = DeconstructBrep(Brep=sdiff)  # -> Faces, Edges, Vertices
# 3c
mp = MultiPipe(
    Curves=debrep.Edges,
    NodeSize=Slider(0.06, range=0..0.1),
    EndOffset=1,
    StrutSize=1,
    Segment=0,
    KinkAngle=0.6,
    CubeFit=0,
    Caps=0)
