# Grasshopper definition Figure7-3_7-4_wireframe_beehive_dome.gh (Grasshopper 1.0.9)

# ----
# Wireframe Beehive Dome
dome_radius = Slider(9.57, range=1..15)
# 1a
neg = Negative(Value=dome_radius)
# 1f
Z = UnitZ(Factor=neg)
# 1b
dom = ConstructDomain(DomainStart=neg, DomainEnd=dome_radius)
# 1
# 1c
rectangle = Rectangle(Plane=PlaneXY(0, 0, 0), XSize=dom, YSize=dom, Radius=0)  # -> Rectangle, Length
# 1d
boundary = BoundarySurfaces(Edges=rectangle.Rectangle)
# 1e
extr = Extrude(Base=boundary, Direction=Z)

# ----
# 2a
sph = Sphere(Base=PlaneXY(0, 0, 0), Radius=dome_radius)
# 2b
sdiff = SolidDifference(BrepsA=sph, BrepsB=extr)
# 2c
debrep = DeconstructBrep(Brep=sdiff)  # -> Faces, Edges, Vertices
# 2
# 2d
item = ListItem(List=debrep.Faces, Index=0, Wrap=True)

number_slider = Slider(20, range=1..100)
# 3a
hexgrid = Hexagonal(Plane=PlaneXY(0, 0, 0), Size=Slider(1, range=1..20), ExtentX=number_slider, ExtentY=number_slider)  # -> Cells, Points
# 3b
bbox = BoundingBox(Content=flatten(hexgrid.Cells), Plane=PlaneXY(0, 0, 0), UnionBox=True)  # -> Box, Box_2
# 3c
# 3
boxprop = BoxProperties(Box=bbox.Box)  # -> Center, Diagonal, Area, Volume, Degeneracy
# 3d
subtraction = Subtraction(A="{0,0,0}", B=boxprop.Center)
# 3e
move = Move(Geometry=hexgrid.Cells, Motion=subtraction)  # -> Geometry, Transform
# 3f
project = ProjectCurve(Curve=move.Geometry, Brep=item, Direction=Vector(0, 0, 1))
# 3g
mp = MultiPipe(
    Curves=project,
    NodeSize=Slider(0.05, range=0.01..1),
    EndOffset=1,
    StrutSize=1,
    Segment=0,
    KinkAngle=0.6,
    CubeFit=0,
    Caps=0)
