# Grasshopper definition Figure7-5_7-6_wireframe_floral_tower.gh (Grasshopper 1.0.9)

R = Slider(9.57, range=1..15)
# Wireframe Floral Tower
number_slider = Slider(8, range=0..100)
# 1a
cir = Circle(Plane=PlaneXY(0, 0, 0), Radius=R)
# 1b
divide = DivideCurve(Curve=cir, Count=number_slider, Kinks=False)  # -> Points, Tangents, Parameters
# 1c
pline = PolyLine(Vertices=divide.Points, Closed=cir)
# 1
# 1d
edges = BrepEdges(Brep=pline)  # -> Naked, Interior, NonManifold
# 1e
end = EndPoints(Curve=edges.Naked)  # -> Start, End
# 1f
area = Area(Geometry=cir)  # -> Area, Centroid
Z = UnitZ(Factor=Slider(20, range=0.5..100))
# 1g
move = Move(Geometry=area.Centroid, Motion=Z)  # -> Geometry, Transform
# 1h
ln = Line(StartPoint=move.Geometry, EndPoint=end.Start)

# ----
# 2
t = Slider(0.6, range=0..1)
eval = EvaluateCurve(Curve=reparameterize(edges.Naked), Parameter=t)  # -> Point, Tangent, Angle
# 2b
ln_2 = Line(StartPoint=move.Geometry, EndPoint=eval.Point)

# ----
# 2a
number_slider_2 = Slider(0.4, range=0..1)
# 3c
# 3d
multiplication = Multiplication(A=number_slider_2, B=R)
# 3b
xy = XYPlane(Origin=move.Geometry)
# 3
# 3a
maelstrom = Maelstrom(Geometry=[ln, ln_2], Plane=xy, First=multiplication, Second=R, Angle=1.570796327, Rigid=False)
# 3e
mirror = Mirror(Geometry=maelstrom, Plane=PlaneYZ(0, 0, 0))  # -> Geometry, Transform
# 3f
crv = Curve([maelstrom, mirror.Geometry])
