# Grasshopper definition Figure7-7_quad_wireframe_from_mesh.gh (Grasshopper 1.0.9)

qrsettings = QuadRemeshSettings(TargetCount=1000, AdaptiveSize=0, AdaptiveCount=False, HardEdges=False, SeamEdges=0, Symmetry=0, GuideCurves=0)
# Quad Wireframe from Mesh
# a
# c
mesh = Mesh(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)
# b
qrmesh = QuadRemesh(Geometry=mesh, Settings=qrsettings)
# d
mp = MultiPipe(
    Curves=qrmesh,
    NodeSize=Slider(0.5, range=0.01..1),
    EndOffset=1,
    StrutSize=1,
    Segment=0,
    KinkAngle=0.6,
    CubeFit=0,
    Caps=0)
