# Grasshopper definition Figure8-17_8-18_double_twisted_weave.gh (Grasshopper 1.0.9)

# ----
# 1
# 1a
number_slider = Slider(6, range=1..10)
# Double Twisted Weave from Rec Grid
number_slider_2 = Slider(2, range=0..10)
recgrid = Rectangular(
    Plane=PlaneXY(0, 0, 0),
    SizeX=number_slider_2,
    SizeY=number_slider_2,
    ExtentX=number_slider,
    ExtentY=Slider(3, range=1..10))  # -> simplify(Cells), Points

# ----
# 3b
# 3a
# 3
number_slider_3 = Slider(0.3, range=0..10)
Z = UnitZ(Factor=number_slider_3)
move = Move(Geometry=recgrid.Cells, Motion=Z)  # -> Geometry, Transform
debrep = DeconstructBrep(Brep=move.Geometry)  # -> Faces, Edges, simplify(Vertices)

# ----
# 2
# 2b
# 2a
debrep_2 = DeconstructBrep(Brep=recgrid.Cells)  # -> Faces, Edges, simplify(Vertices)
viewer = ParamViewer(debrep_2.Vertices)

py3 = Python3Script(verts_l=debrep_2.Vertices, verts_u=debrep.Vertices, t=Slider(0.6, range=0..1))  # -> weaved_edges; inputs verts_l: tree of Point3d, verts_u: tree of Point3d, t: Double
# ---------- py3: Python ----------
__author__ = "isabel"
__version__ = "2026.02.25"

import ghpythonlib.components as ghc

paths_l, length_l, count_l = ghc.TreeStatistics(verts_l)
paths_u, length_u, count_u = ghc.TreeStatistics(verts_u)

def eval_edges(path, tree, t):
    b = ghc.TreeBranch(tree, path)
    shifted_b = ghc.ShiftList(list=b, shift=1, wrap=True)
    edges = ghc.Line(b, shifted_b)
    eval_pts, _, _ = ghc.EvaluateCurve(edges, t)
    return eval_pts

weaved_edges = []
for pl, pu in zip(paths_l, paths_u):
    pts_l = eval_edges(pl, verts_l, t)
    pts_u = eval_edges(pu, verts_u, t)
    shifted_pts_u = ghc.ShiftList(list=pts_u, shift=1, wrap=True)
    weaved_edges.extend(ghc.Line(pts_l, shifted_pts_u))
# ---------- end py3 ----------

# ----
# 4a1
# 4b
# 4c
# 4
number_slider_4 = Slider(0.4, range=0..1)
# 4a2
number_slider_5 = Slider(0.08, range=0..2)

py3_2 = Python3Script(verts_l=debrep_2.Vertices, verts_u=debrep.Vertices, t=number_slider_4)  # -> weaved_edges; inputs verts_l: tree of Point3d, verts_u: tree of Point3d, t: Double; same code as py3

smoothpline = SmoothPolyline(Polyline=[py3, py3_2], Strength=1, Times=1)
# Python 3 Script node
# Access and Type Hints:
# 
# inputs:
# verts_l -> Tree, Point3d
# verts_u -> Tree, Point3d
# t -> Item, float
# 
# outputs:
# weaved_edges -> Line
mp = MultiPipe(
    Curves=flatten(smoothpline),
    NodeSize=number_slider_5,
    EndOffset=1,
    StrutSize=1,
    Segment=0,
    KinkAngle=Slider(0.1, range=0.1..1),
    CubeFit=0,
    Caps="1")
