# Grasshopper definition Figure8-19_to_8-21_triaxial_weave_from_tri_grids.gh (Grasshopper 1.0.9)

# ----
# 1
# 1a
number_slider = Slider(22, range=0..100)
# Triaxial Weave (Hex Weave) from Triangular Grid
number_slider_2 = Slider(2, range=0..10)
trigrid = Triangular(Plane=PlaneXY(0, 0, 0), Size=number_slider_2, ExtentX=number_slider, ExtentY=Slider(7, range=0..100))  # -> Cells, Points

panel = Panel("""Right-click t
-> Set Number
-> 0.5""")

# ----
# 3a
# 3
number_slider_3 = Slider(0.7, range=0..10)
Z = UnitZ(Factor=number_slider_3)
move = Move(Geometry=trigrid.Cells, Motion=Z)  # -> Geometry, Transform
# 3b
debrep = DeconstructBrep(Brep=move.Geometry)  # -> Faces, Edges, Vertices
item = ListItem(List=debrep.Vertices, Index=0, Wrap=True)  # -> Item, Item1, Item2

# ---- group: AB
ln = Line(StartPoint=item.Item, EndPoint=item.Item1)

# ---- group: BC
ln_2 = Line(StartPoint=item.Item1, EndPoint=item.Item2)

# ---- group: CD
ln_3 = Line(StartPoint=item.Item2, EndPoint=item.Item)

# ----
eval = EvaluateCurve(Curve=ln, Parameter=0.5)  # -> Point, Tangent, Angle
eval_2 = EvaluateCurve(Curve=ln_2, Parameter=0.5)  # -> Point, Tangent, Angle
eval_3 = EvaluateCurve(Curve=ln_3, Parameter=0.5)  # -> Point, Tangent, Angle

# ----
# 2
# 2d1
# 2c1
# 2d2
# 2c2
# 2b
# 2a
# 2d3
# 2c3
debrep_2 = DeconstructBrep(Brep=trigrid.Cells)  # -> Faces, Edges, Vertices
item_2 = ListItem(List=debrep_2.Vertices, Index=0, Wrap=True)  # -> Item, Item1, Item2

# ---- group: AB
ln_4 = Line(StartPoint=item_2.Item, EndPoint=item_2.Item1)

# ---- group: BC
ln_5 = Line(StartPoint=item_2.Item1, EndPoint=item_2.Item2)

# ---- group: CD
ln_6 = Line(StartPoint=item_2.Item2, EndPoint=item_2.Item)

# ----
eval_4 = EvaluateCurve(Curve=ln_4, Parameter=0.5)  # -> Point, Tangent, Angle
eval_5 = EvaluateCurve(Curve=ln_5, Parameter=0.5)  # -> Point, Tangent, Angle
eval_6 = EvaluateCurve(Curve=ln_6, Parameter=0.5)  # -> Point, Tangent, Angle

# ---- group: L0 U3
l_a_u_b = Line(StartPoint=eval_4.Point, EndPoint=eval_3.Point)

# ---- group: L1 U0
ln_7 = Line(StartPoint=eval_5.Point, EndPoint=eval.Point)

# ---- group: L2 U1
ln_8 = Line(StartPoint=eval_6.Point, EndPoint=eval_2.Point)

# ----
# 4a1
# 4
# 4a2
# 4b
# 4a3
# 4c
number_slider_4 = Slider(0.1, range=0.1..1)
smoothpline = SmoothPolyline(Polyline=[l_a_u_b, ln_7, ln_8], Strength=1, Times=1)
mp = MultiPipe(
    Curves=flatten(smoothpline),
    NodeSize=Slider(0.2, range=0.1..2),
    EndOffset=1,
    StrutSize=1,
    Segment=0,
    KinkAngle=number_slider_4,
    CubeFit=0,
    Caps="1")
