# Grasshopper definition Figure8-1_to_8-8_basket_weave_from_rec_grids.gh (Grasshopper 1.0.9)

# ----
# 1
# 1a
number_slider = Slider(2, range=0..10)
# Basket Weave from Rectangular Grid
recgrid = Rectangular(Plane=PlaneXY(0, 0, 0), SizeX=number_slider, SizeY=number_slider, ExtentX=10, ExtentY=5)  # -> simplify(Cells), Points

panel = Panel("""Right-click t
-> Set Number
-> 0.5""")

# ----
# 3a
# 3
number_slider_2 = Slider(0.7, range=0..10)
Z = UnitZ(Factor=number_slider_2)
move = Move(Geometry=recgrid.Cells, Motion=Z)  # -> Geometry, Transform
# 3b
debrep = DeconstructBrep(Brep=move.Geometry)  # -> Faces, Edges, Vertices
# 3c
item = ListItem(List=debrep.Vertices, Index=0, Wrap=True)  # -> Item, Item1, Item2, Item3

# ---- group: AB
ln = Line(StartPoint=item.Item, EndPoint=item.Item1)

# ---- group: BC
ln_2 = Line(StartPoint=item.Item1, EndPoint=item.Item2)

# ---- group: CD
ln_3 = Line(StartPoint=item.Item2, EndPoint=item.Item3)

# ---- group: DA
ln_4 = Line(StartPoint=item.Item3, EndPoint=item.Item)

# ----
eval = EvaluateCurve(Curve=ln, Parameter=0.5)  # -> Point, Tangent, Angle
eval_2 = EvaluateCurve(Curve=ln_2, Parameter=0.5)  # -> Point, Tangent, Angle
eval_3 = EvaluateCurve(Curve=ln_3, Parameter=0.5)  # -> Point, Tangent, Angle
eval_4 = EvaluateCurve(Curve=ln_4, Parameter=0.5)  # -> Point, Tangent, Angle

# ----
# 2
# 2d1
# 2c1
# 2d2
# 2c2
# 2b
# 2a
# 2d3
# 2c3
# 2d4
# 2c4
debrep_2 = DeconstructBrep(Brep=recgrid.Cells)  # -> Faces, Edges, Vertices
item_2 = ListItem(List=debrep_2.Vertices, Index=0, Wrap=True)  # -> Item, Item1, Item2, Item3

# ---- group: AB
ln_5 = Line(StartPoint=item_2.Item, EndPoint=item_2.Item1)

# ---- group: BC
ln_6 = Line(StartPoint=item_2.Item1, EndPoint=item_2.Item2)

# ---- group: CD
ln_7 = Line(StartPoint=item_2.Item2, EndPoint=item_2.Item3)

# ---- group: DA
ln_8 = Line(StartPoint=item_2.Item3, EndPoint=item_2.Item)

# ----
eval_5 = EvaluateCurve(Curve=ln_5, Parameter=0.5)  # -> Point, Tangent, Angle
eval_6 = EvaluateCurve(Curve=ln_6, Parameter=0.5)  # -> Point, Tangent, Angle
eval_7 = EvaluateCurve(Curve=ln_7, Parameter=0.5)  # -> Point, Tangent, Angle
eval_8 = EvaluateCurve(Curve=ln_8, Parameter=0.5)  # -> Point, Tangent, Angle

# ---- group: L3 U2
ln_9 = Line(StartPoint=eval_8.Point, EndPoint=eval_3.Point)

# ---- group: L0 U3
l_a_u_b = Line(StartPoint=eval_5.Point, EndPoint=eval_4.Point)

# ---- group: L1 U0
ln_10 = Line(StartPoint=eval_6.Point, EndPoint=eval.Point)

# ---- group: L2 U1
ln_11 = Line(StartPoint=eval_7.Point, EndPoint=eval_2.Point)

# ----
# 4a1
# 4
# 4a2
# 4b
# 4a3
# 4c
# 4a4
number_slider_3 = Slider(0.1, range=0.1..1)
smoothpline = SmoothPolyline(Polyline=[l_a_u_b, ln_10, ln_11, ln_9], Strength=1, Times=1)
mp = MultiPipe(
    Curves=flatten(smoothpline),
    NodeSize=Slider(0.2, range=0.1..2),
    EndOffset=1,
    StrutSize=1,
    Segment=0,
    KinkAngle=number_slider_3,
    CubeFit=0,
    Caps=0)
