# Grasshopper definition Figure8-23_to_8-25_triaxial_bunny_weave.gh (Grasshopper 1.0.9)
# plug-ins: Weaverbird

# ----
# Triaxial Weave - Tri Mesh
# 1
# 1a
# 1b
# 1c
number_slider = Slider(300, range=0..1000)
qrsettings = QuadRemeshSettings(TargetCount=number_slider, AdaptiveSize=0, AdaptiveCount=False, HardEdges=False, SeamEdges=0, Symmetry=0, GuideCurves=0)
mesh = Mesh(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)
qrmesh = QuadRemesh(Geometry=mesh, Settings=qrsettings)
# 1d
triremesh = TriRemesh(Geometry=qrmesh, Length=Slider(6, range=1..100), Iterations=25)  # -> Triangulation, Dual, Creases

panel = Panel("""Right-click t
-> Set Number
-> 0.5""")

# ----
# 3a
# 3
number_slider_2 = Slider(1.5, range=0..3)
wboffset = WeaverbirdsOffsetMesh(MeshCurves=triremesh.Triangulation, Distance=number_slider_2, OffsetType=0)
demesh = DeconstructMesh(Mesh=wboffset)  # -> Vertices, Faces, Colours, Normals
deface = DeconstructFace(Face=demesh.Faces)  # -> CornerA, CornerB, CornerC, CornerD
item = ListItem(List=demesh.Vertices, Index=deface.CornerA, Wrap=True)
item_2 = ListItem(List=demesh.Vertices, Index=deface.CornerB, Wrap=True)
item_3 = ListItem(List=demesh.Vertices, Index=deface.CornerC, Wrap=True)

# ---- group: AB
ln = Line(StartPoint=item, EndPoint=item_2)

# ---- group: BC
ln_2 = Line(StartPoint=item_2, EndPoint=item_3)

# ---- group: CD
ln_3 = Line(StartPoint=item_3, EndPoint=item)

# ----
eval = EvaluateCurve(Curve=ln, Parameter=0.5)  # -> Point, Tangent, Angle
eval_2 = EvaluateCurve(Curve=ln_2, Parameter=0.5)  # -> Point, Tangent, Angle
eval_3 = EvaluateCurve(Curve=ln_3, Parameter=0.5)  # -> Point, Tangent, Angle

# ----
# 2
# 2e1
# 2d1
# 2c1
# 2a
# 2e2
# 2d2
# 2c2
# 2b
# 2e3
# 2c3
# 2d3
# 2c4
demesh_2 = DeconstructMesh(Mesh=triremesh.Triangulation)  # -> Vertices, Faces, Colours, Normals
deface_2 = DeconstructFace(Face=demesh_2.Faces)  # -> CornerA, CornerB, CornerC, CornerD
item_4 = ListItem(List=demesh_2.Vertices, Index=deface_2.CornerA, Wrap=True)
item_5 = ListItem(List=demesh_2.Vertices, Index=deface_2.CornerB, Wrap=True)
item_6 = ListItem(List=demesh_2.Vertices, Index=deface_2.CornerC, Wrap=True)

# ---- group: AB
ln_4 = Line(StartPoint=item_4, EndPoint=item_5)

# ---- group: BC
ln_5 = Line(StartPoint=item_5, EndPoint=item_6)

# ---- group: CA
ln_6 = Line(StartPoint=item_6, EndPoint=item_4)

# ----
eval_4 = EvaluateCurve(Curve=ln_4, Parameter=0.5)  # -> Point, Tangent, Angle
eval_5 = EvaluateCurve(Curve=ln_5, Parameter=0.5)  # -> Point, Tangent, Angle
eval_6 = EvaluateCurve(Curve=ln_6, Parameter=0.5)  # -> Point, Tangent, Angle

# ---- group: L0 U2
l_a_u_b = Line(StartPoint=eval_4.Point, EndPoint=eval_3.Point)

# ---- group: L1 U0
ln_7 = Line(StartPoint=eval_5.Point, EndPoint=eval.Point)

# ---- group: L2 U1
ln_8 = Line(StartPoint=eval_6.Point, EndPoint=eval_2.Point)

# ----
# 4a1
# 4
# 4a2
# 4b
# 4a3
# 4c
number_slider_3 = Slider(0.1, range=0.1..1)
smoothpline = SmoothPolyline(Polyline=[l_a_u_b, ln_7, ln_8], Strength=1, Times=1)
mp = MultiPipe(
    Curves=flatten(smoothpline),
    NodeSize=Slider(0.5, range=0.1..2),
    EndOffset=1,
    StrutSize=1,
    Segment=0,
    KinkAngle=number_slider_3,
    CubeFit=0,
    Caps=0)
