# Grasshopper definition Figure9-10_to_9-11_SlicingAtTwoAngles.gh (Grasshopper 1.0.9)

# ---- group: Bunny
# 1a
mesh = Mesh(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)

# ----
# 1b
bbox = BoundingBox(Content=mesh, Plane=PlaneXY(0, 0, 0))  # -> Box, Box_2
# 1c
debox = DeconstructBox(Box=bbox.Box)  # -> Plane, X, Y, Z
# 1d
dedomain = DeconstructDomain(Domain=[debox.X, debox.Y, debox.Z])  # -> Start, End
# 1
# 1e
subtraction = Subtraction(A=dedomain.End, B=dedomain.Start)
# 1f
sqr = Square(Value=subtraction)
# 1g
ma = MassAddition(Input=sqr)  # -> Result, PartialResults
# 1h
sqrt = SquareRoot(Value=ma.Result)
# 1i
multiplication = Multiplication(A="0.5", B=sqrt)

slice_distance = Slider(8, range=1..50)
# 2a
area = Area(Geometry=bbox.Box)  # -> Area, Centroid
# 2b
# 2f
pdecon = Deconstruct(Point=area.Centroid)  # -> XComponent, YComponent, ZComponent
# 2g
division = Division(A=sqrt, B=slice_distance)
# 2h
round = Round(Number=division)  # -> Nearest, Floor, Ceiling
# 2c
subtraction_2 = Subtraction(A=pdecon.ZComponent, B=multiplication)
Z = UnitZ(Factor=slice_distance)
# 2
# 2d
Z_2 = UnitZ(Factor=subtraction_2)
# 2e
xy = XYPlane(Origin=Z_2)
# 2i
arrlinear = LinearArray(Geometry=xy, Direction=Z, Count=round.Floor)  # -> Geometry, Transform

# ----
# 2a
# 2b4
Y = UnitY(Factor=1)
# 2b
panel = Panel("0.5")
# 2i
# 2b3
pi = Pi(Factor=Slider(0.25, range=0..20))
pi_2 = Pi(Factor=panel)
# 2b5
addition = Addition(A=pi, B=pi_2)
# 2b1
rot3d = Rotate3D(Geometry=arrlinear.Geometry, Angle=pi, Center=area.Centroid, Axis=Y)  # -> Geometry, Transform
# 2b2
rot3d_2 = Rotate3D(Geometry=arrlinear.Geometry, Angle=addition, Center=area.Centroid, Axis=Y)  # -> Geometry, Transform

# ----
# 3a
sec = MeshPlane(Mesh=mesh, Plane=[rot3d.Geometry, rot3d_2.Geometry])  # -> flatten(Curves)
# Forming Slices
# 3b
cls = Closed(Curve=sec)  # -> Closed, Periodic
# 3c
# 3
dispatch = Dispatch(List=sec, DispatchPattern=cls.Closed)  # -> ListA, ListB
# Extruding Slices
# 3d
boundary = BoundarySurfaces(Edges=dispatch.ListA)

# ----
# 4b
panel_2 = Panel("{0.5,0.5,0}")
# for Thinkness
# 4a
evalsrf = EvaluateSurface(Surface=boundary, Point=panel_2)  # -> Point, Normal, UDirection, VDirection, Frame
# 4c
# 4
amp = Amplitude(Vector=evalsrf.Normal, Amplitude=Slider(1, range=0.1..10))
# 4d
extr = Extrude(Base=boundary, Direction=amp)
