# Grasshopper definition Figure9-18_to_9-19_Sliceform_SphereBrep_Hollow.gh (Grasshopper 1.0.9)

# ----
# 0-Brep
# 0a
sph = Sphere(Base=PlaneXY(0, 0, 0), Radius=Slider(60, range=1..100))
# 0c
scale = Scale(Geometry=sph, Center=Point(0, 0, 0), Factor=Slider(0.8, range=0..1))  # -> Geometry, Transform
# 0b
mesh = MeshBrep(
    Brep=sph,
    Settings={GridMaxCount=0, GridMinCount=16, JaggedSeams=False, MaxEdgeLength=0, MinEdgeLength=0.0001, MinTolerance=0, Refine=True, RefineAngle=0, RelativeTolerance=0.65, SimplePlanes=True, Tolerance=0})
# 0d
mesh_2 = MeshBrep(
    Brep=scale.Geometry,
    Settings={GridMaxCount=0, GridMinCount=16, JaggedSeams=False, MaxEdgeLength=0, MinEdgeLength=0.0001, MinTolerance=0, Refine=True, RefineAngle=0, RelativeTolerance=0.65, SimplePlanes=True, Tolerance=0})
# 0e
mdif = MeshDifference(MeshesA=mesh, MeshesB=mesh_2)

# ----
# 1b
bbox = BoundingBox(Content=mdif, Plane=PlaneXY(0, 0, 0))  # -> Box, Box_2
# 1c
debox = DeconstructBox(Box=bbox.Box)  # -> Plane, X, Y, Z
# 1d
dedomain = DeconstructDomain(Domain=[debox.X, debox.Y, debox.Z])  # -> Start, End
# 1e
subtraction = Subtraction(A=dedomain.End, B=dedomain.Start)
# 1
# 1f
sqr = Square(Value=subtraction)
# 1g
ma = MassAddition(Input=sqr)  # -> Result, PartialResults
# 1h
sqrt = SquareRoot(Value=ma.Result)
# 1i
multiplication = Multiplication(A="0.5", B=sqrt)

# ----
# 1b
bbox_2 = BoundingBox(Content=mdif, Plane=PlaneXY(0, 0, 0))  # -> Box, Box_2
# 1c
debox_2 = DeconstructBox(Box=bbox_2.Box)  # -> Plane, X, Y, Z
# 1d
dedomain_2 = DeconstructDomain(Domain=[debox_2.X, debox_2.Y, debox_2.Z])  # -> Start, End
# 1
# 1e
subtraction_2 = Subtraction(A=dedomain_2.End, B=dedomain_2.Start)
# 1f
sqr_2 = Square(Value=subtraction_2)
# 1g
ma_2 = MassAddition(Input=sqr_2)  # -> Result, PartialResults
# 1h
sqrt_2 = SquareRoot(Value=ma_2.Result)
# 1i
multiplication_2 = Multiplication(A="0.5", B=sqrt_2)

# ----
# 1b
bbox_3 = BoundingBox(Content=mdif, Plane=PlaneXY(0, 0, 0))  # -> Box, Box_2
# 1c
debox_3 = DeconstructBox(Box=bbox_3.Box)  # -> Plane, X, Y, Z
# 1d
dedomain_3 = DeconstructDomain(Domain=[debox_3.X, debox_3.Y, debox_3.Z])  # -> Start, End
# 1e
subtraction_3 = Subtraction(A=dedomain_3.End, B=dedomain_3.Start)
# 1
# 1f
sqr_3 = Square(Value=subtraction_3)
# 1g
ma_3 = MassAddition(Input=sqr_3)  # -> Result, PartialResults
# 1h
sqrt_3 = SquareRoot(Value=ma_3.Result)
# 1i
multiplication_3 = Multiplication(A="0.5", B=sqrt_3)

slice_distance = Slider(15, range=1..50)
# 2a
area = Area(Geometry=bbox.Box)  # -> Area, Centroid
# 2b
pdecon = Deconstruct(Point=area.Centroid)  # -> XComponent, YComponent, ZComponent
# 2g
# 2f
division = Division(A=sqrt, B=slice_distance)
# 2h
round = Round(Number=division)  # -> Nearest, Floor, Ceiling
# 2c
subtraction_4 = Subtraction(A=pdecon.ZComponent, B=multiplication)
Z = UnitZ(Factor=slice_distance)
# 2d
Z_2 = UnitZ(Factor=subtraction_4)
# 2
# 2e
xy = XYPlane(Origin=Z_2)
# 2i
arrlinear = LinearArray(Geometry=xy, Direction=Z, Count=round.Floor)  # -> Geometry, Transform

slice_distance_2 = Slider(12, range=1..50)
# 2a
area_2 = Area(Geometry=bbox_2.Box)  # -> Area, Centroid
# 2b
# 2f
pdecon_2 = Deconstruct(Point=area_2.Centroid)  # -> XComponent, YComponent, ZComponent
# 2g
division_2 = Division(A=sqrt_2, B=slice_distance_2)
# 2h
round_2 = Round(Number=division_2)  # -> Nearest, Floor, Ceiling
# 2c
subtraction_5 = Subtraction(A=pdecon_2.ZComponent, B=multiplication_2)
Z_3 = UnitZ(Factor=slice_distance_2)
# 2
# 2d
Z_4 = UnitZ(Factor=subtraction_5)
# 2e
xy_2 = XYPlane(Origin=Z_4)
# 2i
arrlinear_2 = LinearArray(Geometry=xy_2, Direction=Z_3, Count=round_2.Floor)  # -> Geometry, Transform

slice_distance_3 = Slider(9, range=1..50)
# 2a
area_3 = Area(Geometry=bbox_3.Box)  # -> Area, Centroid
# 2b
# 2f
pdecon_3 = Deconstruct(Point=area_3.Centroid)  # -> XComponent, YComponent, ZComponent
# 2g
division_3 = Division(A=sqrt_3, B=slice_distance_3)
# 2h
round_3 = Round(Number=division_3)  # -> Nearest, Floor, Ceiling
# 2c
subtraction_6 = Subtraction(A=pdecon_3.ZComponent, B=multiplication_3)
Z_5 = UnitZ(Factor=slice_distance_3)
# 2d
Z_6 = UnitZ(Factor=subtraction_6)
# 2
# 2e
xy_3 = XYPlane(Origin=Z_6)
# 2i
arrlinear_3 = LinearArray(Geometry=xy_3, Direction=Z_5, Count=round_3.Floor)  # -> Geometry, Transform

# ----
# 2a
# 2b4
Y = UnitY(Factor=1)
# 2b
panel = Panel("0.2")
# 2i
# 2b3
pi = Pi(Factor=Slider(0.6, range=0..20))
pi_2 = Pi(Factor=panel)
# 2b5
addition = Addition(A=pi, B=pi_2)
# 2b1
rot3d = Rotate3D(Geometry=arrlinear.Geometry, Angle=pi, Center=area.Centroid, Axis=Y)  # -> Geometry, Transform
# 2b2
rot3d_2 = Rotate3D(Geometry=arrlinear.Geometry, Angle=addition, Center=area.Centroid, Axis=Y)  # -> Geometry, Transform

# ----
# 2a
# 2b4
Y_2 = UnitY(Factor=1)
# 2b
panel_2 = Panel("0.5")
# 2i
# 2b3
pi_3 = Pi(Factor=Slider(0.25, range=0..20))
pi_4 = Pi(Factor=panel_2)
# 2b5
addition_2 = Addition(A=pi_3, B=pi_4)
# 2b1
rot3d_3 = Rotate3D(Geometry=arrlinear_2.Geometry, Angle=pi_3, Center=area_2.Centroid, Axis=Y_2)  # -> Geometry, Transform
# 2b2
rot3d_4 = Rotate3D(Geometry=arrlinear_2.Geometry, Angle=addition_2, Center=area_2.Centroid, Axis=Y_2)  # -> Geometry, Transform

# ----
# 2a
# 2b4
Y_3 = UnitY(Factor=1)
# 2b
panel_3 = Panel("0.5")
# 2i
# 2b3
pi_5 = Pi(Factor=Slider(0, range=0..20))
pi_6 = Pi(Factor=panel_3)
# 2b5
addition_3 = Addition(A=pi_5, B=pi_6)
# 2b1
rot3d_5 = Rotate3D(Geometry=arrlinear_3.Geometry, Angle=pi_5, Center=area_3.Centroid, Axis=Y_3)  # -> Geometry, Transform
# 2b2
rot3d_6 = Rotate3D(Geometry=arrlinear_3.Geometry, Angle=addition_3, Center=area_3.Centroid, Axis=Y_3)  # -> Geometry, Transform

# ----
# 3a
sec = MeshPlane(Mesh=mdif, Plane=[rot3d.Geometry, rot3d_2.Geometry])  # -> flatten(Curves)
# Forming Slices
# 3b
cls = Closed(Curve=sec)  # -> Closed, Periodic
# 3c
# 3
dispatch = Dispatch(List=sec, DispatchPattern=cls.Closed)  # -> ListA, ListB
# Extruding Slices
# 3d
boundary = BoundarySurfaces(Edges=dispatch.ListA)

# ----
# 3a
sec_2 = MeshPlane(Mesh=mdif, Plane=[rot3d_3.Geometry, rot3d_4.Geometry])  # -> flatten(Curves)
# Forming Slices
# 3b
cls_2 = Closed(Curve=sec_2)  # -> Closed, Periodic
# 3c
# 3
dispatch_2 = Dispatch(List=sec_2, DispatchPattern=cls_2.Closed)  # -> ListA, ListB
# Extruding Slices
# 3d
boundary_2 = BoundarySurfaces(Edges=dispatch_2.ListA)

# ----
# 3a
sec_3 = MeshPlane(Mesh=mdif, Plane=[rot3d_5.Geometry, rot3d_6.Geometry])  # -> flatten(Curves)
# Forming Slices
# 3b
cls_3 = Closed(Curve=sec_3)  # -> Closed, Periodic
# 3c
# 3
dispatch_3 = Dispatch(List=sec_3, DispatchPattern=cls_3.Closed)  # -> ListA, ListB
# Extruding Slices
# 3d
boundary_3 = BoundarySurfaces(Edges=dispatch_3.ListA)

# ----
# 4b
panel_4 = Panel("{0.5,0.5,0}")
# for Thinkness
# 4a
evalsrf = EvaluateSurface(Surface=boundary, Point=panel_4)  # -> Point, Normal, UDirection, VDirection, Frame
# 4c
# 4
amp = Amplitude(Vector=evalsrf.Normal, Amplitude=1)
# 4d
extr = Extrude(Base=boundary, Direction=amp)

# ----
# 4b
panel_5 = Panel("{0.5,0.5,0}")
# for Thinkness
# 4a
evalsrf_2 = EvaluateSurface(Surface=boundary_2, Point=panel_5)  # -> Point, Normal, UDirection, VDirection, Frame
# 4c
# 4
amp_2 = Amplitude(Vector=evalsrf_2.Normal, Amplitude=1)
# 4d
extr_2 = Extrude(Base=boundary_2, Direction=amp_2)

# ----
# 4b
panel_6 = Panel("{0.5,0.5,0}")
# for Thinkness
# 4a
evalsrf_3 = EvaluateSurface(Surface=boundary_3, Point=panel_6)  # -> Point, Normal, UDirection, VDirection, Frame
# 4c
# 4
amp_3 = Amplitude(Vector=evalsrf_3.Normal, Amplitude=1)
# 4d
extr_3 = Extrude(Base=boundary_3, Direction=amp_3)

vec = VectorXYZ(XComponent=Slider(-10, range=-1000..0), YComponent=0, ZComponent=Slider(-120, range=-10000..100))  # -> Vector, Length
move = Move(Geometry=extr_2, Motion=vec.Vector)  # -> Geometry, Transform
X = UnitX(Factor=Slider(60, range=0..10000))
move_2 = Move(Geometry=extr_3, Motion=X)  # -> Geometry, Transform
vec_2 = VectorXYZ(XComponent=Slider(-60, range=-10000..100), YComponent=Slider(-35, range=-500..500), ZComponent=0)  # -> Vector, Length
move_3 = Move(Geometry=extr, Motion=vec_2.Vector)  # -> Geometry, Transform
geo = Geometry([move.Geometry, move_2.Geometry, move_3.Geometry])
