# Grasshopper definition Figure9-22_to_9-23_SpiralRibbons-Polygonal.gh (Grasshopper 1.0.9)

# ----
# Spiral Ribbons - Polygonal
number_slider = Slider(3, range=1..100)
# 1a
polygon = Polygon(Plane=PlaneXY(0, 0, 0), Radius=number_slider, Segments=Slider(4, range=3..20), FilletRadius=0)  # -> Polygon, Length
# 1e
pt = ConstructPoint(XCoordinate=0, YCoordinate=0, ZCoordinate=0)
# 1f
X = UnitX(Factor=1)
# 1b
scale = Scale(Geometry=polygon.Polygon, Center=Point(0, 0, 0), Factor=Slider(1.25, range=0..10))  # -> Geometry, Transform
# 1d
line = LineSDL(Start=pt, Direction=X, Length=1)
# 1i
toggle = BooleanToggle(True)
# 1c
boundary = BoundarySurfaces(Edges=[scale.Geometry, polygon.Polygon])
# 1h
pi = Pi(Factor=Slider(2, range=0..2))
# 1g
twist = Twist(Geometry=boundary, Axis=line, Angle=pi, Infinite=toggle, Rigid=False)
# 1j
rotate = Rotate(Geometry=twist, Angle=1.570796327, Plane=PlaneXY(0, 0, 0))  # -> Geometry, Transform
# 1k
srf = Surface([twist, rotate.Geometry])
