# Grasshopper definition Figure9-3_ComputingBoundingRadius.gh (Grasshopper 1.0.9)

# ---- group: Bunny
# Computing Bounding Radius
# 1a
mesh = Mesh(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)

# ----
# 1b
bbox = BoundingBox(Content=mesh, Plane=PlaneXY(0, 0, 0))  # -> Box, Box_2
# 1c
debox = DeconstructBox(Box=bbox.Box)  # -> Plane, X, Y, Z
# 1d
dedomain = DeconstructDomain(Domain=[debox.X, debox.Y, debox.Z])  # -> Start, End
# 1
# 1e
subtraction = Subtraction(A=dedomain.End, B=dedomain.Start)
# 1f
sqr = Square(Value=subtraction)
# 1g
ma = MassAddition(Input=sqr)  # -> Result, PartialResults
# 1h
sqrt = SquareRoot(Value=ma.Result)
# 1i
multiplication = Multiplication(A="0.5", B=sqrt)
